# Dynamo graph ABG_190324_FamilySharedParameters.dyn "Home2" (Dynamo 2.0.2.6826)

# group: Inputs
excel_file_path = Filename("C:\Users\GavinC\Desktop\Demo\190323_ABG Demo Excel - Dynamo Parameter Push.xlsx")  # graph input
sheet_name = StringInput("Parameters")  # graph input
rows_to_ignore_from_top_in_excel = IntegerSlider(1, range=0..10 step 1)  # graph input

# group: Get Excel Data
file_from_path = FileObject(path=excel_file_path)
boolean = BoolSelector(true)
boolean_2 = BoolSelector(false)
importExcel = Data.ImportExcel(file=file_from_path, sheetName=sheet_name, readAsStrings=boolean, showExcel=boolean_2)
dropItems = List.DropItems(list=importExcel, amount=rows_to_ignore_from_top_in_excel)
transpose = List.Transpose(lists=dropItems)

# group: Shared Parameter info
code_block = CodeBlock { 0; }
par_name = List.GetItemAtIndex(list=transpose, index=code_block)
code_block_2 = CodeBlock { 1; }
par_group = List.GetItemAtIndex(list=transpose, index=code_block_2)

# group: Parameter Group (native)
parameter_groups = ParameterGroupUi(index=52)
parameter_groups_2 = ParameterGroupUi(index=105)
parameter_groups_3 = ParameterGroupUi(index=26)
list_create = List.Create(item0=parameter_groups, item1=parameter_groups_2, item2=parameter_groups_3)
string_from_object = FromObject(obj=list_create)
code_block_3 = CodeBlock { 2; }
getItemAtIndex = List.GetItemAtIndex(list=transpose, index=code_block_3)
indexOf = List.IndexOf(list=string_from_object, element=getItemAtIndex)
PG = List.GetItemAtIndex(list=list_create, index=indexOf)

# group: Is Type to boolean
code_block_4 = CodeBlock { 3; }
getItemAtIndex_2 = List.GetItemAtIndex(list=transpose, index=code_block_4)
string = StringInput("Y")
type = getItemAtIndex_2 == string

# group: Output
addSharedParamsToFamily = RBG_VSNodes.Document.AddSharedParamsToFamily(SPParameterName=par_name, SPGroupName=par_group, BuiltInPG=PG, IsInstance=type)

what_has_happened_to_the_family = Watch(addSharedParamsToFamily)  # graph output
