# Dynamo graph ABG_190331_KineticFacade-Angle.dyn "Solar by actor - planar" (Dynamo 2.0.2.6826)

# group: Curtain panels
categories = Categories(index=141)
all_elements_of_category = ElementsOfCategory(Category=categories)
geometry = Element.Geometry(element=all_elements_of_category)
byGeometry = BoundingBox.ByGeometry(geom=geometry)
# note: Clockwork
properties = Custom[BoundingBox.Properties](boundingBox=byGeometry)  # Retrieves the centroid, width, depth and height of a given bounding box

string = StringInput("Open factor")

# group: Inputs
sun = DSModelElementSelection()  # 1 picked in the model; graph input
surface = DSFaceSelection()  # 1 picked in the model; graph input

# group: Sun vectors
getLocation = Element.GetLocation(element=sun)
byTwoPoints = Vector.ByTwoPoints(start=properties.Centroid, end=getLocation, lacing=Longest)
X = Vector.X(vector=byTwoPoints)
Y = Vector.Y(vector=byTwoPoints)
code_block = CodeBlock { 0; }
byCoordinates = Vector.ByCoordinates(x=X, y=Y, z=code_block, lacing=Longest)

# group: Vectors
normalAtPoint = Surface.NormalAtPoint(surface=surface, point=properties.Centroid, lacing=Longest)

# group: Angles
angleWithVector = Vector.AngleWithVector(vector=byCoordinates, otherVector=normalAtPoint)

# group: Map to normalized range
maximumItem = List.MaximumItem(list=angleWithVector)
sub = maximumItem - angleWithVector
maximumItem_2 = List.MaximumItem(list=sub)
div = sub / maximumItem_2

# group: Process
stray_from_sun = CodeBlock(x=div) { x/2; }
follow_sun_inverted = CodeBlock { (1/2)-(x/2); }  # unwired: x

# group: Set factor
setParameterByName = Element.SetParameterByName(element=all_elements_of_category, parameterName=string, value=stray_from_sun)

# group: Sample lines
code_block_2 = CodeBlock { 3000; }
byStartPointDirectionLength = Line.ByStartPointDirectionLength(startPoint=properties.Centroid, direction=normalAtPoint, length=code_block_2)  # frozen
byStartPointDirectionLength_2 = Line.ByStartPointDirectionLength(startPoint=properties.Centroid, direction=byCoordinates, length=code_block_2)  # frozen

byCoordinates_2 = Vector.ByCoordinates()

# group: Map to 90 degree range
code_block_3 = CodeBlock { 90; }
div_2 = angleWithVector / code_block_3
