# Dynamo graph ABG_190331_KineticFacade-Distance.dyn "Solar by actor" (Dynamo 2.0.2.6826)

# group: Input
sun = DSModelElementSelection()  # 1 picked in the model

# group: Gather distances
categories = Categories(index=141)
all_elements_of_category = ElementsOfCategory(Category=categories)
getLocation = Element.GetLocation(element=all_elements_of_category)
getLocation_2 = Element.GetLocation(element=sun)
distanceTo = Geometry.DistanceTo(geometry=getLocation, other=getLocation_2, lacing=Longest)

# group: Normalize
maximumItem = List.MaximumItem(list=distanceTo)
sub = maximumItem - distanceTo
maximumItem_2 = List.MaximumItem(list=sub)
div = sub / maximumItem_2

# group: Process
follow_sun_inverted = CodeBlock(X=div) { (1/2)-(X/2); }
stray_from_sun = CodeBlock(X=div) { X/2; }

# group: Set parameter
string = StringInput("Open factor")
setParameterByName = Element.SetParameterByName(element=all_elements_of_category, parameterName=string, value=stray_from_sun)
