# Dynamo graph ABG_190331_KineticFacade-Image.dyn "Solar by image" (Dynamo 2.0.2.6826)

# group: Input
filename = Filename(".\CIR Mask.png")  # "Source..."; graph input
x_pixels = DoubleInput(15)  # graph input
y_pixels = DoubleInput(5)  # graph input

# group: Process image
file_from_path = FileObject(path=filename)
readFromFile = Image.ReadFromFile(file=file_from_path)
pixels = Image.Pixels(image=readFromFile, xSamples=x_pixels, ySamples=y_pixels)

# group: Input methods
by_brightness = Color.Brightness(c=pixels)
code_block = CodeBlock(x=x_pixels, y=y_pixels) { x*y; }
by_random = Math.RandomList(amount=code_block)

# group: Curtain Panels
categories = Categories(index=141)
all_elements_of_category = ElementsOfCategory(Category=categories)
getLocation = Element.GetLocation(element=all_elements_of_category)
Z = Point.Z(point=getLocation)

# group: Sort by Z, then X
sortListByAnother = archilab.Lists.Lists.SortListByAnother(list=all_elements_of_category, sortBy=Z)
chop = List.Chop(list=sortListByAnother.list, lengths=x_pixels)
sortListByAnother_2 = archilab.Lists.Lists.SortListByAnother(list=getLocation, sortBy=Z)
chop_2 = List.Chop(list=sortListByAnother_2.list, lengths=x_pixels)
X = Point.X(point=chop_2)
sortListByAnother_3 = archilab.Lists.Lists.SortListByAnother(list=chop, sortBy=X)
flatten = List.Flatten(list=sortListByAnother_3.list)

# group: Output methods
stray_from_sun = CodeBlock(x=by_random) { (1/2)-(x/2); }
follow_sun_invereted = CodeBlock { x/2; }  # unwired: x

# group: Set Parameter
string = StringInput("Open factor")
flatten_2 = List.Flatten(list=stray_from_sun)
setParameterByName = Element.SetParameterByName(element=flatten, parameterName=string, value=flatten_2)
