# Dynamo graph ABG_190331_KineticFacade-Lunchbox.dyn "Lunchbox" (Dynamo 2.0.2.6826)

select_face = DSFaceSelection()  # 1 picked in the model
integer_slider = IntegerSlider(5, range=3..10 step 1)
integer_slider_2 = IntegerSlider(3, range=3..10 step 1)
panelQuad = Geometry.Panel.PanelQuad(srf=select_face, u=integer_slider, v=integer_slider_2)
list_create = List.Create(item0=panelQuad.Points)
family_types = FamilyTypes(index=3)
byPoints = AdaptiveComponent.ByPoints(points=list_create, familyType=family_types)
select_face_2 = DSFaceSelection()  # 1 picked in the model
panelQuadStaggered = Geometry.Panel.PanelQuadStaggered(srf=select_face_2, u=integer_slider, v=integer_slider_2)
list_create_2 = List.Create(item0=panelQuadStaggered.Points)
byPoints_2 = AdaptiveComponent.ByPoints(points=list_create_2, familyType=family_types)
select_face_3 = DSFaceSelection()  # 1 picked in the model
panelTriangleB = Geometry.Panel.PanelTriangleB(srf=select_face_3, u=integer_slider, v=integer_slider_2)
list_create_3 = List.Create(item0=panelTriangleB.Points)
family_types_2 = FamilyTypes(index=8)
byPoints_3 = AdaptiveComponent.ByPoints(points=list_create_3, familyType=family_types_2)
