# Dynamo graph ABG_190331_ShortestPath.dyn "Pacman shortest path" (Dynamo 2.0.2.6826)

# group: Input
selection_walls_to_use_will_be = DSModelElementsSelection()  # "Selection (Walls to use will be filtered from this)"; 42 picked in the model; graph input

# group: Get Walls
getCategory = Element.GetCategory(element=selection_walls_to_use_will_be)
string_from_object = FromObject(obj=getCategory)
string = StringInput("Walls")
eq = string_from_object == string
filterByBoolMask = List.FilterByBoolMask(list=selection_walls_to_use_will_be, mask=eq)

geometry = Element.Geometry(element=filterByBoolMask.in)
flatten = List.Flatten(list=geometry)
byUnion = Solid.ByUnion(solids=flatten)

# group: Input
tolerance_off_walls_500 = DoubleSlider(600, range=200..700 step 200)  # "Tolerance off walls (500 typically allows wider doors only)"; graph input

# group: Get Lines from Wall Geometry, apply tolerance
bySolid = PolySurface.BySolid(solid=byUnion)
boolean = BoolSelector(false)
thicken = Surface.Thicken(surface=bySolid, thickness=tolerance_off_walls_500, both_sides=boolean)
byUnion_2 = Solid.ByUnion(solids=thicken)
XY = Plane.XY()
intersect = Geometry.Intersect(geometry=byUnion_2, other=XY)
flatten_2 = List.Flatten(list=intersect)
perimeterCurves = Surface.PerimeterCurves(surface=flatten_2)
flatten_3 = List.Flatten(list=perimeterCurves)
startPoint = Curve.StartPoint(curve=flatten_3)
endPoint = Curve.EndPoint(curve=flatten_3)
byStartPointEndPoint = Line.ByStartPointEndPoint(startPoint=startPoint, endPoint=endPoint)

byGeometry = BoundingBox.ByGeometry(geom=byUnion)

# group: Inputs
accuracy_of_testing_less_slower = DoubleSlider(100, range=100..1000 step 100)  # "Accuracy of Testing (less = slower, suggest 100)"; graph input
tidy_iterations_more_slower = DoubleSlider(5, range=0..10 step 1)  # "Tidy Iterations (more = slower, suggest 5)"; graph input

# group: Inputs
start_actor = DSModelElementSelection()  # 1 picked in the model; graph input
end_actor = DSModelElementSelection()  # 1 picked in the model; graph input

# group: Locations
getLocation = Element.GetLocation(element=start_actor)
getLocation_2 = Element.GetLocation(element=end_actor)

# group: Space Lattice
byBoundingBoxAndLines = Core.SpaceLattice.ByBoundingBoxAndLines(boundingBox=byGeometry, barriers=byStartPointEndPoint, resolution=accuracy_of_testing_less_slower)
bySpaceLattice = Pathfinding.Route.BySpaceLattice(spaceLattice=byBoundingBoxAndLines, startPoint=getLocation, endPoint=getLocation_2)

# group: Path
curve = Pathfinding.Route.Curve(route=bySpaceLattice, tidyIterations=tidy_iterations_more_slower)
length = Curve.Length(curve=curve)

# group: Outputs
list_create = List.Create(item0=byUnion_2, item1=curve)
n3d_preview = Watch3D(list_create)  # "3D Preview"; graph output
distance_travelled_in_mm = Math.Round(number=length)

# group: Input
railing = DSModelElementSelection()  # 1 picked in the model; graph input

curves = PolyCurve.Curves(polyCurve=curve)

# group: Outputs
distance_travelled_in_mm_2 = Watch(distance_travelled_in_mm)  # graph output
railing_setpath = Custom[Railing SetPath](Railing=railing, Curves=curves)  # Modify the path of an existing railing.
