# Dynamo graph ABG_190413_BatchPrinting (2020 update).dyn "BG_Sheets-BatchPrinter [2.3.0]" (Dynamo 2.3.0.5885)
# packages: Genius Loci 2020.2.24, spring nodes 203.1.0, Data-Shapes 2019.2.42, Orchid 230.0.1.7333, Zebra 2016.7.2, Clockwork for Dynamo 2.x 2.3.0

# group: Prepare sheets for printing
string = StringInput("Sheets")
byName = Category.ByName(name=string)
all_elements_of_category = ElementsOfCategory(Category=byName)
sheetNumber = Sheet.SheetNumber()  # unwired: sheet
sortByFunction = List.SortByFunction(list=all_elements_of_category, func=sheetNumber)
sheetNumber_2 = Sheet.SheetNumber(sheet=sortByFunction)
sheetName = Sheet.SheetName(sheet=sortByFunction)
code_block = CodeBlock(nu=sheetNumber_2, na=sheetName) { nu + ": " + na; }

# group: Buttons
code_block_2 = CodeBlock { "Sheets to Print"; 400; false; }
# note: Custom Node: Data-Shapes
ui_listview_data = Custom[UI.Listview Data](InputName=code_block_2.out0, Keys=code_block, Values=sortByFunction, Height_optionnal=code_block_2.out1, SortItems_optionnal=code_block_2.out2, ShowId_optionnal=code_block_2.out2)  # package Data-Shapes; Create data for ListView input in UI.MultiInputForm ++ . Check out www.data-shapes.net for more infos.
string_2 = StringInput("Print Settings")
# note: Custom Node: GeniusLoci
collector_of_printsettings = Custom[Collector of Printsettings]()  # package Genius Loci; Collects printsettings and their names in the active or given document. Inspired by an archilab node.
boolean = BoolSelector(false)
ui_dropdown_data = Custom[UI.DropDown Data](InputName=string_2, Keys=collector_of_printsettings.Printsetting_s_name, Values=collector_of_printsettings.Printsetting, Sorted_optional=boolean)  # package Data-Shapes; Create data for DropDown input in UI.MultiInputForm ++ . Check out www.data-shapes.net for more infos.
string_3 = StringInput("Sheet Name on the End?")
boolean_2 = BoolSelector(false)
string_4 = StringInput("")
ui_boolean_input = Custom[UI.Boolean input](InputName=string_3, DefaultValue=boolean_2, SideText=string_4)  # package Data-Shapes; Creates a boolean input for UI.MultipleInputForm ++ . Check out www.data-shapes.net for more infos!

# group: User Interface
code_block_3 = CodeBlock { "Batch Print"; "Print"; true; "Cancel"; 800; }
file_path = Filename("..\_Icons\ABG Logo.png")
consolidate_ui = List.Create(item0=ui_listview_data, item1=ui_dropdown_data, item2=ui_boolean_input)
# note: Custom Node: Data-Shapes
ui_multipleinputform = Custom[UI.MultipleInputForm ++](Description_optional=code_block_3.out0, Logo_optional=file_path, ButtonText_optional=code_block_3.out1, Inputs=consolidate_ui, Toggle=code_block_3.out2, CancelButtonText_optional=code_block_3.out3, MaxHeight_optional=code_block_3.out4, Width_optional=code_block_3.out4)  # package Data-Shapes; Create a form with multiple inputs. see www.data-shapes.net for tutorials and infos!

# group: Make view set, get set's sheets
element_types = ElementTypes("ViewSheetSet")
get_username = Python()  # graph input
# ---------- get_username.python (3 lines) ----------
import clr
from System import Environment
OUT = Environment.UserName
# ----------------------------------------
code_block_4 = CodeBlock(out=ui_multipleinputform.User_Inputs, name=get_username) { sht = out[0]; name; true; }
# note: Custom Node: spring nodes
byViewsName = Custom[Springs.ViewSet.ByViewsName](views=code_block_4.sht, setName=code_block_4.name, Overwrite=code_block_4.out2)  # package spring nodes; Creates a set of views(or sheets) for printing. If the set exists, set Overwrite to true to replace it.
code_block_5 = CodeBlock(passthrough=element_types, wait=byViewsName) { [passthrough,wait][0]; }
all_elements_of_type = ElementsOfType(element_type=code_block_5)
code_block_6 = CodeBlock(vsets=all_elements_of_type, usern=get_username)
# ---------- code_block_6.designscript (6 lines) ----------
//Get names of view sets
nam = Revit.Elements.Element.Name(vsets);
//Index of relevant set
ind = DSCore.List.IndexOf(nam, usern);
//Relevant set
DSCore.List.GetItemAtIndex(vsets, ind);
# ----------------------------------------
# note: Custom Node: Orchid
getView = Orchid.RevitProject.Views.SheetSet.GetView(viewSheetSet=code_block_6.out2)

code_block_7 = CodeBlock(out=ui_multipleinputform.User_Inputs) { set = out[1]; nam = out[2]; }

# group: Sheet Number and name (optional)
sheetNumber_3 = Sheet.SheetNumber(sheet=getView)
sheetName_2 = Sheet.SheetName(sheet=getView)
code_block_8 = CodeBlock(na=sheetName_2) { " - " + na; " "; }
# note: Custom Node: Clockwork
replaceIllegalFilenameCharacters = Custom[String.ReplaceIllegalFilenameCharacters](str=code_block_8.out0, replacement=code_block_8.out1)  # package Clockwork for Dynamo 2.x; Replaces all characters in a string that are illegal characters for filenames
code_block_9 = CodeBlock(t1=replaceIllegalFilenameCharacters) { len = DSCore.List.Count(t1); DSCore.List.OfRepeatedItem("", len); }
if_ = Custom[Logic.If](test=code_block_7.nam, ifTrue=replaceIllegalFilenameCharacters, ifFalse=code_block_9.out1, lacing=Longest)  # package Zebra; Retains the old status of the previous built-in IF node.

# group: Current Revision
code_block_10 = CodeBlock { ""; }
string_5 = StringInput("Current Revision")
getParameterValueByName = Element.GetParameterValueByName(element=getView, parameterName=string_5)
eq = code_block_10 == getParameterValueByName
empty_revison = StringInput("!")
if_2 = Custom[Logic.If](test=eq@L1, ifTrue=empty_revison, ifFalse=getParameterValueByName@L1, lacing=Longest)

# group: Make file names
myDocs = Python()
# ---------- myDocs.python (15 lines) ----------
# Made by Gavin Crump
# Free for use
# BIM Guru, www.bimguru.com.au
# Thanks to Sean Page for suggesting the os package

# Boilerplate text
import clr
import os

user = os.environ.get('USERNAME')
fl = os.environ.get('USERPROFILE')

md = fl + "\Documents"

OUT = [user,md]
# ----------------------------------------
code_block_11 = CodeBlock(out=myDocs) { out[1]; }
code_block_12 = CodeBlock(num=sheetNumber_3, nam=if_, rev=if_2) { num + nam + " [" + rev + "]"; }
code_block_13 = CodeBlock(Dir=code_block_11, Fil=code_block_12) { Dir+"\\"+Fil+".pdf"; }

# group: Print sheets
code_block_14 = CodeBlock { "Adobe PDF"; true; }
print_range = Range("Selected views/sheets")
# note: Custom Node: GeniusLoci
print_pdf_multiple_formats = Custom[Print PDF (multiple formats)](FilePaths=code_block_13, views=getView, PrintSetting=code_block_7.set, PrinterName=code_block_14.out0, PrintRange=print_range, RunIt=code_block_14.out1)  # package Genius Loci; This node will allow you to initiate a printing routine from a set of views/sheets, filename, printer name, print settings with many formats and print range. Based on an archilab node.
