# Dynamo graph ABG_190418_ViewCreation.dyn "View Creation" (Dynamo 2.3.0.5885)
# packages: archi-lab.net 2021.25.21

code_block = CodeBlock { "Levels"; }
byName = Category.ByName(name=code_block)
all_elements_of_category = ElementsOfCategory(Category=byName)
code_block_2 = CodeBlock { "Type"; }
getParameterValueByName = Element.GetParameterValueByName(element=all_elements_of_category, parameterName=code_block_2)
name = Element.Name(element=getParameterValueByName)
level_name_begins_with = StringInput("BG_Floor")  # graph input
eq = name == level_name_begins_with
filterByBoolMask = List.FilterByBoolMask(list=all_elements_of_category, mask=eq)
byLevel = FloorPlanView.ByLevel(level=filterByBoolMask.in)  # frozen
code_block_3 = CodeBlock { "View Name"; "View Template"; "Scope Box"; }
prefix = StringInput("10_")  # graph input
name_2 = Level.Name(level=filterByBoolMask.in)
add = prefix + name_2
suffix = StringInput(" - GA Plan")  # graph input
add_2 = add + suffix
setParameterByName = Element.SetParameterByName(element=byLevel, parameterName=code_block_3.out0, value=add_2, lacing=Longest)
# note: Custom Package: archilab v.2021.25.21
view_templates = ViewTemplatesUi("BG_10 - Floor Plans")  # graph input
setParameterByName_2 = Element.SetParameterByName(element=byLevel, parameterName=code_block_3.out1, value=view_templates, lacing=Longest)
code_block_4 = CodeBlock { "Scope Boxes"; }
byName_2 = Category.ByName(name=code_block_4)
all_elements_of_category_2 = ElementsOfCategory(Category=byName_2)
name_3 = Element.Name(element=all_elements_of_category_2)
scope_box_name = StringInput("1-100")  # graph input
eq_2 = name_3 == scope_box_name  # lacing=Longest

# group: I added an extra statement here
apply_scope_box = BoolSelector(false)  # graph input
filterByBoolMask_2 = List.FilterByBoolMask(list=all_elements_of_category_2, mask=eq_2)
empty = List.Empty()
if_ = If(test=apply_scope_box, true=filterByBoolMask_2.in, false=empty)

setParameterByName_3 = Element.SetParameterByName(element=byLevel, parameterName=code_block_3.out2, value=if_, lacing=Longest)
