# Dynamo graph ABG_190422_ViewsToSheets.dyn (Dynamo 2.6.1.8786)
# packages: Rhythm 2020.9.8

# group: All sheets
code_block = CodeBlock { "Sheets"; }
byName = Category.ByName(name=code_block)
all_elements_of_category = ElementsOfCategory(Category=byName)

# group: Get Excel data
file_path = Filename(".\test.xlsx")  # graph input
file_from_path = FileObject(path=file_path)
worksheet_name = StringInput("Sheet1")  # graph input
code_block_2 = CodeBlock { true; false; }
importExcel = Data.ImportExcel(file=file_from_path, sheetName=worksheet_name, readAsStrings=code_block_2.out0, showExcel=code_block_2.out1)
drop_header_rows = IntegerSlider(1, range=0..10 step 1)  # graph input
dropItems = List.DropItems(list=importExcel, amount=drop_header_rows)
transpose = List.Transpose(lists=dropItems)
code_block_3 = CodeBlock(data=transpose) { shts = data[0]; view = data[1]; }

# group: All views
code_block_4 = CodeBlock { "Views"; }
byName_2 = Category.ByName(name=code_block_4)
all_elements_of_category_2 = ElementsOfCategory(Category=byName_2)
code_block_5 = CodeBlock { false; }
clean = List.Clean(list=all_elements_of_category_2, preserveIndices=code_block_5)

# group: Get actual sheets and views
sheetNumber = Sheet.SheetNumber(sheet=all_elements_of_category)
indexOf = List.IndexOf(list=sheetNumber, element=code_block_3.shts)
getItemAtIndex = List.GetItemAtIndex(list=all_elements_of_category, index=indexOf)
name = Element.Name(element=clean)
indexOf_2 = List.IndexOf(list=name, element=code_block_3.view)
getItemAtIndex_2 = List.GetItemAtIndex(list=clean, index=indexOf_2)

# group: Get viewport
reference_viewport = DSModelElementSelection()  # 1 picked in the model; graph input
# note: Custom Node: Rhythm v.2020.9.8
ʳʰʸᵗʰᵐ_viewport_boxcenter = Rhythm.Revit.Elements.Viewport.BoxCenter(viewport=reference_viewport)

# group: Get viewport type by name
python_script = Python()
# ---------- python_script.python (21 lines) ----------
import clr
clr.AddReference("RevitNodes")
import Revit
clr.ImportExtensions(Revit.Elements)

clr.AddReference("RevitServices")
import RevitServices
from RevitServices.Persistence import DocumentManager
doc = DocumentManager.Instance.CurrentDBDocument

clr.AddReference("RevitAPI")
import Autodesk
from Autodesk.Revit.DB import *

# Get viewports
viewports = FilteredElementCollector(doc).OfCategory(BuiltInCategory.OST_Viewports).WhereElementIsNotElementType().ToElements()

# Get valid viewport types
types = [doc.GetElement(i) for i in viewports[0].GetValidTypes()]

OUT = types
# ----------------------------------------
name_2 = Element.Name(element=python_script)
viewport_type_name = StringInput("Title w Line")  # graph input
indexOf_3 = List.IndexOf(list=name_2, element=viewport_type_name)
code_block_6 = CodeBlock(viewports=python_script, i=indexOf_3) { viewports[i]; }

# group: Make viewports and set types
# note: Custom Node: Rhythm v.2020.9.8
ʳʰʸᵗʰᵐ_viewport_create = Rhythm.Revit.Elements.Viewport.Create(sheet=getItemAtIndex, view=getItemAtIndex_2, location=ʳʰʸᵗʰᵐ_viewport_boxcenter)
code_block_7 = CodeBlock { "Type"; }
setParameterByName = Element.SetParameterByName(element=ʳʰʸᵗʰᵐ_viewport_create, parameterName=code_block_7, value=code_block_6, lacing=Longest)
