# Dynamo graph ABG_190519_DynamoPlayer.dyn "Demo script d player" (Dynamo 2.0.3.8104)

where_is_your_excel_file_to = Filename("Demo\Test doc.xlsx")  # "Where is your excel file to write to?"; graph input
sheet_name_in_excel_suggest = StringInput("Sheet1")  # "Sheet name in Excel (suggest Sheet1)"; graph input
cell_in_excel_for_data_to_start = StringInput("A1")  # "Cell in Excel for data to start at (suggest A1)"; graph input
category_to_schedule = Categories(index=604)  # graph input

# group: Get Elements
all_elements_of_category = ElementsOfCategory(Category=category_to_schedule)

# group: Get Parameters
parameters = Element.Parameters(element=all_elements_of_category)
string_from_object = FromObject(obj=parameters)
code_block = CodeBlock { " : "; true; }
removeAfterCharacters = Custom[String.RemoveAfterCharacters](String=string_from_object, Characters=code_block.out0, ignoreCase=code_block.out1, includeChar=code_block.out1)  # Removes the part of the string after the input character/s
flatten = List.Flatten(list=removeAfterCharacters)
uniqueItems = List.UniqueItems(list=flatten)

what_should_empty_cells_say = StringInput("Empty")  # graph input

# group: Build Data
string = StringInput("Unqiue ID")
addItemToFront = List.AddItemToFront(item=string, list=uniqueItems)
id = Element.Id(element=all_elements_of_category)
getParameterValueByName = Element.GetParameterValueByName(parameterName=uniqueItems)  # unwired: element
map = List.Map(list=all_elements_of_category, f_x=getParameterValueByName)
string_from_object_2 = FromObject(obj=map)
code_block_2 = CodeBlock { ""; }
eq = string_from_object_2 == code_block_2
if_ = Custom[Logic.If](test=eq@L1, ifTrue=what_should_empty_cells_say, ifFalse=string_from_object_2@L1, lacing=Longest)  # Retains the old status of the previous built-in IF node.
count = List.Count(list=uniqueItems)
chop = List.Chop(list=if_, lengths=count)
transpose = List.Transpose(lists=chop)
addItemToFront_2 = List.AddItemToFront(item=id, list=transpose)
transpose_2 = List.Transpose(lists=addItemToFront_2)
addItemToFront_3 = List.AddItemToFront(item=addItemToFront, list=transpose_2)

# group: Write to Excel BB
code_block_3 = CodeBlock { true; false; }
bb_data = Custom[BB Data](sheetName=sheet_name_in_excel_suggest, origin=cell_in_excel_for_data_to_start, data=addItemToFront_3)  # This node is a building block for different modes of writing to Excel files. You can combines this node into a list to write to multiple sheets or use just one to write to a single sheet.
write_excel = Custom[Write Excel](filePath=where_is_your_excel_file_to, runIt=code_block_3.out0, byColumn=code_block_3.out1, BBData=bb_data)  # This node will write data to Excel file and based on how your BBData nodes are structured it will either override the exsting file, create a new one and write a single worksheet or write multiple worksheets.

success = Watch(write_excel)  # graph output
count_2 = List.Count(list=all_elements_of_category)
how_many_elements_scheduled = Watch(count_2)  # graph output
how_many_parmeters_did_we = Watch(count)  # "How many parmeters did we schedule?"; graph output
