# Dynamo graph ABG_190605_LearnDynamo4D.dyn "Decode" (Dynamo 2.0.3.8104)

code_block = CodeBlock { " "; }
code_block_2 = CodeBlock { "A"; "Z"; 1; }
range = Range(start=code_block_2.out0, end=code_block_2.out1, step=code_block_2.out2)
addItemToEnd = List.AddItemToEnd(item=code_block, list=range)
code_block_3 = CodeBlock { 11; 37; 1; }
range_2 = Range(start=code_block_3.out0, end=code_block_3.out1, step=code_block_3.out2)
reverse = List.Reverse(list=range_2)
code_block_4 = CodeBlock { 11; 37; 1; }
range_3 = Range(start=code_block_4.out0, end=code_block_4.out1, step=code_block_4.out2)
reverse_2 = List.Reverse(list=range_3)
code_block_5 = CodeBlock { " "; }
code_block_6 = CodeBlock { "A"; "Z"; 1; }
range_4 = Range(start=code_block_6.out0, end=code_block_6.out1, step=code_block_6.out2)
addItemToEnd_2 = List.AddItemToEnd(item=code_block_5, list=range_4)
string = StringInput("THIS IS ANOTHER MESSAGE")
toList = Custom[String.ToList](String=string)  # Convert the given string to a list
indexOf = List.IndexOf(list=addItemToEnd_2, element=toList)
getItemAtIndex = List.GetItemAtIndex(list=reverse_2, index=indexOf)
string_from_object = FromObject(obj=getItemAtIndex)
concat = String.Concat(string0=string_from_object)
toList_2 = Custom[String.ToList](String=concat)
flatten = List.Flatten(list=toList_2)
code_block_7 = CodeBlock { 2; }
chop = List.Chop(list=flatten, lengths=code_block_7)
concat_2 = String.Concat()  # unwired: string0
map = List.Map(list=chop, f_x=concat_2)
flatten_2 = List.Flatten(list=map)
toNumber = String.ToNumber(str=flatten_2)
indexOf_2 = List.IndexOf(list=reverse, element=toNumber)
getItemAtIndex_2 = List.GetItemAtIndex(list=addItemToEnd, index=indexOf_2)
concat_3 = String.Concat(string0=getItemAtIndex_2)
