# Dynamo graph ABG_190607_LearnDynamo5.dyn "code blocks" (Dynamo 2.0.3.8104)

# group: Code Blocks
code_block = CodeBlock { "String"; }
code_block_2 = CodeBlock { 1.0; }
code_block_3 = CodeBlock { 2; }
code_block_4 = CodeBlock { true; }
code_block_5 = CodeBlock { false; }

# group: Implied statements
code_block_6 = CodeBlock { 2+2; }
code_block_7 = CodeBlock { x=5; }

watch = Watch()  # unwired: arg0
code_block_8 = CodeBlock { 2; 1.0; "String"; true; false; }

# group: Statements
code_block_9 = CodeBlock { x+5; }  # unwired: x
code_block_10 = CodeBlock { x+y; }  # unwired: x, y
code_block_11 = CodeBlock { x; x+y; x*y; x-y; }  # unwired: x, y

watch_2 = Watch()  # unwired: arg0
watch_3 = Watch()  # unwired: arg0

# group: Nodes
number = DoubleInput(1)
number_2 = DoubleInput(2)
string = StringInput("String")
boolean = BoolSelector(true)
boolean_2 = BoolSelector(false)

code_block_12 = CodeBlock { x==5; x!=5; x>5; x<5; x>=5; x<=5; }  # unwired: x

# group: Node to code
code_block_13 = CodeBlock { 5; }
byCoordinates = Point.ByCoordinates(x=code_block_13, y=code_block_13, z=code_block_13)

code_block_14 = CodeBlock { 5; }
byCoordinates_2 = Point.ByCoordinates(x=code_block_14, y=code_block_14, z=code_block_14)
code_block_15 = CodeBlock { 1; 10; }
range = Range(start=code_block_15.out0, end=code_block_15.out1, step=code_block_15.out0)
code_block_16 = CodeBlock { 1; 10; }
sequence = Sequence(start=code_block_16.out0, amount=code_block_16.out1, step=code_block_16.out0)
code_block_17 = CodeBlock { 1; 10; }
range_2 = Range(start=code_block_17.out0, end=code_block_17.out1, step=code_block_17.out0)
code_block_18 = CodeBlock { 5; }
getItemAtIndex = List.GetItemAtIndex(list=range_2, index=code_block_18)
transpose = List.Transpose(lists=getItemAtIndex)

# group: Lists
code_block_19 = CodeBlock { {1,2,3}; }
code_block_20 = CodeBlock { [1,2,3]; }
code_block_21 = CodeBlock { str1="st1"; str2="st2"; str3="st3"; [str1, str2, str3]; }

watch_4 = Watch()  # unwired: arg0

# group: Functions
code_block_22 = CodeBlock()
# ---------- code_block_22.designscript (5 lines) ----------
def squared(input)
{
//explanation text
return = input*input;
};
# ----------------------------------------
code_block_23 = CodeBlock { 5; }
code_block_24 = CodeBlock(x=code_block_23) { squared(x); }
