# Dynamo graph ABG_190612_LearnDynamo7-Read.dyn "Read" (Dynamo 2.0.3.8104)

code_block = CodeBlock()
# ---------- code_block.designscript (8 lines) ----------
["Name",
"Number",
"Unbounded height",
"Department",
"Base Finish",
"Ceiling Finish",
"Wall Finish",
"Floor Finish"];
# ----------------------------------------
exportExcel = Data.ExportExcel()  # unwired: filePath, sheetName, startRow, startCol, data
importExcel = Data.ImportExcel()  # unwired: file, sheetName
