# Dynamo graph ABG_190612_LearnDynamo7-Write.dyn "Write2" (Dynamo 2.0.3.8104)

# group: Get all rooms
string = StringInput("Rooms")
byName = Category.ByName(name=string)
all_elements_of_category = ElementsOfCategory(Category=byName)

file_path = Filename(".\To send back.xlsx")
file_from_path = FileObject(path=file_path)
code_block = CodeBlock { "Sheet1"; true; false; }
importExcel = Data.ImportExcel(file=file_from_path, sheetName=code_block.out0, readAsStrings=code_block.out1, showExcel=code_block.out2)
transpose = List.Transpose(lists=importExcel)

# group: Get rooms
shuffle = List.Shuffle(list=all_elements_of_category)
id = Element.Id(element=shuffle)
string_from_object = FromObject(obj=id)
firstItem = List.FirstItem(list=transpose)
code_block_2 = CodeBlock { 1; }
dropItems = List.DropItems(list=firstItem, amount=code_block_2)
indexOf = List.IndexOf(list=string_from_object, element=dropItems)
getItemAtIndex = List.GetItemAtIndex(list=shuffle, index=indexOf)

code_block_3 = CodeBlock { 1; }
dropItems_2 = List.DropItems(list=transpose, amount=code_block_3)
transpose_2 = List.Transpose(lists=dropItems_2)
code_block_4 = CodeBlock { 0; }
getItemAtIndex_2 = List.GetItemAtIndex(list=transpose_2, index=code_block_4)
count = List.Count(list=getItemAtIndex)
ofRepeatedItem = List.OfRepeatedItem(item=getItemAtIndex_2, amount=count)
code_block_5 = CodeBlock { 1; }
dropItems_3 = List.DropItems(list=transpose_2, amount=code_block_5)
code_block_6 = CodeBlock { 2; }
getItemAtIndex_3 = List.GetItemAtIndex(list=dropItems_3@L2, index=code_block_6)
toNumber = String.ToNumber(str=getItemAtIndex_3)
replaceItemAtIndex = List.ReplaceItemAtIndex(list=dropItems_3@L2, index=code_block_6, item=toNumber@L1)
setParameterByName = Element.SetParameterByName(element=getItemAtIndex, parameterName=ofRepeatedItem, value=replaceItemAtIndex)
code_block_7 = CodeBlock { x; }  # unwired: x
code_block_8 = CodeBlock { y; }  # unwired: y
count_2 = List.Count(list=code_block_8)
ofRepeatedItem_2 = List.OfRepeatedItem(item=code_block_7, amount=count_2)
code_block_9 = CodeBlock { x; }  # unwired: x
code_block_10 = CodeBlock { 2; }
getItemAtIndex_4 = List.GetItemAtIndex(list=code_block_9@L2, index=code_block_10)
toNumber_2 = String.ToNumber(str=getItemAtIndex_4)
replaceItemAtIndex_2 = List.ReplaceItemAtIndex(list=code_block_9@L2, index=code_block_10, item=toNumber_2@L1)
