# Dynamo graph ABG_190617_LearnDynamo8D1.dyn "Make walls" (Dynamo 2.0.3.8104)

# note: archilab
string = StringInput("Walls")
byName = Category.ByName(name=string)
all_elements_of_category = ElementsOfCategory(Category=byName)

# group: Fill centres
select_filled_region_type = FilledRegionTypes(index=1)
instances = Custom[Springs.ElementType.Instances](type=select_filled_region_type)  # Fetches all instances of the input element type
flatten = List.Flatten(list=instances)
filled_region_boundary_curves = Custom[Filled Region Boundary Curves](Filled_Region=flatten)  # This node will get the boundary curves for a filled region.
byJoinedCurves = PolyCurve.ByJoinedCurves(curves=filled_region_boundary_curves)
patch = Curve.Patch(curve=byJoinedCurves)
code_block = CodeBlock { 0.5; }
pointAtParameter = Surface.PointAtParameter(surface=patch, u=code_block, v=code_block)

code_block_2 = CodeBlock { 500; }
thicken = Surface.Thicken(surface=patch, thickness=code_block_2)
flatten_2 = List.Flatten(list=thicken)
geometry = Element.Geometry(element=all_elements_of_category)
doesIntersect = Geometry.DoesIntersect(other=geometry)  # unwired: geometry
map = List.Map(list=flatten_2, f_x=doesIntersect)
flatten_3 = List.Flatten()  # unwired: list
map_2 = List.Map(list=map, f_x=flatten_3)
boolean = BoolSelector(true)
indexOf = List.IndexOf(list=map_2@L2, element=boolean)
getItemAtIndex = List.GetItemAtIndex(list=all_elements_of_category, index=indexOf)
family_types = FamilyTypes(index=1)
flatten_4 = List.Flatten(list=pointAtParameter)
count = List.Count(list=flatten_4)
ofRepeatedItem = List.OfRepeatedItem(item=family_types, amount=count)
byPoints = Custom[Springs.HostedInstance.ByPoints](host=getItemAtIndex, type=ofRepeatedItem, point=flatten_4)  # Creates hosted family instances(doors/windows) at the specified points. You can feed either a single family type or a unique type for each instance.
line_styles = LineStyleUi(index=18)

# group: Get floors edges
all_elements_in_active_view = ElementsInView()
code_block_3 = CodeBlock { "Line Style"; }
getParameterValueByName = Element.GetParameterValueByName(element=all_elements_in_active_view, parameterName=code_block_3)
name = Element.Name(element=getParameterValueByName)
name_2 = Element.Name(element=line_styles)
eq = name == name_2
filterByBoolMask = List.FilterByBoolMask(list=all_elements_in_active_view, mask=eq)
curve = DetailCurve.Curve(detailCurve=filterByBoolMask.in)

floor_types = FloorTypes(index=0)
levels = Levels(index=0)
byOutlineTypeAndLevel = Floor.ByOutlineTypeAndLevel(outlineCurves=curve, floorType=floor_types, level=levels)  # frozen
levels_2 = Levels(index=0)
levels_3 = Levels(index=1)
wall_types = WallTypes(index=0)
byCurveAndLevels = Wall.ByCurveAndLevels(c=curve, startLevel=levels_2, endLevel=levels_3, wallType=wall_types)  # frozen
