# Dynamo graph ABG_190624_LearnDynamo9-Basic.dyn "Basic point generation" (Dynamo 2.0.3.8104)

# group: Reverse engineering
X = Point.X()  # unwired: point
Y = Point.Y()  # unwired: point
Z = Point.Z()  # unwired: point

# group: Translations
translate = Geometry.Translate()  # unwired: geometry, direction, distance
translate_2 = Geometry.Translate()  # unwired: geometry, direction
translate_3 = Geometry.Translate()  # unwired: geometry

# group: Vector Creation
byTwoPoints = Vector.ByTwoPoints()  # unwired: start, end
XAxis = Vector.XAxis()
YAxis = Vector.YAxis()
ZAxis = Vector.ZAxis()
reverse = Vector.Reverse()  # unwired: vector
byCoordinates = Vector.ByCoordinates()

# group: Vector measurement
angleWithVector = Vector.AngleWithVector()  # unwired: vector, otherVector
angleAboutAxis = Vector.AngleAboutAxis()  # unwired: vector, otherVector, rotationAxis

# group: Start point end point
byStartPointDirectionLength = Line.ByStartPointDirectionLength()  # unwired: startPoint, direction

# group: Previously
getLocation = Element.GetLocation()  # unwired: element

# group: Range for spacing
code_block = CodeBlock { 0; }
grid_count_100 = IntegerSlider(1200, range=1000..3000 step 100)
code_block_2 = CodeBlock { 100; }
range = Range(start=code_block, end=grid_count_100, step=code_block_2)

# group: Point by Coordinates
byCoordinates_2 = Point.ByCoordinates()
origin = Point.Origin()
code_block_3 = CodeBlock { 0; }
byCoordinates_3 = Point.ByCoordinates(x=range, y=range, z=code_block_3, lacing=CrossProduct)

# group: Height Range
max_ceiling_height = DoubleSlider(1400, range=1000..4000 step 50)
min_ceiling_height = DoubleSlider(1000, range=0..4000 step 50)

# group: Translate Geometry
ZAxis_2 = Vector.ZAxis()
translate_4 = Geometry.Translate(geometry=byCoordinates_3, direction=ZAxis_2, distance=max_ceiling_height)

# group: Attractor point
number_slider = DoubleSlider(0.67, range=0..1 step 0.01)
number_slider_2 = DoubleSlider(0.41, range=0..1 step 0.01)

# group: Attractor Point
maximumItem = List.MaximumItem(list=range)
code_block_4 = CodeBlock(max=maximumItem, x=number_slider, y=number_slider_2) { max*x; max*y; }
code_block_5 = CodeBlock { 0; }
byCoordinates_4 = Point.ByCoordinates(x=code_block_4.out0, y=code_block_4.out1, z=code_block_5)

code_block_6 = CodeBlock(x=max_ceiling_height) { x-100; }

# group: Map distance
distanceTo = Geometry.DistanceTo(geometry=byCoordinates_3, other=byCoordinates_4)
remapRange = Math.RemapRange(numbers=distanceTo, newMin=min_ceiling_height, newMax=code_block_6)

translate_5 = Geometry.Translate(geometry=byCoordinates_3, direction=ZAxis_2, distance=remapRange)

# group: Make forms
code_block_7 = CodeBlock { 25; }  # frozen
byCenterPointRadius = Circle.ByCenterPointRadius(centerPoint=translate_4, radius=code_block_7)
flatten = List.Flatten(list=byCenterPointRadius)
byCenterPointRadius_2 = Circle.ByCenterPointRadius(centerPoint=translate_5, radius=code_block_7)
flatten_2 = List.Flatten(list=byCenterPointRadius_2)
list_create = List.Create(item0=flatten, item1=flatten_2)
transpose = List.Transpose(lists=list_create)
byLoft = Solid.ByLoft(crossSections=transpose)

flatten_3 = List.Flatten(list=translate_4)
flatten_4 = List.Flatten(list=translate_5)

# group: Place families
list_create_2 = List.Create(item0=flatten_3, item1=flatten_4)
transpose_2 = List.Transpose(lists=list_create_2)
family_types = FamilyTypes(index=0)
byPoints = AdaptiveComponent.ByPoints(points=transpose_2, familyType=family_types, lacing=Longest)

# group: Nurbs from points
byPoints_2 = NurbsCurve.ByPoints(points=translate_5)  # frozen

byLoft_2 = Surface.ByLoft(crossSections=byPoints_2)
byStartPointEndPoint = Line.ByStartPointEndPoint()  # frozen; unwired: startPoint, endPoint
