# Dynamo graph ABG_190624_LearnDynamo9-Complex.dyn "Complex point generation" (Dynamo 2.0.3.8104)

# group: Coordinate System XYZ
code_block = CodeBlock { 0; 30000; }
code_block_2 = CodeBlock { 5000; }
byOrigin = CoordinateSystem.ByOrigin(x=code_block.out0, y=code_block.out1, z=code_block_2)

# group: Spherical Coordinates
code_block_3 = CodeBlock { 15; }
code_block_4 = CodeBlock(x=code_block_3) { 0..360..x; }
bySphericalCoordinates = Point.BySphericalCoordinates(cs=byOrigin, phi=code_block_4, theta=code_block_4, radius=code_block_2, lacing=CrossProduct)
count = List.Count(list=code_block_4)

# group: Points to Lines
chop = List.Chop(list=bySphericalCoordinates, lengths=count)
transpose = List.Transpose(lists=chop@L3)
byBestFitThroughPoints = Circle.ByBestFitThroughPoints(points=transpose)
byBestFitThroughPoints_2 = Circle.ByBestFitThroughPoints(points=chop)
clean = List.Clean(list=byBestFitThroughPoints_2)

# group: Coordinate System XY (Z is 0 always)
code_block_5 = CodeBlock { 0; 15000; }
byOrigin_2 = CoordinateSystem.ByOrigin(x=code_block_5.out0, y=code_block_5.out1)

# group: Cylindrical Coordinates
code_block_6 = CodeBlock { 15; }
code_block_7 = CodeBlock(x=code_block_6) { 0..360..x; }
code_block_8 = CodeBlock { 1000; }
code_block_9 = CodeBlock(x=code_block_8) { 0..6000..x; }
code_block_10 = CodeBlock { 5000; }
byCylindricalCoordinates = Point.ByCylindricalCoordinates(cs=byOrigin_2, angle=code_block_7, elevation=code_block_9, radius=code_block_10, lacing=CrossProduct)

# group: Points to Lines
code_block_11 = CodeBlock(x=byCylindricalCoordinates) { x; }
transpose_2 = List.Transpose(lists=code_block_11@L3)
byBestFitThroughPoints_3 = Circle.ByBestFitThroughPoints(points=transpose_2)
byBestFitThroughPoints_4 = Line.ByBestFitThroughPoints(bestFitPoints=code_block_11)

# group: By Coordinates System
byCartesianCoordinates = Point.ByCartesianCoordinates()  # frozen
