# Dynamo graph ABG_190624_LearnDynamo9-Lacing.dyn "Lacing" (Dynamo 2.0.3.8104)

code_block = CodeBlock { 0..10..1; }
code_block_2 = CodeBlock { 0..5..1; }
byCoordinates = Point.ByCoordinates(x=code_block, y=code_block_2)
