# Dynamo graph ABG_190626_LearnDynamo10.dyn "Edges" (Dynamo 2.0.3.8104)

# group: Inputs
select_model_element = DSModelElementSelection()  # 1 picked in the model
select_edge = DSEdgeSelection()  # nothing selected

# group: Geometry
geometry = Element.Geometry()  # unwired: element

# group: Offset
integer_slider = IntegerSlider(-600, range=-1500..1500 step 50)

# group: Curve Offset
offset = Curve.Offset(distance=integer_slider)  # unwired: curve

# group: Validation
patch = Curve.Patch()  # unwired: curve
isClosed = Curve.IsClosed()  # unwired: curve

# group: Other Divides
pointAtSegmentLength = Curve.PointAtSegmentLength()  # unwired: curve
pointsAtEqualChordLength = Curve.PointsAtEqualChordLength()  # unwired: curve
pointsAtEqualSegmentLength = Curve.PointsAtEqualSegmentLength()  # unwired: curve

# group: Normalize
XY = Plane.XY()
pullOntoPlane = Curve.PullOntoPlane(plane=XY)  # unwired: curve

# group: Inset
integer_slider_2 = IntegerSlider(-450, range=-1500..-300 step 50)

# group: Extend Curves
extendEnd = Curve.ExtendEnd(distance=integer_slider_2)  # unwired: curve
extendStart = Curve.ExtendStart(curve=extendEnd, distance=integer_slider_2)

code_block = CodeBlock { c; divp; }  # unwired: c, divp

# group: By Parameter (Divide)
pointAtParameter = Curve.PointAtParameter(curve=code_block.c, param=code_block.divp)
normalAtParameter = Curve.NormalAtParameter(curve=code_block.c, param=code_block.divp)

# group: Reverse
reverse = Curve.Reverse()  # unwired: curve
reverse_2 = Vector.Reverse(vector=normalAtParameter)

# group: Visualize vectors
code_block_2 = CodeBlock { 500; }
byStartPointDirectionLength = Line.ByStartPointDirectionLength(startPoint=pointAtParameter, direction=reverse_2, length=code_block_2)

# group: Max spacing
integer_slider_3 = IntegerSlider(600, range=300..1500 step 50)

# group: Determine divisions
length = Curve.Length()  # unwired: curve
div = length / integer_slider_3
floor = Math.Floor(number=div)
code_block_3 = CodeBlock(div=floor) { 0..1..#(div+1); }

code_block_4 = CodeBlock { c; floor; }  # unwired: c, floor

# group: Alternative
startPoint = Curve.StartPoint(curve=code_block_4.c)
pointsAtEqualSegmentLength_2 = Curve.PointsAtEqualSegmentLength(curve=code_block_4.c, divisions=code_block_4.floor)
endPoint = Curve.EndPoint(curve=code_block_4.c)
list_create = List.Create(item0=startPoint, item1=pointsAtEqualSegmentLength_2, item2=endPoint)

# group: Family Types
family_types = FamilyTypes(index=1)

# group: Make family
byPoint = FamilyInstance.ByPoint(familyType=family_types)  # unwired: point
setRotation = FamilyInstance.SetRotation(familyInstance=byPoint)  # unwired: degree

# group: Rotation angle
YAxis = Vector.YAxis()
ZAxis = Vector.ZAxis()
angleAboutAxis = Vector.AngleAboutAxis(otherVector=YAxis, rotationAxis=ZAxis)  # unwired: vector
