# Dynamo graph ABG_190823_Feasibility6-1.dyn "part 1 begin" (Dynamo 2.0.3.8104)

levels = Levels(index=26)  # graph input
year = IntegerSlider(2030, range=2019..2030 step 1)  # graph input
start_month = IntegerSlider(6, range=1..12 step 1)  # graph input
end_month = IntegerSlider(6, range=1..12 step 1)  # graph input
code_block = CodeBlock(s=start_month, e=end_month) { s..e..1; }
start_day = IntegerSlider(22, range=1..31 step 1)  # graph input
end_day = IntegerSlider(22, range=1..31 step 1)  # graph input
code_block_2 = CodeBlock(s=start_day, e=end_day) { s..e..1; }
start_day_2 = IntegerSlider(9, range=1..23 step 1)  # graph input
start_day_3 = IntegerSlider(15, range=1..23 step 1)  # graph input
code_block_3 = CodeBlock(s=start_day_2, e=start_day_3) { s..e..1; }
code_block_4 = CodeBlock { 0; }
byDateAndTime = DateTime.ByDateAndTime(year=year, month=code_block, day=code_block_2, hour=code_block_3, minute=code_block_4, second=code_block_4, millisecond=code_block_4, lacing=CrossProduct)
flatten = List.Flatten(list=byDateAndTime)
count = List.Count(list=flatten)
ofRepeatedItem = List.OfRepeatedItem(item=levels, amount=count)
byLevel = FloorPlanView.ByLevel(level=ofRepeatedItem)
string = StringInput("View Name")
prefix = StringInput("Option 1A - ")  # graph input
components = DateTime.Components(dateTime=flatten)
code_block_5 = CodeBlock(Prefix=prefix, d=components.day, m=components.month, y=components.year, h=components.hour) { Prefix+d+"-"+m+"-"+y+"_"+h+"-00"; }
setParameterByName = Element.SetParameterByName(element=byLevel, parameterName=string, value=code_block_5, lacing=Longest)
