# Dynamo graph ABG_190823_Feasibility6-2.dyn "part 2 begin" (Dynamo 2.0.3.8104)

current = Document.Current()
activeView = Document.ActiveView(document=current)
name = Element.Name(element=activeView)
code_block = CodeBlock { 0; }
prefix = StringInput("Option 1B - ")  # graph input
length = String.Length(str=prefix)
remove = String.Remove(str=name, startIndex=code_block, count=length)
code_block_2 = CodeBlock { "-"; "_"; }
split = String.Split(str=remove, separater0=code_block_2.out0, separater1=code_block_2.out1)
toNumber = String.ToNumber(str=split)
code_block_3 = CodeBlock(lst=toNumber) { lst[2]; lst[1]; lst[0]; lst[3]; lst[4]; 0; }
byDateAndTime = DateTime.ByDateAndTime(year=code_block_3.out0, month=code_block_3.out1, day=code_block_3.out2, hour=code_block_3.out3, minute=code_block_3.out4, second=code_block_3.out5, millisecond=code_block_3.out5)
shadow_intensity = IntegerSlider(50, range=10..90 step 5)  # graph input

# group: By others
# note: Copyright (c) 2016, AECOM
# Written by: Matthew Anderle & Chris Williams
python_sun_and_shadow_settings = Python(IN[0]=activeView, IN[1]=byDateAndTime, IN[2]=shadow_intensity)
# ---------- python_sun_and_shadow_settings.python (30 lines) ----------
import clr

clr.AddReference('RevitServices')
from RevitServices.Persistence import DocumentManager
from RevitServices.Transactions import TransactionManager
clr.AddReference('RevitAPI')
from Autodesk.Revit.DB import *
clr.AddReference('System')
import System

ax_view = UnwrapElement(IN[0])
slide_DT = IN[1]
shadeI = IN[2]

doc = DocumentManager.Instance.CurrentDBDocument

DT_kind = System.DateTimeKind.Local
slide_DT = System.DateTime.SpecifyKind(slide_DT, DT_kind)

TransactionManager.Instance.EnsureInTransaction(doc)
settings_sun = ax_view.SunAndShadowSettings
ax_view.ShadowIntensity = 1
settings_sun.SunAndShadowType = SunAndShadowType.StillImage
settings_sun.StartDateAndTime = slide_DT
ax_view.ShadowIntensity = shadeI
TransactionManager.Instance.TransactionTaskDone()


#Assign your output to the OUT variable.
OUT = ax_view
# ----------------------------------------
