# Dynamo graph ABG_190826_Feasibility7.dyn "finished version" (Dynamo 2.0.3.8104)

select_face = DSFaceSelection()  # 1 picked in the model; graph input
code_block = CodeBlock { 0; 1; }
getIsoline = Surface.GetIsoline(surface=select_face, isoDirection=code_block.out0, parameter=code_block.out1)
length = Curve.Length(curve=getIsoline)
getIsoline_2 = Surface.GetIsoline(surface=select_face, isoDirection=code_block.out1, parameter=code_block.out0)
length_2 = Curve.Length(curve=getIsoline_2)
spacing_u = DoubleSlider(3000, range=1000..10000 step 1000)  # graph input
spacing_v = DoubleSlider(3000, range=1000..10000 step 1000)  # graph input
code_block_2 = CodeBlock(Srf=select_face, IsoU=length, IsoV=length_2, SpU=spacing_u, SpV=spacing_v) { Srf; IsoU; IsoV; DSCore.Math.Ceiling(IsoU/SpU); DSCore.Math.Ceiling(IsoV/SpV); }
panelQuad = Geometry.Panel.PanelQuad(srf=code_block_2.Srf, u=code_block_2.out3, v=code_block_2.out4)
code_block_3 = CodeBlock { 100; true; }
thicken = Surface.Thicken(surface=code_block_2.Srf, thickness=code_block_3.out0, both_sides=code_block_3.out1)
doesIntersect = Geometry.DoesIntersect(geometry=thicken, other=panelQuad.Points)
countFalse = List.CountFalse(list=doesIntersect@L2)
# note: Lunchbox
intersection_threshold = IntegerSlider(0, range=0..3 step 1)  # graph input
code_block_4 = CodeBlock(f=countFalse, t=intersection_threshold) { f > t; }
filterByBoolMask = List.FilterByBoolMask(list=panelQuad.Panels@L2, mask=code_block_4)
list_create = List.Create(item0=filterByBoolMask.out)
code_block_5 = CodeBlock { 0.5; }
pointAtParameter = Surface.PointAtParameter(surface=list_create, u=code_block_5, v=code_block_5)
external_normals = BoolSelector(true)  # graph input
normalAtPoint = Surface.NormalAtPoint(surface=select_face@L1, point=pointAtParameter@L3)
reverse = Vector.Reverse(vector=normalAtPoint)
# note: Zebra
if_ = Custom[Logic.If](test=external_normals, ifTrue=normalAtPoint, ifFalse=reverse)  # Retains the old status of the previous built-in IF node.
offset = DoubleInput(150)  # graph input
translate = Geometry.Translate(geometry=pointAtParameter, direction=if_, distance=offset, lacing=Longest)
flatten = List.Flatten(list=translate)
family_types = FamilyTypes(index=30)  # graph input
byPoints = AdaptiveComponent.ByPoints(points=flatten, familyType=family_types)
code_block_6 = CodeBlock()
# ---------- code_block_6.designscript (4 lines) ----------
["ABG_Data_Count1",
"ABG_Data_Area1",
"ABG_Data_Comment1",
"ABG_Data_Comment2"];
# ----------------------------------------
count = List.Count(list=byPoints)
area = Surface.Area(surface=select_face)
convert_between_units = DynamoConvert(area, MeasurementType="Area", FromConversion="SquareMillimeter", ToConversion="SquareMeter")
mass_name = StringInput("Mass Name")  # graph input
face_name = StringInput("Face Name")  # graph input
list_create_2 = List.Create(item0=count, item1=convert_between_units, item2=mass_name, item3=face_name)
flatten_2 = List.Flatten(list=list_create_2)
setParameterByName = Element.SetParameterByName(parameterName=code_block_6, value=flatten_2)  # unwired: element
map = List.Map(list=byPoints, f_x=setParameterByName)
