# Dynamo graph ABG_190828_Feasibility8.dyn "finished version" (Dynamo 2.0.3.8104)

detector_family = FamilyTypes(index=37)  # graph input
byFamilyType = FamilyInstance.ByFamilyType(familyType=detector_family)
parameter_to_filter = StringInput("ABG_Data_Comment2")  # graph input
getParameterValueByName = Element.GetParameterValueByName(element=byFamilyType, parameterName=parameter_to_filter)
value_to_filter = StringInput("")  # graph input
boolean = BoolSelector(true)
contains = String.Contains(str=getParameterValueByName, searchFor=value_to_filter, ignoreCase=boolean)
filterByBoolMask = List.FilterByBoolMask(list=byFamilyType, mask=contains)
location = FamilyInstance.Location(familyInstance=filterByBoolMask.in)
viewpoint = DSModelElementSelection()  # 1 picked in the model; graph input
location_2 = FamilyInstance.Location(familyInstance=viewpoint)
byStartPointEndPoint = Line.ByStartPointEndPoint(startPoint=location, endPoint=location_2, lacing=Longest)
geometry_for_clashing = DSModelElementsSelection()  # 3 picked in the model; graph input
geometry = Element.Geometry(element=geometry_for_clashing)
flatten = List.Flatten(list=geometry)
byUnion = Solid.ByUnion(solids=flatten)
doesIntersect = Geometry.DoesIntersect(geometry=byStartPointEndPoint, other=byUnion, lacing=Longest)
filterByBoolMask_2 = List.FilterByBoolMask(list=byStartPointEndPoint, mask=doesIntersect)  # frozen
list_create = List.Create(item0=filterByBoolMask_2.out)
filterByBoolMask_3 = List.FilterByBoolMask(list=filterByBoolMask.in, mask=doesIntersect)
code_block = CodeBlock { "ABG_Data_View1"; false; true; }
setParameterByName = Element.SetParameterByName(element=filterByBoolMask_3.in, parameterName=code_block.out0, value=code_block.out1, lacing=Longest)
setParameterByName_2 = Element.SetParameterByName(element=filterByBoolMask_3.out, parameterName=code_block.out0, value=code_block.out2, lacing=Longest)
