# Dynamo graph ABG_190830_Feasibility9.dyn "finished script" (Dynamo 2.0.3.8104)

# group: Minute intervals
minute_intervals = IntegerSlider(60, range=1..60 step 1)
code_block = CodeBlock(c=minute_intervals) { list = 0..60..#(c+1); }
count = List.Count(list=code_block)
code_block_2 = CodeBlock(x=count) { x-1; }
removeItemAtIndex = List.RemoveItemAtIndex(list=code_block, indices=code_block_2)

code_block_3 = CodeBlock { 100; 0; }
takeEveryNthItem = List.TakeEveryNthItem(n=code_block_3.out0, offset=code_block_3.out1)  # unwired: list

# group: Refine for continuity
code_block_4 = CodeBlock { input_list; }  # unwired: input_list
code_block_5 = CodeBlock { vectors; }  # unwired: vectors
count_2 = List.Count(list=code_block_5)
code_block_6 = CodeBlock { 0; }
allIndicesOf = List.AllIndicesOf(list=code_block_4@L2, item=code_block_6)
code_block_7 = CodeBlock { 0; }
addItemToFront = List.AddItemToFront(item=code_block_7, list=allIndicesOf@L2)
sub = allIndicesOf - addItemToFront
sum = Math.Sum(values=sub)
code_block_8 = CodeBlock(count=count_2, sum=sum) { count-sum; }
addItemToEnd = List.AddItemToEnd(item=code_block_8@L1, list=sub@L2)
chop = List.Chop(list=code_block_4@L2, lengths=addItemToEnd@L2)
sum_2 = Math.Sum()  # unwired: values
map = List.Map(list=chop, f_x=sum_2)
code_block_9 = CodeBlock { 15; }
code_block_10 = CodeBlock(consec=map, interval=code_block_9) { consec/interval; }
floor = Math.Floor(number=code_block_10)
sum_3 = Math.Sum(values=floor)

detector = FamilyTypes(index=37)  # graph input
byFamilyType = FamilyInstance.ByFamilyType(familyType=detector)
parameter_filter_1 = StringInput("ABG_Data_Comment1")  # graph input
getParameterValueByName = Element.GetParameterValueByName(element=byFamilyType, parameterName=parameter_filter_1)
filter_value_1 = StringInput("Option 1B")  # graph input
boolean = BoolSelector(true)
contains = String.Contains(str=getParameterValueByName, searchFor=filter_value_1, ignoreCase=boolean)
filterByBoolMask = List.FilterByBoolMask(list=byFamilyType, mask=contains)
parameter_filter_2 = StringInput("ABG_Data_Comment2")  # graph input
getParameterValueByName_2 = Element.GetParameterValueByName(element=filterByBoolMask.in, parameterName=parameter_filter_2)
filter_value_2 = StringInput("Tower")  # graph input
boolean_2 = BoolSelector(true)
contains_2 = String.Contains(str=getParameterValueByName_2, searchFor=filter_value_2, ignoreCase=boolean_2)
filterByBoolMask_2 = List.FilterByBoolMask(list=filterByBoolMask.in, mask=contains_2)
string = StringInput("ABG_Data_SunHours1")
getLocation = Element.GetLocation(element=filterByBoolMask_2.in)
epw_file = Filename(".\AUS_NSW.Sydney.947670_IWEC.epw")  # graph input
import_location = Custom[Import Location](epwFile=epw_file)  # Import location. -
month = IntegerSlider(6, range=1..12 step 1)  # graph input
day = IntegerSlider(22, range=1..31 step 1)  # graph input
hour_start = IntegerSlider(9, range=1..23 step 1)  # graph input
hour_end = IntegerSlider(15, range=1..23 step 1)  # graph input
code_block_11 = CodeBlock(x=hour_start, y=hour_end) { x..y..1; }
calculate_hoy = Custom[Calculate HOY](month=month, day=day, hour=code_block_11, lacing=CrossProduct)  # Calculate hour of the year. -
sunPath = Custom[SunPath](location=import_location.location, hoys=calculate_hoy.hoy)  # Use this component to make a 3D sun-path (aka. sun plot). The component also outputs sun vectors that can be used for solar access analysis or shading design. -
flatten = List.Flatten(list=sunPath.vectors)
reverse = Vector.Reverse(vector=flatten)
vector_reach = DoubleSlider(1000000, range=100000..1500000 step 100000)  # graph input
byStartPointDirectionLength = Line.ByStartPointDirectionLength(direction=reverse, length=vector_reach, lacing=Longest)  # unwired: startPoint
map_2 = List.Map(list=getLocation, f_x=byStartPointDirectionLength)
collision_elements = DSModelElementsSelection()  # 4 picked in the model; graph input
geometry = Element.Geometry(element=collision_elements)
flatten_2 = List.Flatten(list=geometry)
byUnion = Solid.ByUnion(solids=flatten_2)
doesIntersect = Geometry.DoesIntersect(geometry=map_2, other=byUnion)
code_block_12 = CodeBlock { 0; 1; }
if_ = Custom[Logic.If](test=doesIntersect, ifTrue=code_block_12.out0, ifFalse=code_block_12.out1)  # Retains the old status of the previous built-in IF node.
sum_4 = Math.Sum(values=if_)
setParameterByName = Element.SetParameterByName(element=filterByBoolMask_2.in, parameterName=string, value=sum_4)
