# Dynamo graph ABG_190902_Feasibility10.dyn "wip script 2" (Dynamo 2.0.3.8104)

code_block = CodeBlock { 100; 0; }
takeEveryNthItem = List.TakeEveryNthItem(n=code_block.out0, offset=code_block.out1)  # unwired: list
family_types = FamilyTypes(index=37)
byFamilyType = FamilyInstance.ByFamilyType(familyType=family_types)
string = StringInput("ABG_Data_Comment1")
getParameterValueByName = Element.GetParameterValueByName(element=byFamilyType, parameterName=string)
string_2 = StringInput("Option 1B")
boolean = BoolSelector(false)
contains = String.Contains(str=getParameterValueByName, searchFor=string_2, ignoreCase=boolean)
filterByBoolMask = List.FilterByBoolMask(list=byFamilyType, mask=contains)
string_3 = StringInput("ABG_Data_Comment2")
getParameterValueByName_2 = Element.GetParameterValueByName(element=filterByBoolMask.in, parameterName=string_3)
string_4 = StringInput("Tower")
boolean_2 = BoolSelector(false)
contains_2 = String.Contains(str=getParameterValueByName_2, searchFor=string_4, ignoreCase=boolean_2)
filterByBoolMask_2 = List.FilterByBoolMask(list=filterByBoolMask.in, mask=contains_2)
getLocation = Element.GetLocation(element=filterByBoolMask_2.in)
file_path = Filename("C:\Users\GavinC\Desktop\demo\feaso 9\AUS_NSW.Sydney.947670_IWEC.epw")
import_location = Custom[Import Location](epwFile=file_path)  # Import location. -
integer_slider = IntegerSlider(6, range=1..12 step 1)
integer_slider_2 = IntegerSlider(22, range=1..31 step 1)
integer_slider_3 = IntegerSlider(15, range=1..23 step 1)
code_block_2 = CodeBlock { 15; }
calculate_hoy = Custom[Calculate HOY](month=integer_slider, day=integer_slider_2, hour=integer_slider_3, minute=code_block_2, lacing=CrossProduct)  # Calculate hour of the year. -
sunPath = Custom[SunPath](location=import_location.location, hoys=calculate_hoy.hoy)  # Use this component to make a 3D sun-path (aka. sun plot). The component also outputs sun vectors that can be used for solar access analysis or shading design. -
integer_slider_4 = IntegerSlider(9, range=1..23 step 1)
code_block_3 = CodeBlock(s=integer_slider_4, e=integer_slider_3) { s..e..1; }
code_block_4 = CodeBlock { 0..45..15; }
calculate_hoy_2 = Custom[Calculate HOY](month=integer_slider, day=integer_slider_2, hour=code_block_3, minute=code_block_4, lacing=CrossProduct)
sunPath_2 = Custom[SunPath](location=import_location.location, hoys=calculate_hoy_2.hoy)
addItemToEnd = List.AddItemToEnd(item=sunPath.vectors, list=sunPath_2.vectors)
flatten = List.Flatten(list=addItemToEnd)
reverse = Vector.Reverse(vector=flatten)
integer_slider_5 = IntegerSlider(1000000, range=500000..2000000 step 1)
byStartPointDirectionLength = Line.ByStartPointDirectionLength(direction=reverse, length=integer_slider_5, lacing=Longest)  # unwired: startPoint
map = List.Map(list=getLocation, f_x=byStartPointDirectionLength)
select_model_elements = DSModelElementsSelection()  # 4 picked in the model
geometry = Element.Geometry(element=select_model_elements)
flatten_2 = List.Flatten(list=geometry)
byUnion = Solid.ByUnion(solids=flatten_2)
doesIntersect = Geometry.DoesIntersect(geometry=map, other=byUnion)
code_block_5 = CodeBlock { 0; 1; }
if_ = Custom[Logic.If](test=doesIntersect, ifTrue=code_block_5.out0, ifFalse=code_block_5.out1)  # Retains the old status of the previous built-in IF node.
string_5 = StringInput("ABG_Data_SunHours1")
setParameterByName = Element.SetParameterByName(parameterName=string_5)  # unwired: element, value
list_create = List.Create()  # unwired: item0, item1
code_block_6 = CodeBlock { false; }
addItemToFront = List.AddItemToFront(item=code_block_6, list=doesIntersect@L2)
combine = List.Combine(comb=list_create, list1=addItemToFront, list2=doesIntersect)
