# Dynamo graph ABG_190904_Feasibility11.dyn "sensor naming" (Dynamo 2.0.3.8104)

family_types = FamilyTypes()  # nothing selected
byFamilyType = FamilyInstance.ByFamilyType(familyType=family_types)
getLocation = Element.GetLocation(element=byFamilyType)
Z = Point.Z(point=getLocation)
sortByKey = List.SortByKey(list=byFamilyType, keys=Z)
string = StringInput("Comments")
string_2 = StringInput("Level ")
code_block = CodeBlock { 10..34..1; }
add = string_2 + code_block  # lacing=Longest
code_block_2 = CodeBlock { 19; }
ofRepeatedItem = List.OfRepeatedItem(item=add@L1, amount=code_block_2)
flatten = List.Flatten(list=ofRepeatedItem)
setParameterByName = Element.SetParameterByName(element=sortByKey.sorted_list, parameterName=string, value=flatten)
