# Dynamo graph ABG_190909_ViewStripper.dyn "Finished script" (Dynamo 2.0.3.8104)

# group: Get Views
string = StringInput("Views")
byName = Category.ByName(name=string)
all_elements_of_category = ElementsOfCategory(Category=byName)

# group: Get Views
string_2 = StringInput("Views")
byName_2 = Category.ByName(name=string_2)
all_elements_of_category_2 = ElementsOfCategory(Category=byName_2)

# group: Get parameters
view_type = ViewTypesUi(index=9)
getByType = archilab.Revit.Views.Views.GetByType(viewType=view_type)
string_3 = StringInput("Sheets")
byName_3 = Category.ByName(name=string_3)
all_elements_of_category_3 = ElementsOfCategory(Category=byName_3)
code_block = CodeBlock(x=getByType, y=all_elements_of_category_3) { x[0]; y[0]; }
parameters = Element.Parameters(element=code_block.out0)
name = Parameter.Name(parameter=parameters)
parameters_2 = Element.Parameters(element=code_block.out1)
name_2 = Parameter.Name(parameter=parameters_2)

# group: Build UI
code_block_2 = CodeBlock { "Select filter parameters"; "Next step"; "Cancel"; 500; 500; }
file_path = Filename("..\..\Image Sources\DYNoMite\DYNoMite Logo PSD Alpha Lo-Res.png")
code_block_3 = CodeBlock { "View Parameter"; "Sheet Parameter"; 0; true; }
ui_dropdown_data = Custom[UI.DropDown Data](InputName=code_block_3.out0, Keys_var=name, Values_var=name, DefaultValueIndex=code_block_3.out2, Sorted_optional=code_block_3.out3)  # Create data for DropDown input in UI.MultiInputForm ++ . Check out www.data-shapes.net for more infos.
ui_dropdown_data_2 = Custom[UI.DropDown Data](InputName=code_block_3.out1, Keys_var=name_2, Values_var=name_2, DefaultValueIndex=code_block_3.out2, Sorted_optional=code_block_3.out3)
list_create = List.Create(item0=ui_dropdown_data, item1=ui_dropdown_data_2)
boolean = BoolSelector(true)
ui_multipleinputform = Custom[UI.MultipleInputForm ++](Description_optional=code_block_2.out0, Logo_optional=file_path, ButtonText_optional=code_block_2.out1, Inputs=list_create, Toggle=boolean, CancelButtonText_optional=code_block_2.out2, MaxHeight_optional=code_block_2.out3, Width_optional=code_block_2.out4)  # Create a form with multiple inputs. see www.data-shapes.net for tutorials and infos!

# group: Get Sheets
string_4 = StringInput("Sheets")
byName_4 = Category.ByName(name=string_4)
all_elements_of_category_4 = ElementsOfCategory(Category=byName_4)

# group: Get parameters, clean up lists
isNull = Object.IsNull(obj=all_elements_of_category_2)
filterByBoolMask = List.FilterByBoolMask(list=all_elements_of_category_2, mask=isNull)
code_block_4 = CodeBlock(x=ui_multipleinputform.User_Inputs) { x[0]; x[1]; }
getParameterValueByName = Element.GetParameterValueByName(element=filterByBoolMask.out, parameterName=code_block_4.out0)
uniqueItems = List.UniqueItems(list=getParameterValueByName)
string_5 = StringInput("")
eq = uniqueItems == string_5
filterByBoolMask_2 = List.FilterByBoolMask(list=uniqueItems, mask=eq)
getParameterValueByName_2 = Element.GetParameterValueByName(element=all_elements_of_category_4, parameterName=code_block_4.out1)
uniqueItems_2 = List.UniqueItems(list=getParameterValueByName_2)
string_6 = StringInput("")
eq_2 = uniqueItems_2 == string_6
filterByBoolMask_3 = List.FilterByBoolMask(list=uniqueItems_2, mask=eq_2)

# group: Build List UI
code_block_5 = CodeBlock { "Select what to delete..."; "Delete!"; "Cancel"; 500; }
file_path_2 = Filename("..\..\Image Sources\DYNoMite\DYNoMite Logo PSD Alpha Lo-Res.png")
code_block_6 = CodeBlock { "View Parameter Equals..."; 200; false; true; }
ui_listview_data = Custom[UI.Listview Data](InputName=code_block_6.out0, Keys_var=filterByBoolMask_2.out, Values_var=filterByBoolMask_2.out, Height_optionnal=code_block_6.out1, HilightInView_optionnal=code_block_6.out2, DisplayModeOnly_optionnal=code_block_6.out2, ShowElementCount_optionnal=code_block_6.out3, SortItems_optionnal=code_block_6.out3, ShowId_optionnal=code_block_6.out2)  # Create data for ListView input in UI.MultiInputForm ++ . Check out www.data-shapes.net for more infos.
code_block_7 = CodeBlock { "Sheet Parameter Equals..."; 200; false; true; }
ui_listview_data_2 = Custom[UI.Listview Data](InputName=code_block_7.out0, Keys_var=filterByBoolMask_3.out, Values_var=filterByBoolMask_3.out, Height_optionnal=code_block_7.out1, HilightInView_optionnal=code_block_7.out2, DisplayModeOnly_optionnal=code_block_7.out2, ShowElementCount_optionnal=code_block_7.out3, SortItems_optionnal=code_block_7.out3, ShowId_optionnal=code_block_7.out2)
list_create_2 = List.Create(item0=ui_listview_data, item1=ui_listview_data_2)
boolean_2 = BoolSelector(true)
ui_multipleinputform_2 = Custom[UI.MultipleInputForm ++](Description_optional=code_block_5.out0, Logo_optional=file_path_2, ButtonText_optional=code_block_5.out1, Inputs=list_create_2, Toggle=boolean_2, CancelButtonText_optional=code_block_5.out2, Width_optional=code_block_5.out3)
code_block_8 = CodeBlock(x=ui_multipleinputform_2.User_Inputs) { views=x[0]; sheets=x[1]; }

# group: Find matching views
isNull_2 = Object.IsNull(obj=all_elements_of_category)
filterByBoolMask_4 = List.FilterByBoolMask(list=all_elements_of_category, mask=isNull_2)
getParameterValueByName_3 = Element.GetParameterValueByName(element=filterByBoolMask_4.out, parameterName=code_block_4.out0)
contains = List.Contains(list=code_block_8.views, item=getParameterValueByName_3@L1)
filterByBoolMask_5 = List.FilterByBoolMask(list=filterByBoolMask_4.out, mask=contains)

count = List.Count(list=filterByBoolMask_5.in)

# group: Get Sheets
string_7 = StringInput("Sheets")
byName_5 = Category.ByName(name=string_7)
all_elements_of_category_5 = ElementsOfCategory(Category=byName_5)

# group: Find matching sheets
isNull_3 = Object.IsNull(obj=all_elements_of_category_5)
filterByBoolMask_6 = List.FilterByBoolMask(list=all_elements_of_category_5, mask=isNull_3)
getParameterValueByName_4 = Element.GetParameterValueByName(element=filterByBoolMask_6.out, parameterName=code_block_4.out1)
contains_2 = List.Contains(list=code_block_8.sheets, item=getParameterValueByName_4@L1)
filterByBoolMask_7 = List.FilterByBoolMask(list=filterByBoolMask_6.out, mask=contains_2)

# group: Merge and Delete
list_create_3 = List.Create(item0=filterByBoolMask_5.in, item1=filterByBoolMask_7.in)
flatten = List.Flatten(list=list_create_3)
delete = Orchid.Revit.Elements.Element.Delete(element=flatten)

count_2 = List.Count(list=filterByBoolMask_7.in)

# group: Results UI
code_block_9 = CodeBlock { "Results"; "Finished"; "Cancel"; 500; 500; }
file_path_3 = Filename("..\..\Image Sources\DYNoMite\DYNoMite Logo PSD Alpha Lo-Res.png")
code_block_10 = CodeBlock { "Views Deleted:"; }
code_block_11 = CodeBlock(passthrough=count, waitfor=delete) { [passthrough,waitfor][0]; }
string_from_object = FromObject(obj=code_block_11)
ui_textnote_data = Custom[UI.TextNote Data](Title=code_block_10, TextNote_string_var=string_from_object)  # Create Data for TextNote input in UI.MultipleInputForm ++ . Check out www.data-shapes.net for more informations
code_block_12 = CodeBlock { "Sheets Deleted:"; }
code_block_13 = CodeBlock(passthrough=count_2, waitfor=delete) { [passthrough,waitfor][0]; }
string_from_object_2 = FromObject(obj=code_block_13)  # graph output
ui_textnote_data_2 = Custom[UI.TextNote Data](Title=code_block_12, TextNote_string_var=string_from_object_2)
list_create_4 = List.Create(item0=ui_textnote_data, item1=ui_textnote_data_2)
boolean_3 = BoolSelector(true)
ui_multipleinputform_3 = Custom[UI.MultipleInputForm ++](Description_optional=code_block_9.out0, Logo_optional=file_path_3, ButtonText_optional=code_block_9.out1, Inputs=list_create_4, Toggle=boolean_3, CancelButtonText_optional=code_block_9.out2, MaxHeight_optional=code_block_9.out3, Width_optional=code_block_9.out4)
