# Dynamo graph ABG_190911_Warnings-Highlight.dyn "Highlight warnings" (Dynamo 2.0.3.8104)

all_elements_in_active_view = ElementsInView()
getWarnings = archilab.Revit.Elements.Warning.GetWarnings()
elements = archilab.Revit.Elements.Warning.Elements(warning=getWarnings)
id = archilab.Revit.Elements.WarningElement.Id(warningElement=elements)
flatten = List.Flatten(list=id)
uniqueItems = List.UniqueItems(list=flatten)
id_2 = Element.Id(element=all_elements_in_active_view)
contains = List.Contains(list=uniqueItems@L2, item=id_2, lacing=Longest)
filterByBoolMask = List.FilterByBoolMask(list=all_elements_in_active_view, mask=contains)
code_block = CodeBlock { 255; 125; 0; }
byARGB = Color.ByARGB(a=code_block.out0, r=code_block.out0, g=code_block.out1, b=code_block.out2)
byARGB_2 = Color.ByARGB(a=code_block.out0, r=code_block.out0, g=code_block.out0, b=code_block.out2)
fill_patterns = FillPatterns(index=1)
byProperties = Revit.Filter.OverrideGraphicSettings.ByProperties(projectionFillColor=byARGB, projectionLineColor=byARGB_2, projectionFillPattern=fill_patterns)
overrideInView = Element.OverrideInView(element=filterByBoolMask.in, overrides=byProperties)
code_block_2 = CodeBlock { 255; 125; 0; }
byARGB_3 = Color.ByARGB(a=code_block_2.out0, r=code_block_2.out0, g=code_block_2.out0, b=code_block_2.out0)
byARGB_4 = Color.ByARGB(a=code_block_2.out0, r=code_block_2.out1, g=code_block_2.out1, b=code_block_2.out1)
fill_patterns_2 = FillPatterns(index=1)
code_block_3 = CodeBlock { 100; }
boolean = BoolSelector(true)
byProperties_2 = Revit.Filter.OverrideGraphicSettings.ByProperties(projectionFillColor=byARGB_3, projectionLineColor=byARGB_4, projectionFillPattern=fill_patterns_2, transparency=code_block_3, halftone=boolean)
overrideInView_2 = Element.OverrideInView(element=filterByBoolMask.out, overrides=byProperties_2)
