# Dynamo graph ABG_190911_Warnings-IsolateType.dyn "Isolate warning type" (Dynamo 2.0.3.8104)

warning_type = WarningsOfType(index=2)  # graph input
failingElements = Bang.Revit.Elements.Warning.FailingElements(warning=warning_type)
flatten = List.Flatten(list=failingElements)
uniqueItems = List.UniqueItems(list=flatten)
code_block = CodeBlock { 255; 125; 0; }
byARGB = Color.ByARGB(a=code_block.out0, r=code_block.out2, g=code_block.out1, b=code_block.out0)
byARGB_2 = Color.ByARGB(a=code_block.out0, r=code_block.out2, g=code_block.out2, b=code_block.out0)
fill_patterns = FillPatterns(index=1)
byProperties = Revit.Filter.OverrideGraphicSettings.ByProperties(projectionFillColor=byARGB, projectionLineColor=byARGB_2, projectionFillPattern=fill_patterns)
overrideInView = Element.OverrideInView(element=uniqueItems, overrides=byProperties)
