# Dynamo graph ABG_190911_Warnings-Reset.dyn "Reset graphics" (Dynamo 2.0.3.8104)

all_elements_in_active_view = ElementsInView()
current = Document.Current()
activeView = Document.ActiveView(document=current)
resetElementOverrides = Custom[View.ResetElementOverrides](element=all_elements_in_active_view, view=activeView)  # Resets all overrides for an element in a given view
