# Dynamo graph ABG_190916_ModelPenetrations.dyn "Finished script" (Dynamo 2.0.3.8104)

wall_for_opening = DSModelElementSelection()  # 1 picked in the model; graph input
circular_opening = BoolSelector(false)  # graph input
window_family = FamilyTypes(index=30)  # graph input
window_family_2 = FamilyTypes(index=117)  # graph input
if_ = Custom[Logic.If](test=circular_opening, ifTrue=window_family, ifFalse=window_family_2)  # Retains the old status of the previous built-in IF node.
elements_for_opening = DSModelElementsSelection()  # 2 picked in the model; graph input
geometry = Element.Geometry(element=elements_for_opening)
flatten = List.Flatten(list=geometry)
type = Object.Type(obj=flatten)
code_block = CodeBlock { "solid"; true; }
contains = String.Contains(str=type, searchFor=code_block.out0, ignoreCase=code_block.out1)
filterByBoolMask = List.FilterByBoolMask(list=flatten, mask=contains)
byUnion = Solid.ByUnion(solids=filterByBoolMask.in)
geometry_2 = Element.Geometry(element=wall_for_opening)
intersect = Geometry.Intersect(geometry=byUnion, other=geometry_2)
boundingBox = Geometry.BoundingBox(geometry=intersect)
toCuboid = BoundingBox.ToCuboid(boundingBox=boundingBox)

# group: Centroid of intersection
centroid = Solid.Centroid(solid=toCuboid)

byPoints = Custom[Springs.HostedInstance.ByPoints](host=wall_for_opening, type=if_, point=centroid)  # Creates hosted family instances(doors/windows) at the specified points. You can feed either a single family type or a unique type for each instance.
code_block_2 = CodeBlock { "Width"; "Height"; }

# group: Wall geometry
getLocation = Element.GetLocation(element=wall_for_opening)
startPoint = Curve.StartPoint(curve=getLocation)
endPoint = Curve.EndPoint(curve=getLocation)

# group: Find Angle to work at Dynamo north for
XAxis = Vector.XAxis()
code_block_3 = CodeBlock { 1000; }
translate = Geometry.Translate(geometry=startPoint, direction=XAxis, distance=code_block_3)
byTwoPoints = Vector.ByTwoPoints(start=startPoint, end=translate)
byTwoPoints_2 = Vector.ByTwoPoints(start=startPoint, end=endPoint)
ZAxis = Vector.ZAxis()
angleAboutAxis = Vector.AngleAboutAxis(vector=byTwoPoints, otherVector=byTwoPoints_2, rotationAxis=ZAxis)
code_block_4 = CodeBlock(x=angleAboutAxis) { x*-1; }

# group: Rotate and find bounding box at Dynamo north
ZAxis_2 = Vector.ZAxis()
rotate = Geometry.Rotate(geometry=intersect, origin=centroid, axis=ZAxis_2, degrees=code_block_4)
boundingBox_2 = Geometry.BoundingBox(geometry=rotate)
toCuboid_2 = BoundingBox.ToCuboid(boundingBox=boundingBox_2)

# group: Opening Tolerance
opening_tolerance = DoubleSlider(0, range=0..1000 step 50)  # graph input

# group: Find Opening size
width = Cuboid.Width(cuboid=toCuboid_2)
height = Cuboid.Height(cuboid=toCuboid_2)
code_block_5 = CodeBlock(bb_w=width, inc_s=opening_tolerance, bb_h=height) { bb_w+inc_s; bb_h+inc_s; }

setParameterByName = Element.SetParameterByName(element=byPoints, parameterName=code_block_2.out0, value=code_block_5.out0)
setParameterByName_2 = Element.SetParameterByName(element=byPoints, parameterName=code_block_2.out1, value=code_block_5.out1)
