# Dynamo graph ABG_190918_ViewFromSun.dyn "Finished script" (Dynamo 2.0.3.8104)

focal_element_ideally_small = DSModelElementSelection()  # 1 picked in the model; graph input
geometry = Element.Geometry(element=focal_element_ideally_small)
type = Object.Type(obj=geometry)
code_block = CodeBlock { "solid"; true; }
contains = String.Contains(str=type, searchFor=code_block.out0, ignoreCase=code_block.out1)
filterByBoolMask = List.FilterByBoolMask(list=geometry, mask=contains)
flatten = List.Flatten(list=filterByBoolMask.in)
byUnion = Solid.ByUnion(solids=flatten)
centroid = Solid.Centroid(solid=byUnion)
epw_file = Filename(".\AUS_NSW.Sydney.947670_IWEC.epw")  # graph input
import_location = Custom[Import Location](epwFile=epw_file)  # Import location. -
month = IntegerSlider(6, range=1..12 step 1)  # graph input
day = IntegerSlider(22, range=1..31 step 1)  # graph input
hour_start = IntegerSlider(9, range=1..23 step 1)  # graph input
hour_end = IntegerSlider(15, range=1..23 step 1)  # graph input
code_block_2 = CodeBlock(s=hour_start, e=hour_end) { s..e..1; }
calculate_hoy = Custom[Calculate HOY](month=month, day=day, hour=code_block_2, lacing=CrossProduct)  # Calculate hour of the year. -
sunPath = Custom[SunPath](location=import_location.location, hoys=calculate_hoy.hoy)  # Use this component to make a 3D sun-path (aka. sun plot). The component also outputs sun vectors that can be used for solar access analysis or shading design. -
reverse = Vector.Reverse(vector=sunPath.vectors)
metres_from_target = DoubleInput(200)  # graph input
convert_between_units = DynamoConvert(metres_from_target, MeasurementType="Length", FromConversion="Meters", ToConversion="Millimeters")
translate = Geometry.Translate(geometry=centroid, direction=reverse, distance=convert_between_units)
view_prefix = StringInput("Sun View")  # graph input
view_suffix = StringInput("Option XX")  # graph input
code_block_3 = CodeBlock(pref=view_prefix, dd=month, mm=day, hh=code_block_2, suff=view_suffix) { pref+" - "+dd+"-"+mm+"_"+hh+"-00 - "+suff; }
boolean = BoolSelector(false)
byEyePointTargetAndElement = PerspectiveView.ByEyePointTargetAndElement(eyePoint=translate, target=centroid, element=focal_element_ideally_small, name=code_block_3, isolateElement=boolean, lacing=Longest)
locked_view = BoolSelector(false)  # graph input
not_ = Not(x=locked_view)
n3dview_lock_or_unlock = Custom[3DView Lock or Unlock](3DView=byEyePointTargetAndElement, Toggle=not_, lacing=Longest)  # Use a boolean True to unlock the 3D view. False locks the 3D view and saves its orientation.
watch = Watch(code_block_3)
