# Dynamo graph ABG_190920_DependentViews.dyn "Basic script" (Dynamo 2.0.3.8104)

list_create = List.Create()  # unwired: item0, item1, item2
flatten = List.Flatten(list=list_create)
code_block = CodeBlock { "Select views and scope boxes"; "Apply as dependent"; "Cancel"; 800; }
file_path = Filename(".\logo.jpg")
code_block_2 = CodeBlock { "Views to apply scope boxes to"; 300; }
view_type = ViewTypesUi(index=9)
getByType = archilab.Revit.Views.Views.GetByType(viewType=view_type)
name = Element.Name(element=getByType)
code_block_3 = CodeBlock(name_v=name) { "Floor Plan: "+name_v; }
view_type_2 = ViewTypesUi(index=1)
getByType_2 = archilab.Revit.Views.Views.GetByType(viewType=view_type_2)
name_2 = Element.Name(element=getByType_2)
code_block_4 = CodeBlock(name_v=name_2) { "Ceiling Plan: "+name_v; }
view_type_3 = ViewTypesUi(index=0)
getByType_3 = archilab.Revit.Views.Views.GetByType(viewType=view_type_3)
name_3 = Element.Name(element=getByType_3)
code_block_5 = CodeBlock(name_v=name_3) { "Area Plan: "+name_v; }
list_create_2 = List.Create(item0=code_block_3, item1=code_block_4, item2=code_block_5)
flatten_2 = List.Flatten(list=list_create_2)
list_create_3 = List.Create(item0=getByType, item1=getByType_2, item2=getByType_3)
flatten_3 = List.Flatten(list=list_create_3)
ui_listview_data = Custom[UI.Listview Data](InputName=code_block_2.out0, Keys_var=flatten_2, Values_var=flatten_3, Height_optionnal=code_block_2.out1)  # Create data for ListView input in UI.MultiInputForm ++ . Check out www.data-shapes.net for more infos.
code_block_6 = CodeBlock { "Scope Boxes"; 100; }
string = StringInput("Scope Boxes")
byName = Category.ByName(name=string)
all_elements_of_category = ElementsOfCategory(Category=byName)
name_4 = Element.Name(element=all_elements_of_category)
ui_listview_data_2 = Custom[UI.Listview Data](InputName=code_block_6.out0, Keys_var=name_4, Values_var=all_elements_of_category, Height_optionnal=code_block_6.out1)
list_create_4 = List.Create(item0=ui_listview_data, item1=ui_listview_data_2)
boolean = BoolSelector(true)
ui_multipleinputform = Custom[UI.MultipleInputForm ++](Description_optional=code_block.out0, Logo_optional=file_path, ButtonText_optional=code_block.out1, Inputs=list_create_4, Toggle=boolean, CancelButtonText_optional=code_block.out2, MaxHeight_optional=code_block.out3, Width_optional=code_block.out3)  # Create a form with multiple inputs. see www.data-shapes.net for tutorials and infos!
code_block_7 = CodeBlock(list=ui_multipleinputform.User_Inputs) { list[0]; list[1]; }
count = List.Count(list=code_block_7.out1)
cycle = List.Cycle(list=code_block_7.out0@L1, amount=count)
flatten_4 = List.Flatten(list=cycle)
name_5 = Element.Name(element=flatten_4)
count_2 = List.Count(list=code_block_7.out0)
cycle_2 = List.Cycle(list=code_block_7.out1, amount=count_2)
name_6 = Element.Name(element=cycle_2)
code_block_8 = CodeBlock(v_name=name_5, s_name=name_6) { v_name+" - "+s_name; }
duplicate_options = DuplicateOptionsUi(index=0)
duplicate = archilab.Revit.Views.Views.Duplicate(view=flatten_4, name=code_block_8, options=duplicate_options, lacing=Longest)
string_2 = StringInput("Scope Box")
setParameterByName = Element.SetParameterByName(element=duplicate, parameterName=string_2, value=cycle_2)
