# Dynamo graph ABG_190923_ScopeBox-2-Sheets.dyn "2 - Create sheets" (Dynamo 2.0.3.8104)

# group: Inputs
excel_data = Filename(".\Sheets input.xlsx")  # graph input
sheet_name = StringInput("Sheet1")  # graph input
header_rows_to_ignore = IntegerSlider(1, range=0..100 step 1)  # graph input

# group: Excel process
file_from_path = FileObject(path=excel_data)
boolean = BoolSelector(true)
boolean_2 = BoolSelector(false)
importExcel = Data.ImportExcel(file=file_from_path, sheetName=sheet_name, readAsStrings=boolean, showExcel=boolean_2)

# group: Sheet Name and Number
dropItems = List.DropItems(list=importExcel, amount=header_rows_to_ignore)
transpose = List.Transpose(lists=dropItems)
code_block = CodeBlock { 0; 1; }
getItemAtIndex = List.GetItemAtIndex(list=transpose, index=code_block.out0)
getItemAtIndex_2 = List.GetItemAtIndex(list=transpose, index=code_block.out1)

# group: Get Values
code_block_2 = CodeBlock { 0; }
getItemAtIndex_3 = List.GetItemAtIndex(list=importExcel, index=code_block_2)
code_block_3 = CodeBlock { 2; }
dropItems_2 = List.DropItems(list=getItemAtIndex_3, amount=code_block_3)
dropItems_3 = List.DropItems(list=transpose, amount=code_block_3)

# group: Make Sheets and Add Data
createPlaceholder = archilab.Revit.Views.Sheets.CreatePlaceholder(number=getItemAtIndex, name=getItemAtIndex_2)
setParameterByName = Element.SetParameterByName(element=createPlaceholder, lacing=Shortest)  # unwired: parameterName, value
combine = List.Combine(comb=setParameterByName, list1=dropItems_2, list2=dropItems_3)
