# Dynamo graph ABG_190923_ScopeBox-3-ViewToSheets.dyn "3 - views to sheet" (Dynamo 2.0.3.8104)

# group: Inputs
excel_file = Filename(".\Sample 1.xlsx")  # graph input
excel_sheet_name = StringInput("Sheet1")  # graph input
rows_to_ignore_at_top = IntegerSlider(1, range=0..100 step 1)  # graph input

# group: Process excel
file_from_path = FileObject(path=excel_file)
boolean = BoolSelector(true)
boolean_2 = BoolSelector(false)
importExcel = Data.ImportExcel(file=file_from_path, sheetName=excel_sheet_name, readAsStrings=boolean, showExcel=boolean_2)
dropItems = List.DropItems(list=importExcel, amount=rows_to_ignore_at_top)
transpose = List.Transpose(lists=dropItems)
code_block = CodeBlock(list=transpose) { list[0]; list[1]; }

# group: Get Sheets
string = StringInput("Sheets")
byName = Category.ByName(name=string)
all_elements_of_category = ElementsOfCategory(Category=byName)
sheetNumber = Sheet.SheetNumber(sheet=all_elements_of_category)
indexOf = List.IndexOf(list=sheetNumber, element=code_block.out0)
getItemAtIndex = List.GetItemAtIndex(list=all_elements_of_category, index=indexOf)

# group: Get Views
view_type = ViewTypesUi(index=0)  # graph input
getByType = archilab.Revit.Views.Views.GetByType(viewType=view_type)
name = Element.Name(element=getByType)
indexOf_2 = List.IndexOf(list=name, element=code_block.out1)
getItemAtIndex_2 = List.GetItemAtIndex(list=getByType, index=indexOf_2)

# group: Viewport BBox
reference_view = DSModelElementSelection()  # 1 picked in the model; graph input
# note: Rhythm
locationData = Rhythm.Revit.Elements.Viewport.LocationData(viewport=reference_view)
count = List.Count(list=getItemAtIndex)
ofRepeatedItem = List.OfRepeatedItem(item=locationData.boxCenter, amount=count)
flatten = List.Flatten(list=ofRepeatedItem)

# group: Move Views
# note: SteamNodes
placeViewsOnExistingSheets = Custom[Tool.PlaceViewsOnExistingSheets](Sheet=getItemAtIndex, View=getItemAtIndex_2, Point=flatten)  # Place the views on the sheets at the points you provide.
flatten_2 = List.Flatten(list=placeViewsOnExistingSheets)

# group: Get Viewport types
element_types = ElementTypes(index=335)
all_elements_of_type = ElementsOfType(element_type=element_types)
type = archilab.Revit.Elements.Elements.Type(element=all_elements_of_type)
uniqueItems = List.UniqueItems(list=type)

# group: Input
viewport_type = StringInput("None")  # graph input

# group: Find Viewport type
name_2 = Element.Name(element=uniqueItems)
eq = name_2 == viewport_type
filterByBoolMask = List.FilterByBoolMask(list=uniqueItems, mask=eq)
code_block_2 = CodeBlock(viewp=uniqueItems) { viewp[0]; }

# group: If no match, get first type
count_2 = List.Count(list=filterByBoolMask.in)
code_block_3 = CodeBlock(x=count_2) { x==1; }
# note: Zebra
if_ = Custom[Logic.If](test=code_block_3, ifTrue=filterByBoolMask.in, ifFalse=code_block_2)  # Retains the old status of the previous built-in IF node.

# group: Set Viewport Types
string_2 = StringInput("Type")
setParameterByName = Element.SetParameterByName(element=flatten_2, parameterName=string_2, value=if_, lacing=Longest)
