# Dynamo graph ABG_190925_Titleblocks-1.dyn "demo1" (Dynamo 2.0.3.8104)

family_types = FamilyTypes(index=0)  # graph input
byFamilyType = FamilyInstance.ByFamilyType(familyType=family_types)
view = Orchid.Revit.Elements.Element.View(element=byFamilyType)
string = StringInput("Sheet Issue Date")  # graph input
getParameterValueByName = Element.GetParameterValueByName(element=view, parameterName=string)
string_2 = StringInput("Temporary")  # graph input
eq = getParameterValueByName == string_2
filterByBoolMask = List.FilterByBoolMask(list=byFamilyType, mask=eq)
string_3 = StringInput("Scale")  # graph input
number = DoubleInput(50)  # graph input
setParameterByName = Element.SetParameterByName(element=filterByBoolMask.in, parameterName=string_3, value=number)
