# Dynamo graph ABG_190925_Titleblocks-2.dyn "demo2" (Dynamo 2.0.3.8104)

family_types = FamilyTypes(index=42)
byFamilyType = FamilyInstance.ByFamilyType(familyType=family_types)
view = Orchid.Revit.Elements.Element.View(element=byFamilyType)
getViewportsAndViews = Rhythm.Revit.Elements.Sheet.GetViewportsAndViews(sheet=view)
code_block = CodeBlock { 0; }
getItemAtIndex = List.GetItemAtIndex(list=getViewportsAndViews.views@L2, index=code_block)
string = StringInput("Scope Box")
getParameterValueByName = Element.GetParameterValueByName(element=getItemAtIndex, parameterName=string)
string_2 = StringInput("None")
eq = getParameterValueByName == string_2
filterByBoolMask = List.FilterByBoolMask(list=byFamilyType, mask=eq)
string_3 = StringInput("Zone highlight")
filterByBoolMask_2 = List.FilterByBoolMask(list=getParameterValueByName, mask=eq)
name = Element.Name(element=filterByBoolMask_2.out)
code_block_2 = CodeBlock { " "; true; }
lastIndexOf = String.LastIndexOf(str=name, searchFor=code_block_2.out0, ignoreCase=code_block_2.out1)
code_block_3 = CodeBlock(x=lastIndexOf) { 0; x+1; }
remove = String.Remove(str=name, startIndex=code_block_3.out0, count=code_block_3.out1)
toNumber = String.ToNumber(str=remove)
setParameterByName = Element.SetParameterByName(element=filterByBoolMask.out, parameterName=string_3, value=toNumber)
