# Dynamo graph ABG_190927_Feasibility12.dyn "Finished script" (Dynamo 2.0.3.8104)

current = Document.Current()
activeView = Document.ActiveView(document=current)
analysis_face = DSFaceSelection()  # 1 picked in the model; graph input
detector_family = FamilyTypes(index=37)  # graph input
byFamilyType = FamilyInstance.ByFamilyType(familyType=detector_family)
filter_parameter_1 = StringInput("ABG_Data_Comment1")  # graph input
getParameterValueByName = Element.GetParameterValueByName(element=byFamilyType, parameterName=filter_parameter_1)
filter_value_1 = StringInput("Option 1B")  # graph input
eq = getParameterValueByName == filter_value_1
filterByBoolMask = List.FilterByBoolMask(list=byFamilyType, mask=eq)
filter_parameter_2 = StringInput("ABG_Data_Comment2")  # graph input
getParameterValueByName_2 = Element.GetParameterValueByName(element=filterByBoolMask.in, parameterName=filter_parameter_2)
filter_value_2 = StringInput("North Tower")  # graph input
eq_2 = getParameterValueByName_2 == filter_value_2
filterByBoolMask_2 = List.FilterByBoolMask(list=filterByBoolMask.in, mask=eq_2)
getLocation = Element.GetLocation(element=filterByBoolMask_2.in)
closestPointTo = Geometry.ClosestPointTo(geometry=analysis_face, other=getLocation, lacing=Longest)
UVParameterAtPoint = Surface.UVParameterAtPoint(surface=analysis_face, lacing=Longest)  # unwired: point
map = List.Map(list=closestPointTo, f_x=UVParameterAtPoint)
flatten = List.Flatten(list=map)
sun_hour_parameter = StringInput("ABG_Data_SunHours1")  # graph input
getParameterValueByName_3 = Element.GetParameterValueByName(element=filterByBoolMask_2.in, parameterName=sun_hour_parameter)
code_block = CodeBlock(x=filter_value_1, y=filter_value_2) { x+": "+y; }
code_block_2 = CodeBlock { null; }
byViewFacePointsAndValues = Revit.AnalysisDisplay.FaceAnalysisDisplay.ByViewFacePointsAndValues(view=activeView, surface=analysis_face, sampleLocations=flatten, samples=getParameterValueByName_3, name=code_block, description=code_block, unitType=code_block_2)
