# Dynamo graph ABG_190930_TagAll1.dyn "Finished script" (Dynamo 2.0.3.8104)

all_elements_in_active_view = ElementsInView()
getCategory = Element.GetCategory(element=all_elements_in_active_view)
string_from_object = FromObject(obj=getCategory)
string = StringInput("Rooms")
eq = string_from_object == string
filterByBoolMask = List.FilterByBoolMask(list=all_elements_in_active_view, mask=eq)
type = archilab.Revit.Elements.Elements.Type(element=filterByBoolMask.out)
taggable_parameter = StringInput("ABG_Data_Code1")  # graph input
getParameterValueByName = Element.GetParameterValueByName(element=type, parameterName=taggable_parameter)
code_block = CodeBlock { ""; }
ne = getParameterValueByName != code_block
filterByBoolMask_2 = List.FilterByBoolMask(list=filterByBoolMask.out, mask=ne)
categories = Categories(index=327)
current = Document.Current()
activeView = Document.ActiveView(document=current)
boolean = BoolSelector(true)
# note: Clockwork
all_view_dependent_family = Custom[All View-Dependent Family Instances Of Category](category=categories, view=activeView, toggle=boolean)  # Gets all view-dependent family instances in a given view for a given list of categories - useful for finding annotation elements
type_2 = archilab.Revit.Elements.Elements.Type(element=all_view_dependent_family)
flatten = List.Flatten(list=type_2)
string_from_object_2 = FromObject(obj=flatten)
tag_family = FamilyTypes(index=35)  # graph input
string_from_object_3 = FromObject(obj=tag_family)
eq_2 = string_from_object_2 == string_from_object_3
filterByBoolMask_3 = List.FilterByBoolMask(list=all_view_dependent_family, mask=eq_2)
taggedElement = Tag.TaggedElement(tag=filterByBoolMask_3.in)
flatten_2 = List.Flatten(list=taggedElement)
id = Element.Id(element=flatten_2)
id_2 = Element.Id(element=filterByBoolMask_2.in)
contains = List.Contains(list=id, item=id_2@L1)
filterByBoolMask_4 = List.FilterByBoolMask(list=filterByBoolMask_2.in, mask=contains)
getLocation = Element.GetLocation(element=filterByBoolMask_4.out)
string_from_object_4 = FromObject(obj=getLocation)
code_block_2 = CodeBlock { "point"; true; }
startsWith = String.StartsWith(str=string_from_object_4, searchFor=code_block_2.out0, ignoreCase=code_block_2.out1)
filterByBoolMask_5 = List.FilterByBoolMask(list=getLocation, mask=startsWith)
filterByBoolMask_6 = List.FilterByBoolMask(list=filterByBoolMask_4.out, mask=startsWith)
boolean_2 = BoolSelector(true)
# note: GeniusLoci
create_independent_tag = Custom[Create Independent Tag](TagLocations=filterByBoolMask_5.in, TagType=tag_family, Elements=filterByBoolMask_6.in, Views=activeView, RunIt=boolean_2)  # Works only in Revit 2018 and later. This node will create an annotation tag at a given location, of given type and in a supplied view. If only single view is supplied then all tags will be created in that view. The node works also with Linked Elements, Multi Category tag and Material Tag. From archilab
