# Dynamo graph ABG_191002_TagAll2.dyn "finished script" (Dynamo 2.0.3.8104)

all_elements_in_active_view = ElementsInView()
getCategory = Element.GetCategory(element=all_elements_in_active_view)
string_from_object = FromObject(obj=getCategory)
string = StringInput("Rooms")
ne = string_from_object != string
filterByBoolMask = List.FilterByBoolMask(list=all_elements_in_active_view, mask=ne)
type = archilab.Revit.Elements.Elements.Type(element=filterByBoolMask.in)
string_2 = StringInput("ABG_Data_Code1")
getParameterValueByName = Element.GetParameterValueByName(element=type, parameterName=string_2)
code_block = CodeBlock { ""; }
ne_2 = getParameterValueByName != code_block
filterByBoolMask_2 = List.FilterByBoolMask(list=filterByBoolMask.in, mask=ne_2)
getLocation = Element.GetLocation(element=filterByBoolMask_2.in)
string_from_object_2 = FromObject(obj=getLocation)
code_block_2 = CodeBlock { "point"; true; }
startsWith = String.StartsWith(str=string_from_object_2, searchFor=code_block_2.out0, ignoreCase=code_block_2.out1)
filterByBoolMask_3 = List.FilterByBoolMask(list=filterByBoolMask_2.in, mask=startsWith)
filterByBoolMask_4 = List.FilterByBoolMask(list=getLocation, mask=startsWith)
select_room = DSModelElementSelection()  # 1 picked in the model; graph input
finishBoundary = Room.FinishBoundary(room=select_room)
byJoinedCurves = PolyCurve.ByJoinedCurves(curves=finishBoundary)
tolerance_beyond_rooms = DoubleInput(125)  # graph input
offset = Curve.Offset(curve=byJoinedCurves, distance=tolerance_beyond_rooms)
ZAxis = Vector.ZAxis()
boundingBox = Element.BoundingBox(element=select_room)
maxPoint = BoundingBox.MaxPoint(boundingBox=boundingBox)
Z = Point.Z(point=maxPoint)
minPoint = BoundingBox.MinPoint(boundingBox=boundingBox)
Z_2 = Point.Z(point=minPoint)
code_block_3 = CodeBlock(max=Z, min=Z_2) { max-min; }
translate = Geometry.Translate(geometry=offset, direction=ZAxis, distance=code_block_3)
addItemToEnd = List.AddItemToEnd(item=translate@L1, list=offset)
byLoft = Solid.ByLoft(crossSections=addItemToEnd)
doesIntersect = Geometry.DoesIntersect(geometry=filterByBoolMask_4.in, other=byLoft, lacing=Longest)
filterByBoolMask_5 = List.FilterByBoolMask(list=filterByBoolMask_3.in, mask=doesIntersect)
categories = Categories(index=327)
current = Document.Current()
activeView = Document.ActiveView(document=current)
boolean = BoolSelector(true)
all_view_dependent_family = Custom[All View-Dependent Family Instances Of Category](category=categories, view=activeView, toggle=boolean)  # Gets all view-dependent family instances in a given view for a given list of categories - useful for finding annotation elements
type_2 = archilab.Revit.Elements.Elements.Type(element=all_view_dependent_family)
flatten = List.Flatten(list=type_2)
string_from_object_3 = FromObject(obj=flatten)
family_types = FamilyTypes(index=35)
string_from_object_4 = FromObject(obj=family_types)
eq = string_from_object_3 == string_from_object_4
filterByBoolMask_6 = List.FilterByBoolMask(list=all_view_dependent_family, mask=eq)
taggedElement = Tag.TaggedElement(tag=filterByBoolMask_6.in)
flatten_2 = List.Flatten(list=taggedElement)
id = Element.Id(element=flatten_2)
id_2 = Element.Id(element=filterByBoolMask_5.in)
contains = List.Contains(list=id, item=id_2@L1)
filterByBoolMask_7 = List.FilterByBoolMask(list=filterByBoolMask_5.in, mask=contains)
getLocation_2 = Element.GetLocation(element=filterByBoolMask_7.out)
boolean_2 = BoolSelector(true)
create_independent_tag = Custom[Create Independent Tag](TagLocations=getLocation_2, TagType=family_types, Elements=filterByBoolMask_7.out, Views=activeView, RunIt=boolean_2)  # Works only in Revit 2018 and later. This node will create an annotation tag at a given location, of given type and in a supplied view. If only single view is supplied then all tags will be created in that view. The node works also with Linked Elements, Multi Category tag and Material Tag. From archilab
