# Dynamo graph ABG_191004_TagAll3.dyn "finished script" (Dynamo 2.0.3.8104)

all_elements_in_active_view = ElementsInView()
getCategory = Element.GetCategory(element=all_elements_in_active_view)
string_from_object = FromObject(obj=getCategory)
string = StringInput("Rooms")
ne = string_from_object != string
filterByBoolMask = List.FilterByBoolMask(list=all_elements_in_active_view, mask=ne)
type = archilab.Revit.Elements.Elements.Type(element=filterByBoolMask.in)
parameter_to_tag = StringInput("ABG_Data_Code1")  # graph input
getParameterValueByName = Element.GetParameterValueByName(element=type, parameterName=parameter_to_tag)
code_block = CodeBlock { ""; }
ne_2 = getParameterValueByName != code_block
filterByBoolMask_2 = List.FilterByBoolMask(list=filterByBoolMask.in, mask=ne_2)
getLocation = Element.GetLocation(element=filterByBoolMask_2.in)
string_from_object_2 = FromObject(obj=getLocation)
code_block_2 = CodeBlock { "point"; true; }
startsWith = String.StartsWith(str=string_from_object_2, searchFor=code_block_2.out0, ignoreCase=code_block_2.out1)
filterByBoolMask_3 = List.FilterByBoolMask(list=filterByBoolMask_2.in, mask=startsWith)
filterByBoolMask_4 = List.FilterByBoolMask(list=getLocation, mask=startsWith)
room_for_tagging = DSModelElementSelection()  # 1 picked in the model; graph input
finishBoundary = Room.FinishBoundary(room=room_for_tagging)
byJoinedCurves = PolyCurve.ByJoinedCurves(curves=finishBoundary)
tolerance_past_walls = DoubleInput(150)  # graph input
offset = Curve.Offset(curve=byJoinedCurves, distance=tolerance_past_walls)
ZAxis = Vector.ZAxis()
boundingBox = Element.BoundingBox(element=room_for_tagging)
maxPoint = BoundingBox.MaxPoint(boundingBox=boundingBox)
Z = Point.Z(point=maxPoint)
minPoint = BoundingBox.MinPoint(boundingBox=boundingBox)
Z_2 = Point.Z(point=minPoint)
sub = Z - Z_2
translate = Geometry.Translate(geometry=offset, direction=ZAxis, distance=sub)
addItemToEnd = List.AddItemToEnd(item=translate@L1, list=offset)
byLoft = Solid.ByLoft(crossSections=addItemToEnd)
doesIntersect = Geometry.DoesIntersect(geometry=filterByBoolMask_4.in, other=byLoft, lacing=Longest)
filterByBoolMask_5 = List.FilterByBoolMask(list=filterByBoolMask_3.in, mask=doesIntersect)
categories = Categories(index=327)
current = Document.Current()
activeView = Document.ActiveView(document=current)
boolean = BoolSelector(true)
all_view_dependent_family = Custom[All View-Dependent Family Instances Of Category](category=categories, view=activeView, toggle=boolean)  # Gets all view-dependent family instances in a given view for a given list of categories - useful for finding annotation elements
type_2 = archilab.Revit.Elements.Elements.Type(element=all_view_dependent_family)
flatten = List.Flatten(list=type_2)
string_from_object_3 = FromObject(obj=flatten)
tag_type = FamilyTypes(index=35)  # graph input
string_from_object_4 = FromObject(obj=tag_type)
eq = string_from_object_3 == string_from_object_4
filterByBoolMask_6 = List.FilterByBoolMask(list=all_view_dependent_family, mask=eq)
taggedElement = Tag.TaggedElement(tag=filterByBoolMask_6.in)
flatten_2 = List.Flatten(list=taggedElement)
id = Element.Id(element=flatten_2)
id_2 = Element.Id(element=filterByBoolMask_5.in)
contains = List.Contains(list=id, item=id_2@L1)
filterByBoolMask_7 = List.FilterByBoolMask(list=filterByBoolMask_5.in, mask=contains)
getLocation_2 = Element.GetLocation(element=filterByBoolMask_7.out)
custom_selection_ui = BoolSelector(true)  # graph input
not_ = Not(x=custom_selection_ui)
create_independent_tag = Custom[Create Independent Tag](TagLocations=getLocation_2, TagType=tag_type, Elements=filterByBoolMask_7.out, Views=activeView, RunIt=not_)  # Works only in Revit 2018 and later. This node will create an annotation tag at a given location, of given type and in a supplied view. If only single view is supplied then all tags will be created in that view. The node works also with Linked Elements, Multi Category tag and Material Tag. From archilab
code_block_3 = CodeBlock { "Selectively tag"; "Run"; 1100; 600; }
code_block_4 = CodeBlock { "Select elements to tag..."; 800; }
type_3 = archilab.Revit.Elements.Elements.Type(element=filterByBoolMask_7.out)
groupByKey = List.GroupByKey(list=filterByBoolMask_7.out, keys=type_3)
name = FamilyType.Name(familyType=groupByKey.unique_keys)
ui_listview_data = Custom[UI.Listview Data](InputName=code_block_4.out0, Keys_var=name, Values_var=groupByKey.groups, Height_optionnal=code_block_4.out1)  # Create data for ListView input in UI.MultiInputForm ++ . Check out www.data-shapes.net for more infos.
list_create = List.Create(item0=ui_listview_data)
ui_multipleinputform = Custom[UI.MultipleInputForm ++](Description_optional=code_block_3.out0, ButtonText_optional=code_block_3.out1, Inputs=list_create, Toggle=custom_selection_ui, MaxHeight_optional=code_block_3.out2, Width_optional=code_block_3.out3)  # Create a form with multiple inputs. see www.data-shapes.net for tutorials and infos!
flatten_3 = List.Flatten(list=ui_multipleinputform.User_Inputs)
getLocation_3 = Element.GetLocation(element=flatten_3)
current_2 = Document.Current()
activeView_2 = Document.ActiveView(document=current_2)
create_independent_tag_2 = Custom[Create Independent Tag](TagLocations=getLocation_3, TagType=tag_type, Elements=flatten_3, Views=activeView_2, RunIt=custom_selection_ui)
