# Dynamo graph ABG_191017_Doctrans.dyn "wip script" (Dynamo 2.0.3.8104)

file_destination = Directory("C:\Users\GavinC\Desktop\demo\doctrans")  # graph input
string = StringInput("\")
file_name_no_extension = StringInput("Doctrans")  # graph input
code_block = CodeBlock(x=file_destination, y=string, z=file_name_no_extension) { x+y+z+".xlsx"; }
template_file = Filename(".\Template.xlsx")  # graph input
file_from_path = FileObject(path=template_file)
boolean = BoolSelector(true)
copyFile = FileSystem.CopyFile(file=file_from_path, destinationPath=code_block, overwrite=boolean)
code_block_2 = CodeBlock(passthrough=code_block, waitfor=copyFile) { [passthrough,waitfor][0]; }
code_block_3 = CodeBlock { true; false; }
code_block_4 = CodeBlock { "Sheet1"; "A1"; }
element_types = ElementTypes(index=264)
all_elements_of_type = ElementsOfType(element_type=element_types)
string_2 = StringInput("Revision Sequence")
getParameterValueByName = Element.GetParameterValueByName(element=all_elements_of_type, parameterName=string_2)
sortByKey = List.SortByKey(list=all_elements_of_type, keys=getParameterValueByName)
name = Element.Name(element=sortByKey.sorted_list)
code_block_5 = CodeBlock(revs=name)
# ---------- code_block_5.designscript (2 lines) ----------
["SHEET NUMBER", "SHEET NAME",
"CURRENT", revs];
# ----------------------------------------
flatten = List.Flatten(list=code_block_5)
string_3 = StringInput("Sheets")
byName = Category.ByName(name=string_3)
all_elements_of_category = ElementsOfCategory(Category=byName)
sheetNumber = Sheet.SheetNumber(sheet=all_elements_of_category)
sortByKey_2 = List.SortByKey(list=all_elements_of_category, keys=sheetNumber)
revisions = archilab.Revit.Views.Sheets.Revisions(sheet=sortByKey_2.sorted_list)
isEmpty = List.IsEmpty(list=revisions, lacing=Longest)
filterByBoolMask = List.FilterByBoolMask(list=sortByKey_2.sorted_list, mask=isEmpty)
sheetNumber_2 = Sheet.SheetNumber(sheet=filterByBoolMask.out)
sheetName = Sheet.SheetName(sheet=filterByBoolMask.out)
revisions_2 = archilab.Revit.Views.Sheets.Revisions(sheet=filterByBoolMask.out)
uniqueId = Element.UniqueId(element=revisions_2)
concat = String.Concat(string0=uniqueId)
uniqueId_2 = Element.UniqueId(element=sortByKey.sorted_list)
contains = String.Contains(str=concat, searchFor=uniqueId_2, lacing=Longest)
transpose = List.Transpose(lists=contains)
countTrue = List.CountTrue(list=transpose@L2)
list_create = List.Create(item0=sheetNumber_2, item1=sheetName, item2=countTrue)
code_block_6 = CodeBlock { "X"; ""; }
if_ = If(test=transpose, true=code_block_6.out0, false=code_block_6.out1)
transpose_2 = List.Transpose(lists=if_)
join = List.Join(list0=list_create, list1=transpose_2)
transpose_3 = List.Transpose(lists=join)
addItemToFront = List.AddItemToFront(item=flatten, list=transpose_3)
bb_data = Custom[BB Data](sheetName=code_block_4.out0, origin=code_block_4.out1, data=addItemToFront)  # This node is a building block for different modes of writing to Excel files. You can combines this node into a list to write to multiple sheets or use just one to write to a single sheet.
write_excel = Custom[Write Excel](filePath=code_block_2, runIt=code_block_3.out0, byColumn=code_block_3.out1, BBData=bb_data)  # This node will write data to Excel file and based on how your BBData nodes are structured it will either override the exsting file, create a new one and write a single worksheet or write multiple worksheets.
