# Dynamo graph ABG_191121_NavisClashes (updated).dyn "CLASH REVIT - updated" (Dynamo 2.3.1.11775)

# group: Get rotated CS
XY = Plane.XY()
toCoordinateSystem = Plane.ToCoordinateSystem(plane=XY)
origin = Point.Origin()
ZAxis = Vector.ZAxis()
projectRotation = Coordinates.ProjectRotation()
rotate = CoordinateSystem.Rotate(coordinateSystem=toCoordinateSystem, origin=origin, axis=ZAxis, degrees=projectRotation)

# group: Excel data
file_path = Filename(".\HID X HVAC.xlsx")  # graph input
file_from_path = FileObject(path=file_path)
sheet_name = StringInput("HID X  HVAC\"")  # graph input
code_block = CodeBlock { false; }
importExcel = Data.ImportExcel(file=file_from_path, sheetName=sheet_name, readAsStrings=code_block, showExcel=code_block)

# group: Reconstruct data
code_block_2 = CodeBlock { 8; }
dropItems = List.DropItems(list=importExcel, amount=code_block_2)
code_block_3 = CodeBlock { -1; }
dropItems_2 = List.DropItems(list=dropItems, amount=code_block_3)
transpose = List.Transpose(lists=dropItems_2)
code_block_4 = CodeBlock(x=importExcel) { x[7]; }
code_block_5 = CodeBlock(excelData=code_block_4)
# ---------- code_block_5.designscript (5 lines) ----------
DSCore.List.IndexOf(excelData, "Clash Name");
DSCore.List.IndexOf(excelData, "Status");
DSCore.List.IndexOf(excelData, "Clash Point");
ID1 = DSCore.List.IndexOf(excelData, "Item ID");
ID2 = ID1 + 1;
# ----------------------------------------
code_block_6 = CodeBlock(list=transpose, I1=code_block_5.out0, I2=code_block_5.out1, I3=code_block_5.out2, I4=code_block_5.ID1, I5=code_block_5.ID2) { names = list[I1]; status = list[I2]; point = list[I3]; id1 = list[I4]; id2 = list[I5]; }

# group: Get XYZ points (untranslated)
code_block_7 = CodeBlock { "x:"; ", y:"; ", z:"; }
split = String.Split(str=code_block_6.point, separator0=code_block_7.out0, separator1=code_block_7.out1, separator2=code_block_7.out2)
toNumber = String.ToNumber(str=split)
transpose_2 = List.Transpose(lists=toNumber)
code_block_8 = CodeBlock(list=transpose_2) { x = list[0]; y = list[1]; z = list[2]; }

# group: Get N/S and E/W of I/O
code_block_9 = CodeBlock { "Site - Internal Origin"; }
byName = Category.ByName(name=code_block_9)
all_elements_of_category = ElementsOfCategory(Category=byName)
lastItem = List.LastItem(list=all_elements_of_category)
code_block_10 = CodeBlock { ["E/W","N/S","Elev"]; }
getParameterValueByName = Element.GetParameterValueByName(element=lastItem, parameterName=code_block_10, lacing=Longest)
code_block_11 = CodeBlock(X=getParameterValueByName) { X[0]; X[1]; X[2]; }

# group: Translate points, make adaptives
code_block_12 = CodeBlock(x=code_block_8.x, ew=code_block_11.out0, y=code_block_8.y, ns=code_block_11.out1, z=code_block_8.z, el=code_block_11.out2) { x-ew; y-ns; z-el; }
byCartesianCoordinates = Point.ByCartesianCoordinates(cs=rotate, x=code_block_12.out0, y=code_block_12.out1, z=code_block_12.out2)
clash_sphere_type = FamilyTypes("ABG_GEN_ClashSphere_R20:Typical")  # graph input
byPoints = AdaptiveComponent.ByPoints(points=byCartesianCoordinates, familyType=clash_sphere_type)

# group: Get clash 1/2 IDs
code_block_13 = CodeBlock { ": "; }
split_2 = String.Split(str=code_block_6.id1, separator0=code_block_13)
lastItem_2 = List.LastItem(list=split_2@L2)
split_3 = String.Split(str=code_block_6.id1, separator0=code_block_13)
lastItem_3 = List.LastItem(list=split_3@L2)

# group: Set parameters
code_block_14 = CodeBlock()
# ---------- code_block_14.designscript (7 lines) ----------
["Clash name",
"Clash status",
"Clash ID 1",
"Clash ID 2",
"Clash X",
"Clash Y",
"Clash Z"];
# ----------------------------------------
list_create = List.Create(item0=code_block_6.names, item1=code_block_6.status, item2=lastItem_2, item3=lastItem_3, item4=code_block_8.x, item5=code_block_8.y, item6=code_block_8.z)
setParameterByName = Element.SetParameterByName(element=byPoints@L2, parameterName=code_block_14@L1, value=list_create@L2, lacing=Longest)
