# Dynamo graph ABG_191121_NavisClashes.dyn "Finished script" (Dynamo 2.0.3.8104)

# group: Dynamo WCS
XY = Plane.XY()
toCoordinateSystem = Plane.ToCoordinateSystem(plane=XY)
origin = Point.Origin()
ZAxis = Vector.ZAxis()

get_project_locations = Custom[Get Project Locations]()  # Works only in Revit 2018 and later. Retrieves the project positions with the survey point as the origin. (Coordinates of Internal origin, project base point and survey point)
code_block = CodeBlock(pbp=get_project_locations.Project_Base_Point) { pbp[3]; }

# group: Rotate and move coordinate system
rotate = CoordinateSystem.Rotate(coordinateSystem=toCoordinateSystem, origin=origin, axis=ZAxis, degrees=code_block)
origin_2 = Point.Origin()
code_block_2 = CodeBlock(int_or=get_project_locations.Active_Project_Location) { N_s_neg = int_or[1]*-1; E_w_neg = int_or[0]*-1; }
byCartesianCoordinates = Point.ByCartesianCoordinates(cs=rotate, x=code_block_2.E_w_neg, y=code_block_2.N_s_neg)
byTwoPoints = Vector.ByTwoPoints(start=origin_2, end=byCartesianCoordinates)
distanceTo = Geometry.DistanceTo(geometry=origin_2, other=byCartesianCoordinates)
translate = CoordinateSystem.Translate(coordinateSystem=rotate, direction=byTwoPoints, distance=distanceTo)

boolean = BoolSelector(true)
code_block_3 = CodeBlock { true; false; }
code_block_4 = CodeBlock { 8; }

# group: Process Excel
clash_report = Filename("report\beams vs mech.xlsx")  # graph input
file_from_path = FileObject(path=clash_report)

get_worksheet_names = Custom[Get Worksheet Names](filePath=clash_report, runIt=boolean)  # This node will query an Excel file and return a list of sheet names that it contains.
code_block_5 = CodeBlock(x=get_worksheet_names) { x[0]; }

# group (continued): Process Excel
importExcel = Data.ImportExcel(file=file_from_path, sheetName=code_block_5, readAsStrings=code_block_3.out0, showExcel=code_block_3.out1)
dropItems = List.DropItems(list=importExcel, amount=code_block_4)
code_block_6 = CodeBlock(x=importExcel) { x[7]; }
code_block_7 = CodeBlock(headers=code_block_6)
# ---------- code_block_7.designscript (5 lines) ----------
DSCore.List.IndexOf(headers, "Clash Name");
DSCore.List.IndexOf(headers, "Status");
DSCore.List.IndexOf(headers, "Clash Point");
ID1 = DSCore.List.IndexOf(headers, "Item ID");
ID2 = ID1+1;
# ----------------------------------------

code_block_8 = CodeBlock { -1; }
dropItems_2 = List.DropItems(list=dropItems, amount=code_block_8)

# group (continued): Process Excel
transpose = List.Transpose(lists=dropItems_2)
code_block_9 = CodeBlock(list=transpose, I1=code_block_7.out0, I2=code_block_7.out1, I3=code_block_7.out2, I4=code_block_7.ID1, I5=code_block_7.ID2) { names  = list[I1]; status = list[I2]; point  = list[I3]; id1    = list[I4]; id2    = list[I5]; }

# group: Clash points
code_block_10 = CodeBlock { "x:"; ", y:"; ", z:"; }
split = String.Split(str=code_block_9.point, separater0=code_block_10.out0, separater1=code_block_10.out1, separater2=code_block_10.out2)
toNumber = String.ToNumber(str=split)
convert_between_units = DynamoConvert(toNumber, MeasurementType="Length", FromConversion="Meters", ToConversion="Millimeters")
transpose_2 = List.Transpose(lists=convert_between_units)
code_block_11 = CodeBlock(list=transpose_2) { x = list[0]; y = list[1]; z = list[2]; }

byCartesianCoordinates_2 = Point.ByCartesianCoordinates(cs=translate, x=code_block_11.x, y=code_block_11.y, z=code_block_11.z, lacing=Longest)
clash_family = FamilyTypes(index=1)  # graph input
byPoints = AdaptiveComponent.ByPoints(points=byCartesianCoordinates_2, familyType=clash_family, lacing=Longest)

# group: Set values
string = StringInput("CRN_Clash_Name1")
setParameterByName = Element.SetParameterByName(element=byPoints, parameterName=string, value=code_block_9.names, lacing=Longest)
string_2 = StringInput("CRN_Clash_Status1")
setParameterByName_2 = Element.SetParameterByName(element=byPoints, parameterName=string_2, value=code_block_9.status, lacing=Longest)
string_3 = StringInput("CRN_Clash_ID2")
code_block_12 = CodeBlock { 0; 12; }
remove = String.Remove(str=code_block_9.id2, startIndex=code_block_12.out0, count=code_block_12.out1)
setParameterByName_3 = Element.SetParameterByName(element=byPoints, parameterName=string_3, value=remove, lacing=Longest)
string_4 = StringInput("CRN_Clash_ID1")
remove_2 = String.Remove(str=code_block_9.id1, startIndex=code_block_12.out0, count=code_block_12.out1)
setParameterByName_4 = Element.SetParameterByName(element=byPoints, parameterName=string_4, value=remove_2, lacing=Longest)

# group: Set XYZ
string_5 = StringInput("CRN_Clash_X")
setParameterByName_5 = Element.SetParameterByName(element=byPoints, parameterName=string_5, value=code_block_11.x, lacing=Longest)
string_6 = StringInput("CRN_Clash_Y")
setParameterByName_6 = Element.SetParameterByName(element=byPoints, parameterName=string_6, value=code_block_11.y, lacing=Longest)
string_7 = StringInput("CRN_Clash_Z")
setParameterByName_7 = Element.SetParameterByName(element=byPoints, parameterName=string_7, value=code_block_11.z, lacing=Longest)
