# Dynamo graph ABG_191219_DuctSupports.dyn "WIP_MEP_DuctRun-SupportDivision" (Dynamo 2.0.3.8104)

# group: Isolate Duct System elements
categories = Categories(index=177)
all_elements_of_category = ElementsOfCategory(Category=categories)
name = Element.Name(element=all_elements_of_category)
select_model_element = DSModelElementSelection()  # 1 picked in the model
string = StringInput("System Name")
getParameterValueByName = Element.GetParameterValueByName(element=select_model_element, parameterName=string)
indexOf = List.IndexOf(list=name, element=getParameterValueByName)
getItemAtIndex = List.GetItemAtIndex(list=all_elements_of_category, index=indexOf)
ductsystem_all_elements_in = Custom[DuctSystem all elements in network](DuctSystem=getItemAtIndex)  # Returns every element in the duct network, inlcuding ducts, fittings etc.

# group: Filter to ducts only
getCategory = Element.GetCategory(element=ductsystem_all_elements_in)
string_2 = StringInput("Ducts")

string_from_object = FromObject(obj=getCategory)

# group (continued): Filter to ducts only
eq = string_from_object == string_2
filterByBoolMask = List.FilterByBoolMask(list=ductsystem_all_elements_in, mask=eq)

getLocation = Element.GetLocation(element=filterByBoolMask.in)
length = Curve.Length(curve=getLocation)

# group: Duct length Domain
minimumItem = List.MinimumItem(list=length)
maximumItem = List.MaximumItem(list=length)
list_create = List.Create(item0=minimumItem, item1=maximumItem)
watch = Watch(list_create)

# group: Threshold for run length
duct_cull = DoubleSlider(700, range=0..2000 step 100)

gt = length > duct_cull
filterByBoolMask_2 = List.FilterByBoolMask(list=getLocation, mask=gt)

# group: Duct preview
duct_line_preview = BoolSelector(true)  # frozen
empty = List.Empty()
if_ = Custom[Logic.If](test=duct_line_preview, ifTrue=filterByBoolMask_2.in, ifFalse=empty)  # Retains the old status of the previous built-in IF node.
code_block = CodeBlock { 255; 0; }
byARGB = Color.ByARGB(a=code_block.out0, r=code_block.out1, g=code_block.out1, b=code_block.out0)
byGeometryColor = Modifiers.GeometryColor.ByGeometryColor(geometry=if_, color=byARGB)
empty_2 = List.Empty()
if_2 = Custom[Logic.If](test=duct_line_preview, ifTrue=filterByBoolMask_2.out, ifFalse=empty_2)
code_block_2 = CodeBlock { 255; 0; }
byARGB_2 = Color.ByARGB(a=code_block_2.out0, r=code_block_2.out0, g=code_block_2.out1, b=code_block_2.out1)
byGeometryColor_2 = Modifiers.GeometryColor.ByGeometryColor(geometry=if_2, color=byARGB_2)

# group: Toggle
duct_preview = BoolSelector(false)
empty_3 = List.Empty()
if_3 = Custom[Logic.If](test=duct_preview, ifTrue=filterByBoolMask.in, ifFalse=empty_3)  # frozen

# group: Duct preview
filterByBoolMask_3 = List.FilterByBoolMask(list=if_3, mask=gt)
geometry = Element.Geometry(element=filterByBoolMask_3.in)
code_block_3 = CodeBlock { 75; 255; 125; 0; }
byARGB_3 = Color.ByARGB(a=code_block_3.out0, r=code_block_3.out2, g=code_block_3.out1, b=code_block_3.out1)
byGeometryColor_3 = Modifiers.GeometryColor.ByGeometryColor(geometry=geometry, color=byARGB_3)
geometry_2 = Element.Geometry(element=filterByBoolMask_3.out)
code_block_4 = CodeBlock { 75; 255; 125; 0; }
byARGB_4 = Color.ByARGB(a=code_block_4.out0, r=code_block_4.out1, g=code_block_4.out1, b=code_block_4.out2)
byGeometryColor_4 = Modifiers.GeometryColor.ByGeometryColor(geometry=geometry_2, color=byARGB_4)

# group: Determine spacing of supports
length_2 = Curve.Length(curve=filterByBoolMask_2.in)
start_end_inset = DoubleSlider(100, range=0..250 step 50)
max_spacing = DoubleInput(1000)
code_block_5 = CodeBlock(x=length_2, ins=start_end_inset, max_spacing=max_spacing) { len = x-ins; count = len/max_spacing; req_c = DSCore.Math.Ceiling(count+1); spacing = len/req_c; }
watch_2 = Watch(code_block_5.req_c)
code_block_6 = CodeBlock(inset=start_end_inset, count=code_block_5.req_c, spacing=code_block_5.spacing) { inset..count*spacing..#count; }

# group: Create normals at points on duct
pointAtSegmentLength = Curve.PointAtSegmentLength(curve=filterByBoolMask_2.in, segmentLength=code_block_6)
parameterAtPoint = Curve.ParameterAtPoint(curve=filterByBoolMask_2.in, point=pointAtSegmentLength)
normalAtParameter = Curve.NormalAtParameter(curve=filterByBoolMask_2.in, param=parameterAtPoint)

support_width = DoubleSlider(1000, range=300..1500 step 100)

# group: Create lines
code_block_7 = CodeBlock(x=support_width) { x/2; x/-2; }
translate = Geometry.Translate(geometry=pointAtSegmentLength, direction=normalAtParameter, distance=code_block_7.out0)
translate_2 = Geometry.Translate(geometry=pointAtSegmentLength, direction=normalAtParameter, distance=code_block_7.out1)
byStartPointEndPoint = Line.ByStartPointEndPoint(startPoint=translate, endPoint=translate_2)

filterByBoolMask_4 = List.FilterByBoolMask(list=filterByBoolMask.in, mask=gt)

# group: Get Level of system
code_block_8 = CodeBlock(ducts=filterByBoolMask_4.in) { list = DSCore.List.Flatten(ducts); list[0]; "Bottom Elevation"; "Reference Level"; }
getParameterValueByName_2 = Element.GetParameterValueByName(element=code_block_8.out1, parameterName=code_block_8.out3)
getParameterValueByName_3 = Element.GetParameterValueByName(element=code_block_8.list, parameterName=code_block_8.out2)
round = Math.Round(number=getParameterValueByName_3)
elevation = Level.Elevation(level=getParameterValueByName_2)
round_2 = Math.Round(number=elevation)

# group: Support family type
flatten = List.Flatten(list=byStartPointEndPoint)
family_types = FamilyTypes()  # nothing selected
byCurve = Custom[FamilyInstance.ByCurve](curve=flatten, familyType=family_types, level=getParameterValueByName_2)  # Places a line-based family instance on a given level

# group: Replicate height fields per hanger
ofRepeatedItem = List.OfRepeatedItem()  # unwired: item, amount
count = List.Count(list=byStartPointEndPoint@L2)
combine = List.Combine(comb=ofRepeatedItem, list1=round, list2=count)
flatten_2 = List.Flatten(list=combine)

# group: Ray bounce
ZAxis = Vector.ZAxis()
current = Document.Current()
activeView = Document.ActiveView(document=current)
byRayBounce = Revit.LinkElement.ByRayBounce(origin=pointAtSegmentLength, direction=ZAxis, view3D=activeView)
code_block_9 = CodeBlock(clash=byRayBounce.Point, level=round_2)
# ---------- code_block_9.designscript (4 lines) ----------
points = DSCore.List.GetItemAtIndex(clash@L2<1>, 1);
zval   = points.Z;
zvalr  = DSCore.Math.Round(zval);
fixh   = zvalr - level;
# ----------------------------------------

# group: Set parameter values
string_3 = StringInput("Support height")
setParameterByName = Element.SetParameterByName(element=byCurve, parameterName=string_3, value=flatten_2)
string_4 = StringInput("Fixing height")
setParameterByName_2 = Element.SetParameterByName(element=byCurve, parameterName=string_4, value=code_block_9.fixh)
