# Dynamo graph ABG_191223_ExportFamilyParameters.dyn "Finished script" (Dynamo 2.0.3.8104)

code_block = CodeBlock { "Export family parameters"; "Export"; "Cancel"; 1000; 600; }
code_block_2 = CodeBlock { "Which parameters?"; }
families = FamiliesDD(index=0)
types = Family.Types(family=families)
code_block_3 = CodeBlock(x=types) { x[0]; }
parameters = Element.Parameters(element=code_block_3)
name = Parameter.Name(parameter=parameters)
string = StringInput("Category")
eq = name == string  # lacing=Longest
filterByBoolMask = List.FilterByBoolMask(list=name, mask=eq)
code_block_4 = CodeBlock(params=filterByBoolMask.out) { params; }
string_2 = StringInput("Type Name")
indexOf = List.IndexOf(list=code_block_4, element=string_2)
removeItemAtIndex = List.RemoveItemAtIndex(list=code_block_4, indices=indexOf)
parameters_2 = Element.Parameters(element=types)
filterByBoolMask_2 = List.FilterByBoolMask(mask=eq)  # unwired: list
map = List.Map(list=parameters_2, f_x=filterByBoolMask_2.out)
string_from_object = FromObject(obj=map)
code_block_5 = CodeBlock { ind = ":"; true; }
indexOf_2 = String.IndexOf(str=string_from_object, searchFor=code_block_5.ind, ignoreCase=code_block_5.out1)
code_block_6 = CodeBlock(ind=indexOf_2) { 0; ind+2; }
remove = String.Remove(str=string_from_object, startIndex=code_block_6.out0, count=code_block_6.out1)
code_block_7 = CodeBlock(str=remove) { Yes_check = str == "Yes"; No_check = str == "Yes"; Yes_check||No_check; }
getParameterValueByName = Element.GetParameterValueByName(parameterName=filterByBoolMask.out)  # unwired: element
map_2 = List.Map(list=types, f_x=getParameterValueByName)
if_ = If(test=code_block_7.out2, true=code_block_7.Yes_check, false=map_2)
type = Object.Type(obj=if_)
code_block_8 = CodeBlock(x=type) { x[0]; }
code_block_9 = CodeBlock { 0; }
code_block_10 = CodeBlock { "."; true; }
lastIndexOf = String.LastIndexOf(str=code_block_8, searchFor=code_block_10.out0, ignoreCase=code_block_10.out1)
code_block_11 = CodeBlock(x=lastIndexOf) { x+1; }
type_2 = String.Remove(str=code_block_8, startIndex=code_block_9, count=code_block_11)
string_3 = StringInput("Revit.Elements.Material")
eq_2 = type == string_3
name_2 = Material.Name(material=if_)
value = If(test=eq_2, true=name_2, false=if_)
addItemToFront = List.AddItemToFront(item=code_block_4, list=value)
addItemToFront_2 = List.AddItemToFront(item=type_2, list=addItemToFront)
transpose = List.Transpose(lists=addItemToFront_2)
removeItemAtIndex_2 = List.RemoveItemAtIndex(list=transpose, indices=indexOf)
code_block_12 = CodeBlock { 500; true; }
ui_listview_data = Custom[UI.Listview Data](InputName=code_block_2, Keys_var=removeItemAtIndex, Values_var=removeItemAtIndex_2, Height_optionnal=code_block_12.out0, SortItems_optionnal=code_block_12.out1)  # Create data for ListView input in UI.MultiInputForm ++ . Check out www.data-shapes.net for more infos.
code_block_13 = CodeBlock { "Excel file path"; "Choose a document"; }
ui_filepath_data = Custom[UI.FilePath Data](InputName=code_block_13.out0, ButtonText=code_block_13.out1)  # Create filepath input for UI.MultipleInputForm ++ . Check out www.data-shapes.net for more infos !
list_create = List.Create(item0=ui_listview_data, item1=ui_filepath_data)
boolean = BoolSelector(true)
ui_multipleinputform = Custom[UI.MultipleInputForm ++](Description_optional=code_block.out0, ButtonText_optional=code_block.out1, Inputs=list_create, Toggle=boolean, CancelButtonText_optional=code_block.out2, MaxHeight_optional=code_block.out3, Width_optional=code_block.out4)  # Create a form with multiple inputs. see www.data-shapes.net for tutorials and infos!
code_block_14 = CodeBlock(x=ui_multipleinputform.User_Inputs) { x[1]; "Sheet1"; 0; x[0]; true; }
getItemAtIndex = List.GetItemAtIndex(list=transpose, index=indexOf)
addItemToFront_3 = List.AddItemToFront(item=getItemAtIndex, list=code_block_14.out3)
transpose_2 = List.Transpose(lists=addItemToFront_3)
exportExcel = Data.ExportExcel(filePath=code_block_14.out0, sheetName=code_block_14.out1, startRow=code_block_14.out2, startCol=code_block_14.out2, data=transpose_2, overWrite=code_block_14.out4)
if_2 = Custom[Logic.If]()  # Retains the old status of the previous built-in IF node.; unwired: test, ifTrue, ifFalse
