# Dynamo graph ABG_191226_ImportFamilyParameters.dyn "Finished script" (Dynamo 2.0.3.8104)

family_to_update = FamiliesDD(index=4)  # graph input
# note: Type names
# note: EX types
types = Family.Types(family=family_to_update)
type_data = Filename("demo\import family types\Updated data.xlsx")  # graph input
file_from_path = FileObject(path=type_data)
code_block = CodeBlock { "Sheet1"; true; false; }
# note: Get data
importExcel = Data.ImportExcel(file=file_from_path, sheetName=code_block.out0, readAsStrings=code_block.out1, showExcel=code_block.out2)
code_block_2 = CodeBlock { 2; }
# note: Data
dropItems = List.DropItems(list=importExcel, amount=code_block_2)
code_block_3 = CodeBlock { 0; }
getItemAtIndex = List.GetItemAtIndex(list=dropItems@L2, index=code_block_3)
name = Element.Name(element=types)
# note: Type exists?
contains = List.Contains(list=getItemAtIndex@L2, item=name, lacing=Longest)
filterByBoolMask = List.FilterByBoolMask(list=types, mask=contains)
filterByBoolMask_2 = List.FilterByBoolMask(list=name, mask=contains)
indexOf = List.IndexOf(list=getItemAtIndex, element=filterByBoolMask_2.in)
# note: Organise types to match excel order
sortByKey = List.SortByKey(list=filterByBoolMask.in, keys=indexOf)
name_2 = Family.Name(family=family_to_update)
# note: Orchid
familyDocument = Orchid.Revit.Elements.Family.FamilyDocument(family=family_to_update)
values_new = List.RemoveItemAtIndex(list=dropItems, indices=indexOf)
code_block_4 = CodeBlock { 0; }
# note: Get new type names
getItemAtIndex_2 = List.GetItemAtIndex(list=values_new@L2, index=code_block_4)
create = Orchid.Revit.FamilyDocument.FamilyType.Create(familyDocument=familyDocument, name=getItemAtIndex_2, lacing=Longest)
code_block_5 = CodeBlock(passthrough=familyDocument, waitfor=create) { [passthrough,waitfor][0]; }
loadFamily = Orchid.Revit.FamilyDocument.Document.LoadFamily(familyDocument=code_block_5)
# note: Processed lists
code_block_6 = CodeBlock(passthrough=code_block_5, waitfor=loadFamily) { [passthrough,waitfor][0]; }
boolean = BoolSelector(false)
close = Orchid.Revit.Core.Document.Close(document=code_block_6, save=boolean)
code_block_7 = CodeBlock(passthrough=name_2, waitfor=close) { [passthrough,waitfor][0]; }
byName = Family.ByName(name=code_block_7)
byFamilyAndName = FamilyType.ByFamilyAndName(family=byName, name=getItemAtIndex_2, lacing=Longest)
addItemToFront = List.AddItemToFront(item=sortByKey.sorted_list, list=byFamilyAndName)
# note: Add EX to new Types
flatten = List.Flatten(list=addItemToFront)
# note: Break out two rows
# Isolate EX/New data
parameters = CodeBlock(x=importExcel) { data_type  = x[0]; param_name = x[1]; }
code_block_8 = CodeBlock { 1; }
dropItems_2 = List.DropItems(list=parameters.param_name, amount=code_block_8)
count = List.Count(list=dropItems_2)
cycle = List.Cycle(list=flatten, amount=count)
flatten_2 = List.Flatten(list=cycle)
# note: Family types cycled by param count
# Param count cycled by family
count_2 = List.Count(list=flatten)
cycle_2 = List.Cycle(list=dropItems_2@L1, amount=count_2)
flatten_3 = List.Flatten(list=cycle_2)
getItemAtIndex_3 = List.GetItemAtIndex()  # unwired: list, index
join = List.Join()  # unwired: list0, list1
values_existing = List.GetItemAtIndex(list=dropItems, index=indexOf)
dropItems_3 = List.DropItems(list=values_existing@L2, amount=code_block_8)
transpose = List.Transpose(lists=dropItems_3)
transpose_2 = List.Transpose(lists=values_new)
code_block_9 = CodeBlock { 1; }
param_values_new = List.DropItems(list=transpose_2, amount=code_block_9)
# note: Join EX on front of new values
combine = List.Combine(comb=join, list1=transpose, list2=param_values_new)
code_block_10 = CodeBlock(str=combine) { str; dbl_1 = DSCore.String.ToNumber(str); int_1 = DSCore.Math.Floor(dbl_1); str=="True"; }
byName_2 = Material.ByName(name=combine)
list_create = List.Create(item0=code_block_10.str, item1=byName_2, item2=code_block_10.dbl_1, item3=code_block_10.int_1, item4=code_block_10.out3)
# note: Drop type name and parameter
# Tranpose values to columns
dropItems_4 = List.DropItems(list=parameters.data_type, amount=code_block_8)
# note: List indices for conversion
code_block_11 = CodeBlock(x=dropItems_4)
# ---------- code_block_11.designscript (9 lines) ----------
x=="Material" ?
1:
x=="Double" ?
2:
x=="Int64" ?
3:
x=="Boolean" ?
4:
0;
# ----------------------------------------
getItemAtIndex_4 = List.GetItemAtIndex(list=list_create, index=code_block_11)
count_3 = List.Count(list=code_block_11)
# note: Index per value
code_block_12 = CodeBlock(x=count_3) { 0..x-1..1; }
# note: For each list, get indexed sub-list
combine_2 = List.Combine(comb=getItemAtIndex_3, list1=getItemAtIndex_4, list2=code_block_12)
# note: Flatten and prepare results
flatten_4 = List.Flatten(list=combine_2)
setParameterByName = Element.SetParameterByName(element=flatten_2, parameterName=flatten_3, value=flatten_4)
