# Dynamo graph ABG_200130_ShortestDistance.dyn "Shortest path by curves" (Dynamo 2.0.3.8104)

# group: Get lines
network = DSModelElementsSelection()  # 10 picked in the model
geometry = Element.Geometry(element=network)

# group: Network colour
code_block = CodeBlock { 125; }
byARGB = Color.ByARGB(a=code_block, r=code_block, g=code_block, b=code_block)
byGeometryColor = Modifiers.GeometryColor.ByGeometryColor(geometry=geometry, color=byARGB)

# group: Find all intersection points
flatten = List.Flatten(list=geometry)
list_create = List.Create(item0=flatten)
flatten_2 = List.Flatten(list=list_create)
# note: Custom Node: BimorphNodes v.2.5.1
intersectAll = Curve.IntersectAll(curves=list_create)
flatten_3 = List.Flatten(list=intersectAll)

# group: Network split by segment
doesIntersect = Geometry.DoesIntersect(other=flatten_3)  # unwired: geometry
map = List.Map(list=flatten_2, f_x=doesIntersect)
filterByBoolMask = List.FilterByBoolMask(list=flatten_3)  # unwired: mask
map_2 = List.Map(list=map, f_x=filterByBoolMask.in)
splitByPoints = Curve.SplitByPoints(curve=flatten_2, points=map_2)
flatten_4 = List.Flatten(list=splitByPoints)

# group: Topology mapped to dictionary by length
byGeometry = Topologic.Topology.ByGeometry(geometry=flatten_4)
code_block_2 = CodeBlock { "length"; }
length = Curve.Length(curve=flatten_4)
byKeysValues = DesignScript.Builtin.Dictionary.ByKeysValues(keys=code_block_2, values=length, lacing=Longest)
setDictionary = Topologic.Topology.SetDictionary(topology=byGeometry, dictionary=byKeysValues, lacing=Longest)
# note: Custom Node: Topologic
# 	 v. 1.0.0
byEdges = Topologic.Wire.ByEdges(edges=setDictionary)

# group: All start/end points
startPoint = Curve.StartPoint(curve=geometry)
endPoint = Curve.EndPoint(curve=geometry)
list_create_2 = List.Create(item0=startPoint, item1=endPoint)
flatten_5 = List.Flatten(list=list_create_2)

# group: Get start/end
n1 = DSModelElementSelection()  # "1"; 1 picked in the model
geometry_2 = Element.Geometry(element=n1)
centerPoint = Circle.CenterPoint(circle=geometry_2)
n2 = DSModelElementSelection()  # "2"; 1 picked in the model
geometry_3 = Element.Geometry(element=n2)
centerPoint_2 = Circle.CenterPoint(circle=geometry_3)

# group: Closest end point on network
distanceTo = Geometry.DistanceTo(geometry=centerPoint, other=flatten_5, lacing=Longest)
sortByKey = List.SortByKey(list=flatten_5, keys=distanceTo)
distanceTo_2 = Geometry.DistanceTo(geometry=centerPoint_2, other=flatten_5, lacing=Longest)
sortByKey_2 = List.SortByKey(list=flatten_5, keys=distanceTo_2)
code_block_3 = CodeBlock(start=sortByKey.sorted_list, end=sortByKey_2.sorted_list) { start[0]; end[0]; }

# group: Topologic graph
boolean = BoolSelector(true)
byTopology = Topologic.Graph.ByTopology(topology=byEdges, direct=boolean)
deconstructPoint = Geometry.Points.DeconstructPoint(point=code_block_3.out0)
verticesAtCoordinates = Topologic.Graph.VerticesAtCoordinates(graph=byTopology, x=deconstructPoint.X, y=deconstructPoint.Y, z=deconstructPoint.Z)
# note: Custom Node: LunchBox
#     v.2018.7.6
deconstructPoint_2 = Geometry.Points.DeconstructPoint(point=code_block_3.out1)
verticesAtCoordinates_2 = Topologic.Graph.VerticesAtCoordinates(graph=byTopology, x=deconstructPoint_2.X, y=deconstructPoint_2.Y, z=deconstructPoint_2.Z)

# group: Shortest path
shortestPath = Topologic.Graph.ShortestPath(graph=byTopology, startVertex=verticesAtCoordinates, endVertex=verticesAtCoordinates_2, edgeKey=code_block_2)
# note: Custom Node: Topologic
# 	 v. 1.0.0
geometry_4 = Topologic.Topology.Geometry(topology=shortestPath)

# group: Raise path
ZAxis = Vector.ZAxis()
code_block_4 = CodeBlock { 100; }
translate = Geometry.Translate(geometry=geometry_4, direction=ZAxis, distance=code_block_4)

# group: Red path
code_block_5 = CodeBlock { 255; 0; }
byARGB_2 = Color.ByARGB(a=code_block_5.out0, r=code_block_5.out0, g=code_block_5.out1, b=code_block_5.out1)
byGeometryColor_2 = Modifiers.GeometryColor.ByGeometryColor(geometry=translate, color=byARGB_2)

# group: Preview spheres
# note: Custom Node: LunchBox
#     v.2018.7.6
deconstructPolyCurve = Geometry.Curves.DeconstructPolyCurve(polycurve=translate)
lastItem = List.LastItem(list=deconstructPolyCurve.Segments@L2)
endPoint_2 = Curve.EndPoint(curve=lastItem)
list_create_3 = List.Create(item0=endPoint_2, item1=deconstructPolyCurve.Points)
flatten_6 = List.Flatten(list=list_create_3)
code_block_6 = CodeBlock { 2000; }
byCenterPointRadius = Sphere.ByCenterPointRadius(centerPoint=flatten_6, radius=code_block_6)

# group: Red nodes
code_block_7 = CodeBlock { 255; 0; }
byARGB_3 = Color.ByARGB(a=code_block_7.out0, r=code_block_7.out0, g=code_block_7.out1, b=code_block_7.out1)
byGeometryColor_3 = Modifiers.GeometryColor.ByGeometryColor(geometry=byCenterPointRadius, color=byARGB_3)
