# Dynamo graph ABG_200203_DoorToFrom-1.dyn "demo 1 - select doors" (Dynamo 2.0.3.8104)

all_elements_in_active_view = ElementsInView()
getCategory = Element.GetCategory(element=all_elements_in_active_view)
string_from_object = FromObject(obj=getCategory)
string = StringInput("Doors")
eq = string_from_object == string
filterByBoolMask = List.FilterByBoolMask(list=all_elements_in_active_view, mask=eq)
list_create = List.Create(item0=filterByBoolMask.in)
ꟿ_selectinrevit = Custom[ꟿ SelectInRevit](element=list_create)  # Selects the input elements inside the Revit UI.
