# Dynamo graph ABG_200203_DoorToFrom-2.dyn "demo 2 - parameters" (Dynamo 2.0.3.8104)

ꟿ_collect_currentselection = Custom[ꟿ Collect.CurrentSelection]()  # Gets the currently selected elements. Connect a boolean switch to refresh the selection.
string = StringInput("ABG_Doors_From")
rooms = Custom[Door.Rooms](door=ꟿ_collect_currentselection)  # Gets the rooms that are connected by a given door
number = Room.Number(room=rooms.fromRoom)
string_2 = StringInput("No Room")
replaceNull = Custom[List.ReplaceNull](seq=number, replacement=string_2)  # Replaces all null values within a given list with a substitute
setParameterByName = Element.SetParameterByName(element=ꟿ_collect_currentselection, parameterName=string, value=replaceNull)
parameters = Element.Parameters(element=ꟿ_collect_currentselection)
string_3 = StringInput("ABG_Doors_To")
number_2 = Room.Number(room=rooms.toRoom)
replaceNull_2 = Custom[List.ReplaceNull](seq=number_2, replacement=string_2)
setParameterByName_2 = Element.SetParameterByName(element=ꟿ_collect_currentselection, parameterName=string_3, value=replaceNull_2)
