# Dynamo graph ABG_200203_DoorToFrom-3.dyn "demo 3 - audit" (Dynamo 2.0.3.8104)

ꟿ_collect_currentselection = Custom[ꟿ Collect.CurrentSelection]()  # Gets the currently selected elements. Connect a boolean switch to refresh the selection.
rooms = Custom[Door.Rooms](door=ꟿ_collect_currentselection)  # Gets the rooms that are connected by a given door
code_block = CodeBlock { 2; }
lt = rooms.roomCount < code_block
filterByBoolMask = List.FilterByBoolMask(list=ꟿ_collect_currentselection, mask=lt)
code_block_2 = CodeBlock { 255; 255; 125; 0; }
byARGB = Color.ByARGB(a=code_block_2.out0, r=code_block_2.out1, g=code_block_2.out2, b=code_block_2.out3)
number = DoubleInput(6)
byProperties = Revit.Filter.OverrideGraphicSettings.ByProperties(cutFillColor=byARGB, projectionFillColor=byARGB, cutLineColor=byARGB, projectionLineColor=byARGB, cutLineWeight=number, projectionLineWeight=number)
overrideInView = Element.OverrideInView(element=filterByBoolMask.in, overrides=byProperties)
