# Dynamo graph ABG_200213_ScheduleWorksets.dyn "Demo script" (Dynamo 2.0.3.8104)

categories = Categories(index=159)
all_elements_of_category = ElementsOfCategory(Category=categories)
string = StringInput("Manual_Workset")
group = Custom[Element.Group](element=all_elements_of_category)  # Retrieves the group an element belongs to (if any)
isNull = Object.IsNull(obj=group)
workset = Custom[Element.Workset](element=all_elements_of_category)  # Retrieves the workset of a given element
name = Custom[Element.Name+](element=workset)  # Gets an element's name. Unlike the OOTB node, this node should work for all Revit elements that have names and will also return the localized names of system parameters, parameter groups, display unit types, parameter types, unit symbol types and unit types.
string_2 = StringInput("Grouped: ")
workset_2 = Custom[Element.Workset](element=group)
name_2 = Custom[Element.Name+](element=workset_2)
add = string_2 + name_2
if_ = If(test=isNull, true=name, false=add)
setParameterByName = Element.SetParameterByName(element=all_elements_of_category, parameterName=string, value=if_)
