# Dynamo graph ABG_200217_AlignCeiling.dyn "Finished script" (Dynamo 2.0.3.8104)

# group: Get Elements
categories = Categories(index=5)
all_elements_of_category = ElementsOfCategory(Category=categories)

# group: Filter by Type Comments
type = archilab.Revit.Elements.Elements.Type(element=all_elements_of_category)
string = StringInput("Type Comments")
getParameterValueByName = Element.GetParameterValueByName(element=type, parameterName=string)
code_block = CodeBlock { "ceiling"; true; }
contains = String.Contains(str=getParameterValueByName, searchFor=code_block.out0, ignoreCase=code_block.out1)
filterByBoolMask = List.FilterByBoolMask(list=all_elements_of_category, mask=contains)

# group: Linked Ceilings
select_link = DSModelElementSelection()  # 1 picked in the model
string_2 = StringInput("Ceilings")
byName = Category.ByName(name=string_2)
# note: Bimorph
ofCategory = Revit.LinkElement.OfCategory(linkInstance=select_link, Category=byName)

# group: Intersection
getLocation = Element.GetLocation(element=filterByBoolMask.in)
code_block_2 = CodeBlock { 1500; }

byCenterPointRadius = Sphere.ByCenterPointRadius(centerPoint=getLocation, radius=code_block_2)

# group (continued): Intersection
# note: Bimorph
intersectsSolid = Revit.Element.IntersectsSolid(solids=byCenterPointRadius, elements=ofCategory)

# group: Get Ceiling Heights for matches
string_3 = StringInput("Height Offset From Level")
getParameterValueByName_2 = Element.GetParameterValueByName(element=intersectsSolid.Element, parameterName=string_3)
isEmpty = List.IsEmpty(list=getParameterValueByName_2, lacing=Longest)
filterByBoolMask_2 = List.FilterByBoolMask(list=filterByBoolMask.in, mask=isEmpty)
filterByBoolMask_3 = List.FilterByBoolMask(list=getParameterValueByName_2, mask=isEmpty)
code_block_3 = CodeBlock { 0; }

string_4 = StringInput("Offset")
getItemAtIndex = List.GetItemAtIndex(list=filterByBoolMask_3.out@L2, index=code_block_3)

# group: Overrides for non-matched
code_block_4 = CodeBlock { 255; 255; 0; 0; }
byARGB = Color.ByARGB(a=code_block_4.out0, r=code_block_4.out1, g=code_block_4.out2, b=code_block_4.out3)
code_block_5 = CodeBlock { "<Solid fill>"; }
getByName = FillPatternElement.GetByName(name=code_block_5)
byProperties = Revit.Filter.OverrideGraphicSettings.ByProperties(projectionFillColor=byARGB, projectionFillPattern=getByName)

# group: Set overrides
setParameterByName = Element.SetParameterByName(element=filterByBoolMask_2.out, parameterName=string_4, value=getItemAtIndex)
overrideInView = Element.OverrideInView(element=filterByBoolMask_2.in, overrides=byProperties)
