# Dynamo graph ABG_200224_SheetSweeper.dyn "Finished script" (Dynamo 2.0.3.8104)

file_path = Filename(".\logo.png")

# group: UI
code_block = CodeBlock { "Select sheets to sweep"; "Clean-em!"; "Cancel"; 1200; 800; }
code_block_2 = CodeBlock { "Select sheets"; }
string = StringInput("Sheets")
byName = Category.ByName(name=string)
all_elements_of_category = ElementsOfCategory(Category=byName)
sheetNumber = Sheet.SheetNumber(sheet=all_elements_of_category)
sheetName = Sheet.SheetName(sheet=all_elements_of_category)
code_block_3 = CodeBlock(nu=sheetNumber, na=sheetName) { nu + ": " + na; }
code_block_4 = CodeBlock { true; false; }
ui_listview_data = Custom[UI.Listview Data](InputName=code_block_2, Keys_var=code_block_3, Values_var=all_elements_of_category, SortItems_optionnal=code_block_4.out0, ShowId_optionnal=code_block_4.out1)  # Create data for ListView input in UI.MultiInputForm ++ . Check out www.data-shapes.net for more infos.
list_create = List.Create(item0=ui_listview_data)
boolean = BoolSelector(true)
ui_multipleinputform = Custom[UI.MultipleInputForm ++](Description_optional=code_block.out0, Logo_optional=file_path, ButtonText_optional=code_block.out1, Inputs=list_create, Toggle=boolean, CancelButtonText_optional=code_block.out2, MaxHeight_optional=code_block.out3, Width_optional=code_block.out4)  # Create a form with multiple inputs. see www.data-shapes.net for tutorials and infos!

code_block_5 = CodeBlock(x=ui_multipleinputform.User_Inputs) { x[0]; }
getViewportsAndViews = Rhythm.Revit.Elements.Sheet.GetViewportsAndViews(sheet=code_block_5)
name = Element.Name(element=getViewportsAndViews.schedules)
code_block_6 = CodeBlock { "<Revision Schedule>"; false; }
contains = String.Contains(str=name, searchFor=code_block_6.out0, ignoreCase=code_block_6.out1)
filterByBoolMask = List.FilterByBoolMask(list=getViewportsAndViews.schedules, mask=contains)
join = List.Join(list0=getViewportsAndViews.viewports, list1=filterByBoolMask.out)
flatten = List.Flatten(list=join)
delete = archilab.Revit.Elements.Elements.Delete(element=flatten)
filterByBoolMask_2 = List.FilterByBoolMask(list=delete, mask=delete)
code_block_7 = CodeBlock(sheets=code_block_5, elements=filterByBoolMask_2.in, failed=filterByBoolMask_2.out)
# ---------- code_block_7.designscript (5 lines) ----------
"Sheets sweeped!";
count1 = DSCore.List.Count(sheets);
count2 = DSCore.List.Count(elements);
count3 = DSCore.List.Count(failed);
count2 + " elements swept off " + count1 + " sheets! (" + count3 + " failed)";
# ----------------------------------------
# note: rhythm
simpleUserMessage = Rhythm.Revit.Helpers.Helpers.SimpleUserMessage(caption=code_block_7.out0, message=code_block_7.out4)
