# Dynamo graph ABG_200309_BySpline-1.dyn "demo 1" (Dynamo 2.0.3.8104)

all_elements_in_active_view = ElementsInView()
getCategory = Element.GetCategory(element=all_elements_in_active_view)
string_from_object = FromObject(obj=getCategory)
code_block = CodeBlock { "Rooms"; false; }
contains = String.Contains(str=string_from_object, searchFor=code_block.out0, ignoreCase=code_block.out1)
filterByBoolMask = List.FilterByBoolMask(list=all_elements_in_active_view, mask=contains)
spline = DSModelElementSelection()  # 1 picked in the model; graph input
geometry = Element.Geometry(element=spline)
XY = Plane.XY()
pullOntoPlane = Curve.PullOntoPlane(curve=geometry, plane=XY)
finishBoundary = Room.FinishBoundary(room=filterByBoolMask.in)
byJoinedCurves = PolyCurve.ByJoinedCurves(curves=finishBoundary)
pullOntoPlane_2 = Curve.PullOntoPlane(curve=byJoinedCurves, plane=XY)
flatten = List.Flatten(list=pullOntoPlane_2)
intersect = Geometry.Intersect(geometry=pullOntoPlane, other=flatten, lacing=Longest)
isEmpty = List.IsEmpty(list=intersect, lacing=Longest)
filterByBoolMask_2 = List.FilterByBoolMask(list=filterByBoolMask.in, mask=isEmpty)
filterByBoolMask_3 = List.FilterByBoolMask(list=intersect, mask=isEmpty)
code_block_2 = CodeBlock { 0; }
getItemAtIndex = List.GetItemAtIndex(list=filterByBoolMask_3.out@L2, index=code_block_2)
parameterAtPoint = Curve.ParameterAtPoint(curve=pullOntoPlane, point=getItemAtIndex, lacing=Longest)
sortByKey = List.SortByKey(list=filterByBoolMask_2.out, keys=parameterAtPoint)
parameter_to_set = StringInput("Number")  # graph input
prefix = StringInput("R.")  # graph input
starting_number = DoubleSlider(1, range=0..100 step 1)  # graph input
count = List.Count(list=sortByKey.sorted_list)
code_block_3 = CodeBlock(n=starting_number, c=count) { n..n+(c-1)..1; }
string_from_object_2 = FromObject(obj=code_block_3)
code_block_4 = CodeBlock { "."; }
split = String.Split(str=string_from_object_2, separater0=code_block_4)
code_block_5 = CodeBlock { 0; }
getItemAtIndex_2 = List.GetItemAtIndex(list=split@L2, index=code_block_5)
add = prefix + getItemAtIndex_2
setParameterByName = Element.SetParameterByName(element=sortByKey.sorted_list, parameterName=parameter_to_set, value=add, lacing=Longest)
