# Dynamo graph ABG_200309_BySpline-2.dyn "demo 2" (Dynamo 2.0.3.8104)

select_model_elements = DSModelElementsSelection()  # 30 picked in the model
spline = DSModelElementSelection()  # 1 picked in the model; graph input
geometry = Element.Geometry(element=spline)
XY = Plane.XY()
pullOntoPlane = Curve.PullOntoPlane(curve=geometry, plane=XY)
getLocation = Element.GetLocation(element=select_model_elements)
code_block = CodeBlock(loc=getLocation) { Point.X(loc); Point.Y(loc); }
byCoordinates = Point.ByCoordinates(x=code_block.out0, y=code_block.out1)
closestPointTo = Geometry.ClosestPointTo(geometry=pullOntoPlane, other=byCoordinates, lacing=Longest)
parameterAtPoint = Curve.ParameterAtPoint(curve=pullOntoPlane, point=closestPointTo, lacing=Longest)
sortByKey = List.SortByKey(list=select_model_elements, keys=parameterAtPoint)
parameter_to_set = StringInput("Mark")  # graph input
prefix = StringInput("C-")  # graph input
starting_number = DoubleSlider(1, range=0..100 step 1)  # graph input
count = List.Count(list=sortByKey.sorted_list)
code_block_2 = CodeBlock(n=starting_number, c=count) { n..n+(c-1)..1; }
string_from_object = FromObject(obj=code_block_2)
code_block_3 = CodeBlock { "."; }
split = String.Split(str=string_from_object, separater0=code_block_3)
code_block_4 = CodeBlock { 0; }
getItemAtIndex = List.GetItemAtIndex(list=split@L2, index=code_block_4)
add = prefix + getItemAtIndex
setParameterByName = Element.SetParameterByName(element=sortByKey.sorted_list, parameterName=parameter_to_set, value=add, lacing=Longest)
