# Dynamo graph ABG_200312_SharedParams2020.dyn "Demo script" (Dynamo 2.3.0.5885)
# packages: Orchid 230.0.1.7333

# group: Import Excel
file_path = Filename("C:\Users\Gavin\Desktop\Test file.xlsx")
file_from_path = FileObject(path=file_path)
code_block = CodeBlock { "Standard"; false; }
importExcel = Data.ImportExcel(file=file_from_path, sheetName=code_block.out0, readAsStrings=code_block.out1, showExcel=code_block.out1)

# group: Write Shared Parameters to family
# note: Custom Node: Orchid
#    v. 230.0.1.7333
current = Orchid.RevitProject.Common.Document.Current()
code_block_2 = CodeBlock(data=importExcel)
# ---------- code_block_2.designscript (11 lines) ----------
//Process excel data//
dropped = DSCore.List.DropItems(data, 1);
data_t  = DSCore.List.Transpose(dropped);

//Values for SP node//
sp_nmes   = data_t[0];
sp_grps   = data_t[1];
p_types   = data_t[2];
p_BIpgs   = data_t[4];
p_inst    = data_t[5] == "Yes";
p_rept    = data_t[6] == "Yes";
# ----------------------------------------
addSharedParameter = Orchid.RevitFamily.Parameter.AddSharedParameter(familyDocument=current, parameterName=code_block_2.sp_nmes, groupName=code_block_2.sp_grps, type=code_block_2.p_types, group=code_block_2.p_BIpgs, instance=code_block_2.p_inst, reporting=code_block_2.p_rept, lacing=Longest)
