# Dynamo graph ABG_200312_SharedParamsBatch.dyn "Finished script" (Dynamo 2.3.0.5885)
# packages: Orchid 230.0.1.7333

# group: Family Directory
family_directory = Directory("C:\Users\Gavin\Desktop\Test")  # graph input
code_block = CodeBlock { "*.rfa"; false; }
# note: Custom Node: Orchid
#    v. 230.0.1.7333
contents = Orchid.Core.Directory.Contents(directory=family_directory, searchString=code_block.out0, deepSearch=code_block.out1)
backgroundOpen = Orchid.RevitProject.Common.Document.BackgroundOpen(file=contents)

# group: Import Excel
excel_file = Filename(".\Input.xlsx")  # graph input
file_from_path = FileObject(path=excel_file)
code_block_2 = CodeBlock { "Standard"; false; }
importExcel = Data.ImportExcel(file=file_from_path, sheetName=code_block_2.out0, readAsStrings=code_block_2.out1, showExcel=code_block_2.out1)

# group: Write Shared Parameters to family
code_block_3 = CodeBlock(data=importExcel)
# ---------- code_block_3.designscript (11 lines) ----------
//Process excel data//
dropped = DSCore.List.DropItems(data, 1);
data_t  = DSCore.List.Transpose(dropped);

//Values for SP node//
sp_nmes   = data_t[0];
sp_grps   = data_t[1];
p_types   = data_t[2];
p_BIpgs   = data_t[4];
p_inst    = data_t[5] == "Yes";
p_rept    = data_t[6] == "Yes";
# ----------------------------------------
# note: Custom Node: Orchid
#    v. 230.0.1.7333
addSharedParameter = Orchid.RevitFamily.Parameter.AddSharedParameter(familyDocument=backgroundOpen@L1, parameterName=code_block_3.sp_nmes@L2, groupName=code_block_3.sp_grps@L2, type=code_block_3.p_types@L2, group=code_block_3.p_BIpgs@L2, instance=code_block_3.p_inst@L2, reporting=code_block_3.p_rept@L2, lacing=Longest)

# group: Close and save
code_block_4 = CodeBlock(passthrough=backgroundOpen, waitfor=addSharedParameter) { [passthrough,waitfor][0]; }
boolean = BoolSelector(true)
# note: Custom Node: Orchid
#    v. 230.0.1.7333
close = Orchid.RevitProject.Common.Document.Close(document=code_block_4, save=boolean)
