# Dynamo graph ABG_200319_ElementsInRoom.dyn "Finished script" (Dynamo 2.3.0.5885)
# packages: bimorphNodes 3.0.3, Clockwork for Dynamo 2.x 2.3.0

string = StringInput("Furniture")  # graph input
byName = Category.ByName(name=string)
all_elements_of_category = ElementsOfCategory(Category=byName)
code_block = CodeBlock { "FF&E Room Name"; "FF&E Room Number"; }
link = DSModelElementSelection()  # 1 picked in the model; graph input
string_2 = StringInput("Rooms")
byName_2 = Category.ByName(name=string_2)
# note: Custom Node: BimorphNodes v.3.0.3
ofCategory = Revit.LinkElement.OfCategory(linkInstance=link, Category=byName_2)
boundingBox = Element.BoundingBox(element=all_elements_of_category)
properties = Custom[BoundingBox.Properties](boundingBox=boundingBox)  # package Clockwork for Dynamo 2.x; Retrieves the centroid, width, depth and height of a given bounding box
geometry = Element.Geometry(element=ofCategory)
flatten = List.Flatten(list=geometry)
doesIntersect = Geometry.DoesIntersect(other=flatten)  # unwired: geometry
map = List.Map(list=properties.Centroid, f_x=doesIntersect)
boolean = BoolSelector(true)
indexOf = List.IndexOf(list=map@L2, element=boolean)
getItemAtIndex = List.GetItemAtIndex(list=ofCategory, index=indexOf)
code_block_2 = CodeBlock { "Name"; "Number"; }
getParameterValueByName = Element.GetParameterValueByName(element=getItemAtIndex, parameterName=code_block_2.out0)
setParameterByName = Element.SetParameterByName(element=all_elements_of_category, parameterName=code_block.out0, value=getParameterValueByName, lacing=Longest)
getParameterValueByName_2 = Element.GetParameterValueByName(element=getItemAtIndex, parameterName=code_block_2.out1)
setParameterByName_2 = Element.SetParameterByName(element=all_elements_of_category, parameterName=code_block.out1, value=getParameterValueByName_2, lacing=Longest)
