# Dynamo custom node ABG_200326_CustomNodes-1.dyf "TestIf" (Dynamo 2.3.0.5885)
# category: Testing.Logic
# Test

Test = Input(Test: bool)
Then = Input(Then: var[]..[])
Else = Input(Else: var[]..[])
# note: python if
python_script = Python(IN[0]=Test, IN[1]=Then, IN[2]=Else)
# ---------- python_script.python (6 lines) ----------
#my name is blah

if IN[0] == True:
	OUT = IN[1]
else:
	OUT = IN[2]
# ----------------------------------------
result = Output(python_script)
