# Dynamo custom node ABG_200326_CustomNodes-2.dyf "TestingKickFlip" (Dynamo 2.3.0.5885)
# category: Testing.List.Organize
# This node will drop a certain number of items (usually excel based data, headers) and then transpose rows to columns (as lists).

data = Input(data: var[]..[])
Kick = Input(Kick: int = 1)
code_block = CodeBlock(data=data, drop=Kick) { datad = DSCore.List.DropItems(data, drop); datat = DSCore.List.Transpose(datad); }
Flip = Output(code_block.datat)  # "Flip!"
