# Dynamo graph ABG_200328_AreaBoundaries.dyn (Dynamo 2.3.0.5885)
# packages: archi-lab.net 2021.25.21, Crumple 2021.4.19

current = Document.Current()
activeView = Document.ActiveView(document=current)
categories = Categories("OST_Rooms")
levels = Levels("LEVEL 1A")
# note: Custom Node: archilab v.2021.25.21
byCategoryAndLevel = archilab.Revit.Selection.Select.ByCategoryAndLevel(category=categories, level=levels)
# note: Custom Node: Crumple v.2021.4.19
roomboundaries = Custom[© RoomBoundaries](rooms=byCategoryAndLevel)  # package Crumple; For a room or list of rooms, return all boundary (and internal) curves. The curves will be based on the currently nominated project room boundary settings.
flatten = List.Flatten(list=roomboundaries)
arealinesbycurves = Custom[© AreaLinesByCurves](view=activeView, curves=flatten)  # package Crumple; Given a list of Dynamo curves, the node generates area boundary lines along them in the given view. For convenience of iterability, this node flattens the curve list by default.
