# Dynamo graph ABG_200514_SPfile.dyn "Demo script" (Dynamo 2.3.0.5885)
# packages: Orchid 230.0.1.7333

# note: Custom Node: Orchid
current = Orchid.RevitProject.Common.Document.Current()
code_block = CodeBlock { "PG_TEXT"; false; }
createSharedParameter = Orchid.RevitFamily.Parameter.CreateSharedParameter(familyDocument=current, group=code_block.out0, instance=code_block.out1, reporting=code_block.out1)  # unwired: parameterName, groupName, type
file_path = Filename(".\paramlist.xlsx")
file_from_path = FileObject(path=file_path)
code_block_2 = CodeBlock { "Sheet1"; true; false; }
importExcel = Data.ImportExcel(file=file_from_path, sheetName=code_block_2.out0, readAsStrings=code_block_2.out1, showExcel=code_block_2.out2)
restOfItems = List.RestOfItems(list=importExcel)
transpose = List.Transpose(lists=restOfItems)
code_block_3 = CodeBlock(lst=transpose) { pnames = lst[0]; groups = lst[1]; ptypes = lst[2]; }
combine = List.Combine(comb=createSharedParameter, list1=code_block_3.pnames, list2=code_block_3.groups, list3=code_block_3.ptypes)
