# Dynamo graph ABG_200604_CircularNumbering.dyn "demo script" (Dynamo 2.3.0.5885)

clockwise = BoolSelector(true)  # graph input
select_families = DSModelElementsSelection()  # 80 picked in the model; graph input
boundingBox = Element.BoundingBox(element=select_families)
toCuboid = BoundingBox.ToCuboid(boundingBox=boundingBox)
byUnion = Solid.ByUnion(solids=toCuboid)
XY = Plane.XY()
intersect = Geometry.Intersect(geometry=byUnion, other=XY)
doesIntersect = Geometry.DoesIntersect(geometry=toCuboid, other=intersect@L2, lacing=Longest)
boolean = BoolSelector(true)
indexOf = List.IndexOf(list=doesIntersect@L2, element=boolean)
groupByKey = List.GroupByKey(list=select_families, keys=indexOf)
YAxis = Vector.YAxis()
ZAxis = Vector.ZAxis()
clockwise_rotation = IntegerSlider(90, range=0..360 step 90)  # graph input
code_block = CodeBlock(v=clockwise_rotation) { v * -1; }
rotate = Vector.Rotate(vector=YAxis, axis=ZAxis, degrees=code_block)
boundingBox_2 = Element.BoundingBox(element=groupByKey.groups)
toCuboid_2 = BoundingBox.ToCuboid(boundingBox=boundingBox_2)
byUnion_2 = Solid.ByUnion(solids=toCuboid_2)
byUnion_3 = Solid.ByUnion(solids=byUnion_2)
centroid = Solid.Centroid(solid=byUnion_3)
centroid_2 = Solid.Centroid(solid=byUnion_2)
byTwoPoints = Vector.ByTwoPoints(start=centroid, end=centroid_2)
ZAxis_2 = Vector.ZAxis()
angleAboutAxis = Vector.AngleAboutAxis(vector=rotate, otherVector=byTwoPoints, rotationAxis=ZAxis_2)
sortByKey = List.SortByKey(list=groupByKey.groups, keys=angleAboutAxis)
reverse = List.Reverse(list=sortByKey.sorted_list)
if_ = If(test=clockwise, true=reverse, false=sortByKey.sorted_list)
code_block_2 = CodeBlock { "Mark"; }
count = List.Count(list=sortByKey.sorted_list)
code_block_3 = CodeBlock(c=count) { 1..c..1; }
string_from_object = FromObject(obj=code_block_3)
setParameterByName = Element.SetParameterByName(element=if_@L2, parameterName=code_block_2, value=string_from_object@L1)
