# Dynamo graph ABG_200611_Topologic3.dyn "GavinResponse w remapping" (Dynamo 2.3.0.5885)
# packages: Topologic 1.0.0, Crumple 0.0.1

code_block = CodeBlock { "Rooms"; }
byName = Category.ByName(name=code_block)
current = Document.Current()
activeView = Document.ActiveView(document=current)
all_elements_of_category_in_view = ElementsOfCategoryInView(Category=byName, View=activeView)
centerBoundary = Room.CenterBoundary(room=all_elements_of_category_in_view)
# note: To wires
byGeometry = Topologic.Topology.ByGeometry(geometry=centerBoundary)
byEdges = Topologic.Wire.ByEdges(edges=byGeometry)
byWire = Topologic.Face.ByWire(wire=byEdges)
area = Topologic.Utilities.FaceUtility.Area(face=byWire)
code_block_2 = CodeBlock { 0; 1; }
remapRange = Math.RemapRange(numbers=area@L2, newMin=code_block_2.out0, newMax=code_block_2.out1)
threshold = CodeBlock(x=remapRange) { x<0.05; }
filterByBoolMask = List.FilterByBoolMask(list=byWire, mask=threshold)
flatten = List.Flatten(list=filterByBoolMask.out)
byFaces = Topologic.Shell.ByFaces(faces=flatten)
edges = Topologic.Topology.Edges(topology=byFaces)
faces = Topologic.Topology.Faces(topology=edges)
count = List.Count(list=faces, lacing=Longest)
code_block_3 = CodeBlock(c=count) { c==2; }
filterByBoolMask_2 = List.FilterByBoolMask(list=edges, mask=code_block_3)
geometry = Topologic.Topology.Geometry(topology=filterByBoolMask_2.in)
color_palette = ColorPalette({R: 0, G: 0, B: 255, A: 255})
byGeometryColor = Modifiers.GeometryColor.ByGeometryColor(geometry=geometry, color=color_palette)
geometry_2 = Topologic.Topology.Geometry(topology=filterByBoolMask_2.out)
color_palette_2 = ColorPalette({R: 220, G: 20, B: 60, A: 255})
byGeometryColor_2 = Modifiers.GeometryColor.ByGeometryColor(geometry=geometry_2, color=color_palette_2)
watch = Watch(centerBoundary)
current_2 = Document.Current()
activeView_2 = Document.ActiveView(document=current_2)
geometry_3 = Topologic.Topology.Geometry(topology=edges)
areaLinesFromCurves = Custom[AreaLinesFromCurves](view=activeView_2, curves=geometry_3)  # package Crumple; Given a list of Dynamo curves, the node generates area boundary lines along them in the given view. For convenience of iterability, this node flattens the curve list by default.
