# Dynamo graph ABG_200629_ReplaceParameters.dyn "Finished script" (Dynamo 2.3.0.5885)
# packages: Crumple 0.0.1

# group: Credit
# note: Replace shared parameters
# by Aussie BIM Guru
# 22/6/20

boolean = BoolSelector(true)

# group: Get parameters
# note: Custom Node: Crumple
documentParameters = Custom[DocumentParameters](Refresh=boolean)  # package Crumple; Obtains all parameters in the document, as well as their properties.

code_block = CodeBlock { "BG_"; false; }
startsWith = String.StartsWith(str=documentParameters.names, searchFor=code_block.out0, ignoreCase=code_block.out1)
filterByBoolMask = List.FilterByBoolMask(list=documentParameters.elements, mask=startsWith)
filterByBoolMask_2 = List.FilterByBoolMask(list=documentParameters.names, mask=startsWith)
code_block_2 = CodeBlock { "BG_"; "TEMP_"; }
replace = String.Replace(str=filterByBoolMask_2.in, searchFor=code_block_2.out0, replaceWith=code_block_2.out1)

# group: Shared to family
# note: Custom Node: Crumple
parameterReplaceShared = Custom[ParameterReplaceShared](parameters=filterByBoolMask.in, newNames=replace)  # package Crumple; Given some shared parameters in a family document, replaces them with new family parameters with the chosen names.

# group: Parameters file
# note: Custom Node: Crumple
sharedParameterDefinitions = Custom[SharedParameterDefinitions]()  # package Crumple; Returns the currently available shared parameters, their groups and the external definitions for both.

string = StringInput("ID_")
replace_2 = String.Replace(str=replace, searchFor=code_block_2.out1, replaceWith=string)
code_block_3 = CodeBlock(deflst=sharedParameterDefinitions.paramDefs, namlst=sharedParameterDefinitions.paramNames, newnames=replace_2)
# ---------- code_block_3.designscript (4 lines) ----------
defs    = DSCore.List.Flatten(deflst);
names   = DSCore.List.Flatten(namlst);
indices = DSCore.List.IndexOf(names, newnames);
defs[indices];
# ----------------------------------------

# group: Family to shared
# note: Custom Node: Crumple
parameterReplaceFamily = Custom[ParameterReplaceFamily](parameters=parameterReplaceShared.elements, exDefs=code_block_3.out3)  # package Crumple; Given some family parameters in a document, replace them with new shared parameters with the chosen external definitions.
