# Dynamo graph ABG_200914_GenerativeHouse.dyn "Housing" (Dynamo 2.6.1.8786)

# group: Inputs - Site
SITE_Lot_Width = DoubleSlider(10000, range=1000..15000 step 100)  # graph input
site_controls_side_a = DoubleSlider(1500, range=0..1500 step 100)  # graph input
site_controls_side_b = DoubleSlider(900, range=0..1500 step 100)  # graph input
SITE_Lot_Depth = DoubleSlider(30000, range=20000..30000 step 100)  # graph input
SITE_Controls_Front = DoubleSlider(4500, range=4500..6000 step 100)  # graph input
SITE_Controls_Rear = DoubleSlider(6000, range=6000..9000 step 100)  # graph input
SITE_Controls_Garage = DoubleSlider(1000, range=1000..2000 step 100)  # graph input

code_block = CodeBlock(lw=SITE_Lot_Width, sa=site_controls_side_a, sb=site_controls_side_b, ld=SITE_Lot_Depth, sf=SITE_Controls_Front, sr=SITE_Controls_Rear, gsb=SITE_Controls_Garage)
# ---------- code_block.designscript (14 lines) ----------
//House dimensions
hw = lw - sa - sb;
hd = ld - sf - sr;

//Pass setbacks through
sa;
sb;
sf;
sr;
gsb;

//Pass lot through
lw;
ld;
# ----------------------------------------
house_boundary = CodeBlock(sa=code_block.sa, sf=code_block.sf, hw=code_block.hw, hd=code_block.hd, gsb=code_block.gsb)
# ---------- house_boundary.designscript (18 lines) ----------
//Boundary
c1 = Geometry.Translate(Point.Origin(), sa, sf, 0);
c2 = Geometry.Translate(c1, hw, 0, 0);
c3 = Geometry.Translate(c2, 0, hd, 0);
c4 = Geometry.Translate(c1, 0, hd, 0);

//Frontages
fr = Line.ByStartPointEndPoint(c1,c2);
ga = Geometry.Translate(fr, 0, gsb, 0);
gsb;

//House with garage back
gc1 = Geometry.Translate(c1, 0, gsb, 0);
gc2 = Geometry.Translate(c2, 0, gsb, 0);

//House bounds
points = [gc1,gc2,c3,c4];
bound = PolyCurve.ByPoints(points, true);
# ----------------------------------------

# group: Inputs - Rooms 1
GARAGE_Width = DoubleSlider(3000, range=3000..3500 step 100)  # graph input
GARAGE_Depth = DoubleSlider(5500, range=2000..5500 step 100)  # graph input
CORRIDOR_Width = DoubleSlider(1000, range=900..1200 step 100)  # graph input
LIVING_Depth = DoubleSlider(6000, range=5000..7000 step 100)  # graph input
MASTER_Depth = DoubleSlider(4000, range=3000..5000 step 100)  # graph input
MASTER_Depth2 = DoubleSlider(2200, range=2200..4000 step 100)  # graph input
ALFRESCO_Width = DoubleSlider(3000, range=2500..3500 step 100)  # graph input
ALFRESCO_Depth = DoubleSlider(3000, range=2000..3500 step 100)  # graph input

garage_and_corridor = CodeBlock(hc2=house_boundary.c2, gw=GARAGE_Width, gsb=house_boundary.gsb, gd=GARAGE_Depth, cw=CORRIDOR_Width, hd=code_block.hd, lvd=LIVING_Depth)
# ---------- garage_and_corridor.designscript (19 lines) ----------
//Boundary (Garage)
c1 = Geometry.Translate(hc2, gw*-1, gsb, 0);
c2 = Geometry.Translate(hc2, 0, gsb, 0);
c3 = Geometry.Translate(c2, 0, gd, 0);
c4 = Geometry.Translate(c2, gw*-1, gd, 0);

//Form loop (Garage)
points = [c1,c2,c3,c4];
bound  = PolyCurve.ByPoints(points, true);

//Boundary (Corridor)
cc2 = Geometry.Translate(hc2, gw*-1, 0, 0);
cc1 = Geometry.Translate(cc2, cw*-1, 0, 0);
cc3 = Geometry.Translate(cc2, 0, hd-lvd, 0);
cc4 = Geometry.Translate(cc3, cw*-1, 0, 0);

//Form loop (Corridor)
cpoints = [cc1,cc2,cc3,cc4];
cbound  = PolyCurve.ByPoints(cpoints, true);
# ----------------------------------------
master_bed_and_ens_wir = CodeBlock(hc1=house_boundary.c1, cc1=garage_and_corridor.cc1, md=MASTER_Depth, ed=MASTER_Depth2)
# ---------- master_bed_and_ens_wir.designscript (25 lines) ----------
//Boundary (Master)
c1 = hc1;
c2 = cc1;
c3 = Geometry.Translate(c2, 0, md, 0);
c4 = Geometry.Translate(c1, 0, md, 0);

//Form loop (Master)
points = [c1,c2,c3,c4];
bound  = PolyCurve.ByPoints(points, true);

//Quarters width
width = Geometry.DistanceTo(c1,c2);
widthh = width/2;

//Boundary (Ens, WIR)
ec2 = Geometry.Translate(c4, widthh, 0, 0);
ec3 = Geometry.Translate(ec2, 0, ed, 0);
ec4 = Geometry.Translate(c4, 0, ed, 0);
wc3 = Geometry.Translate(c3, 0, ed, 0);

//Form loop (Ens, WIR)
pointse = [c4,ec2,ec3,ec4];
bounde  = PolyCurve.ByPoints(pointse, true);
pointsw = [ec2,c3,wc3,ec3];
boundw  = PolyCurve.ByPoints(pointsw, true);
# ----------------------------------------

# group: Input - Rooms 3
BATH_Depth = DoubleSlider(2400, range=1800..2400 step 100)  # graph input
LAUNDRY_Depth = DoubleSlider(2200, range=1500..2200 step 100)  # graph input
KITCHEN_Depth = DoubleSlider(3000, range=2500..3500 step 100)  # graph input

bath_laundry_kitchen = CodeBlock(ec4=master_bed_and_ens_wir.ec4, wc3=master_bed_and_ens_wir.wc3, bd=BATH_Depth, ld=LAUNDRY_Depth, kd=KITCHEN_Depth)
# ---------- bath_laundry_kitchen.designscript (25 lines) ----------
//Boundary (Bath)
c1 = ec4;
c2 = wc3;
c3 = Geometry.Translate(c2, 0, bd, 0);
c4 = Geometry.Translate(c1, 0, bd, 0);

//Form loop (Bath)
points = [c1,c2,c3,c4];
bound  = PolyCurve.ByPoints(points, true);

//Boundary (Laundry)
lc3 = Geometry.Translate(c3, 0, ld, 0);
lc4 = Geometry.Translate(c4, 0, ld, 0);

//Form loop (Laundry)
pointsl = [c4,c3,lc3,lc4];
boundl  = PolyCurve.ByPoints(pointsl, true);

//Boundary (Kitchen)
kc3 = Geometry.Translate(lc3, 0, kd, 0);
kc4 = Geometry.Translate(lc4, 0, kd, 0);

//Form loop (Kitchen)
pointsk = [lc4,lc3,kc3,kc4];
boundk  = PolyCurve.ByPoints(pointsk, true);
# ----------------------------------------

# group: Input - Rooms 2
MEDIA_Included = BoolSelector(true)  # graph input
MEDIA_Depth = DoubleSlider(3500, range=2500..4000 step 100)  # graph input
BED_Depth = DoubleSlider(3000, range=2400..3500 step 100)  # graph input
ALFRESCO_Included = BoolSelector(true)  # graph input

if_ = If(test=MEDIA_Included, true=MEDIA_Depth, false=BED_Depth)
bedrooms_and_media_optional = CodeBlock(gc4=garage_and_corridor.c4, gc3=garage_and_corridor.c3, md=if_, bd=BED_Depth)
# ---------- bedrooms_and_media_optional.designscript (21 lines) ----------
//Boundary (Block1)
c1 = gc4;
c2 = gc3;
c3 = Geometry.Translate(c2, 0, md, 0);
c4 = Geometry.Translate(c1, 0, md, 0);

//Form loop (Block1)
points = [c1,c2,c3,c4];
bound  = PolyCurve.ByPoints(points, true);

//Boundary (Block2,3)
b1c3 = Geometry.Translate(c3, 0, bd, 0);
b1c4 = Geometry.Translate(c4, 0, bd, 0);
b2c3 = Geometry.Translate(b1c3, 0, bd, 0);
b2c4 = Geometry.Translate(b1c4, 0, bd, 0);

//Form loop (Block2,3)
pointsb1 = [c4,c3,b1c3,b1c4];
boundb1  = PolyCurve.ByPoints(pointsb1, true);
pointsb2 = [b1c4,b1c3,b2c3,b2c4];
boundb2  = PolyCurve.ByPoints(pointsb2, true);
# ----------------------------------------
alfresco = CodeBlock(hc4=house_boundary.c4, aw=ALFRESCO_Width, ad=ALFRESCO_Depth)
# ---------- alfresco.designscript (9 lines) ----------
//Boundary (Alfresco)
c1 = hc4;
c2 = Geometry.Translate(c1, aw, 0, 0);
c3 = Geometry.Translate(c2, 0, -1*ad, 0);
c4 = Geometry.Translate(c1, 0, -1*ad, 0);

//Form loop (Alfresco)
points = [c1,c2,c3,c4];
bound  = PolyCurve.ByPoints(points, true);
# ----------------------------------------

# group: Optional Rooms
code_block_2 = CodeBlock { null; }
if_2 = If(test=ALFRESCO_Included, true=alfresco.bound, false=code_block_2)
if_3 = If(test=MEDIA_Included, true=bedrooms_and_media_optional.boundb2, false=code_block_2)

collect_bounds = CodeBlock(master=master_bed_and_ens_wir.bound, ens=master_bed_and_ens_wir.bounde, wir=master_bed_and_ens_wir.boundw, bath=bath_laundry_kitchen.bound, laundry=bath_laundry_kitchen.boundl, kitchen=bath_laundry_kitchen.boundk, block1=bedrooms_and_media_optional.bound, block2=bedrooms_and_media_optional.boundb1, garage=garage_and_corridor.bound, corridor=garage_and_corridor.cbound, alfresco=if_2, block3=if_3)
# ---------- collect_bounds.designscript (15 lines) ----------
//Required spaces
master;
ens;
wir;
bath;
laundry;
kitchen;
block1;
block2;
garage;
corridor;

//Optional spaces
alfresco;
block3;
# ----------------------------------------
list_create = List.Create(item0=collect_bounds.master, item1=collect_bounds.ens, item2=collect_bounds.wir, item3=collect_bounds.bath, item4=collect_bounds.laundry, item5=collect_bounds.kitchen, item6=collect_bounds.block1, item7=collect_bounds.block2, item8=collect_bounds.garage, item9=collect_bounds.corridor, item10=collect_bounds.alfresco, item11=collect_bounds.block3)
code_block_3 = CodeBlock { false; }
clean = List.Clean(list=list_create, preserveIndices=code_block_3)
code_block_4 = CodeBlock { 2400; }
extrudeAsSolid = Curve.ExtrudeAsSolid(curve=clean, distance=code_block_4)
code_block_5 = CodeBlock()
# ---------- code_block_5.designscript (14 lines) ----------
a = 255;

[Color.ByARGB(a,255,125,0),
Color.ByARGB(a,0,125,255),
Color.ByARGB(a,0,255,225),
Color.ByARGB(a,0,225,255),
Color.ByARGB(a,0,125,200),
Color.ByARGB(a,0,255,125),
Color.ByARGB(a,255,125,0),
Color.ByARGB(a,255,200,0),
Color.ByARGB(a,125,125,125),
Color.ByARGB(a,225,225,225),
Color.ByARGB(a,175,175,175),
Color.ByARGB(a,255,225,0)];
# ----------------------------------------
byGeometryColor = Modifiers.GeometryColor.ByGeometryColor(geometry=extrudeAsSolid, color=code_block_5.out1)
byPatch = Surface.ByPatch(closedCurve=house_boundary.bound)
byPatch_2 = Surface.ByPatch(closedCurve=clean)
difference = Surface.Difference(surface=byPatch, others=byPatch_2)
perimeterCurves = Surface.PerimeterCurves(surface=difference)
byJoinedCurves = PolyCurve.ByJoinedCurves(curves=perimeterCurves)
extrudeAsSolid_2 = Curve.ExtrudeAsSolid(curve=byJoinedCurves, distance=code_block_4)
code_block_6 = CodeBlock { Color.ByARGB(255,225,225,225); }
byGeometryColor_2 = Modifiers.GeometryColor.ByGeometryColor(geometry=extrudeAsSolid_2, color=code_block_6)
site_boundary = CodeBlock(lw=code_block.lw, ld=code_block.ld, fsb=SITE_Controls_Front, gsb=SITE_Controls_Garage, rsb=SITE_Controls_Rear)
# ---------- site_boundary.designscript (21 lines) ----------
//Boundary
c1 = Point.Origin();
c2 = Geometry.Translate(c1, lw, 0, 0);
c3 = Geometry.Translate(c2, 0, ld, 0);
c4 = Geometry.Translate(c1, 0, ld, 0);

//Form loop
points = [c1,c2,c3,c4];
bound  = PolyCurve.ByPoints(points, true);

//Frontage
fc3 = Geometry.Translate(c2, 0, fsb+gsb, 0);
fc4 = Geometry.Translate(c1, 0, fsb+gsb, 0);
rc1 = Geometry.Translate(c4, 0, rsb*-1, 0);
rc2 = Geometry.Translate(c3, 0, rsb*-1, 0);

//Form lawn loops
pointsf = [c1,c2,fc3,fc4];
boundf  = PolyCurve.ByPoints(pointsf, true);
pointsr = [rc1,rc2,c3,c4];
boundr  = PolyCurve.ByPoints(pointsr, true);
# ----------------------------------------
byPatch_3 = Surface.ByPatch(closedCurve=site_boundary.boundf)
difference_2 = Surface.Difference(surface=byPatch_3, others=byPatch_2)
byPatch_4 = Surface.ByPatch(closedCurve=site_boundary.boundr)
list_create_2 = List.Create(item0=difference_2, item1=byPatch_4, item2=site_boundary.bound)
code_block_7 = CodeBlock()
# ---------- code_block_7.designscript (5 lines) ----------
a = 255;

[Color.ByARGB(a,0,255,0),
Color.ByARGB(a,0,255,0),
Color.ByARGB(a,255,0,0)];
# ----------------------------------------
byGeometryColor_3 = Modifiers.GeometryColor.ByGeometryColor(geometry=list_create_2, color=code_block_7.out1)
byPatch_5 = Surface.ByPatch(closedCurve=collect_bounds.corridor)

# group: Output - Target Areas
area = Surface.Area(surface=difference)
convert_between_units = DynamoConvert(area, MeasurementType="Area", FromConversion="SquareMillimeter", ToConversion="SquareMeter")
GOAL_AreaLiving = Watch(convert_between_units)  # graph output
area_2 = Surface.Area(surface=byPatch_5)
convert_between_units_2 = DynamoConvert(area_2, MeasurementType="Area", FromConversion="SquareMillimeter", ToConversion="SquareMeter")
GOAL_AreaCorridor = Watch(convert_between_units_2)  # graph output
area_3 = Surface.Area(surface=difference_2)
convert_between_units_3 = DynamoConvert(area_3, MeasurementType="Area", FromConversion="SquareMillimeter", ToConversion="SquareMeter")
GOAL_LawnFront = Watch(convert_between_units_3)  # graph output
area_4 = Surface.Area(surface=byPatch_4)
convert_between_units_4 = DynamoConvert(area_4, MeasurementType="Area", FromConversion="SquareMillimeter", ToConversion="SquareMeter")
GOAL_LawnRear = Watch(convert_between_units_4)  # graph output
