# Dynamo graph ABG_200921_ExportDWGDynamo.dyn "Finished script" (Dynamo 2.3.0.5885)
# packages: Genius Loci 2020.2.24, Data-Shapes 2021.2.6

# group: Script Credit
# note: Script by the Aussie BIM Guru
# Free for use and education
# Keep the credit if you can please :)
# https://www.youtube.com/channel/UCry22yTdpgEDdzIZig7NSMQ

# group: Select Path
code_block = CodeBlock { "EXPORT TO"; "SET PATH HERE"; }
# note: Custom Node: Data-Shapes
directorypath_data = Custom[DirectoryPath Data](InputName=code_block.out0, ButtonText=code_block.out1)  # package Data-Shapes; Creates a DirectoryPath input for UI.MultipleInputForm ++ . Check out www.data-shapes.net for more infos!

code_block_2 = CodeBlock { "SELECT SHEETS"; 300; }

# group: Sheet Keys
code_block_3 = CodeBlock { "Sheets"; }
byName = Category.ByName(name=code_block_3)
all_elements_of_category = ElementsOfCategory(Category=byName)
sheetNumber = Sheet.SheetNumber(sheet=all_elements_of_category)
sheetName = Sheet.SheetName(sheet=all_elements_of_category)
code_block_4 = CodeBlock(snu=sheetNumber, sna=sheetName) { snu+": "+sna; }

# group: Listview
code_block_5 = CodeBlock { false; }
# note: Custom Node: Data-Shapes
listview_data = Custom[Listview Data](InputName=code_block_2.out0, Keys=code_block_4, Values=all_elements_of_category, Height_optionnal=code_block_2.out1, ShowId_optionnal=[code_block_5, code_block_5])  # package Data-Shapes; Create data for ListView input in UI.MultiInputForm ++ . Check out www.data-shapes.net for more infos.

# group: Make UI
code_block_6 = CodeBlock { "BULK EXPORT TO DWG"; "EXPORT"; }
list_create = List.Create(item0=directorypath_data, item1=listview_data)
code_block_7 = CodeBlock { true; "CANCEL"; 700; }
# note: Custom Node: Data-Shapes
multipleinputform = Custom[MultipleInputForm ++](Description_optional=code_block_6.out0, ButtonText_optional=code_block_6.out1, Inputs=list_create, Toggle=code_block_7.out0, CancelButtonText_optional=code_block_7.out1, MaxHeight_optional=code_block_7.out2, Width_optional=code_block_7.out2)  # package Data-Shapes; Create a form with multiple inputs. see www.data-shapes.net for tutorials and infos!

code_block_8 = CodeBlock(out=multipleinputform.User_Inputs) { path = out[0]; shts = out[1]; }
sheetNumber_2 = Sheet.SheetNumber(sheet=code_block_8.shts)

# group: Process revision
code_block_9 = CodeBlock { "Current Revision"; }
getParameterValueByName = Element.GetParameterValueByName(element=code_block_8.shts, parameterName=code_block_9)
code_block_10 = CodeBlock { "-"; ""; }
eq = code_block_10.out1 == _  # unwired: y
replaceByCondition = Replace(item=getParameterValueByName, replaceWith=code_block_10.out0, condition=eq)

# group: Project number
code_block_11 = CodeBlock { "Project Information"; }
byName_2 = Category.ByName(name=code_block_11)
all_elements_of_category_2 = ElementsOfCategory(Category=byName_2)
code_block_12 = CodeBlock { "Project Number"; }
getParameterValueByName_2 = Element.GetParameterValueByName(element=all_elements_of_category_2, parameterName=code_block_12)

code_block_13 = CodeBlock(sn=sheetNumber_2, r=replaceByCondition, prjn=getParameterValueByName_2) { sheetn = "-" + sn + " [" + r + "]"; fulln  = prjn<1L> + sheetn<1L>; }
code_block_14 = CodeBlock { true; }
# note: Custom Node: GeniusLoci
export_dwg_in_document = Custom[Export DWG in Document](DirectoryPath=code_block_8.path, view=code_block_8.shts, Filename=code_block_13.fulln, MergeViews=code_block_14, RunIt=code_block_14, lacing=Longest)  # package Genius Loci; Export views to DWG with export setup in the active or given document. Based on an archilab's script.
