# Dynamo graph ABG_201012_DynamoExcavation.dyn "Finished script" (Dynamo 2.3.0.5885)
# packages: Crumple 0.0.1, spring nodes 203.2.0

# group: Obtain all pads in model
code_block = CodeBlock { "Site - Pads"; }
byName = Category.ByName(name=code_block)
all_elements_of_category = ElementsOfCategory(Category=byName)

geometry = Element.Geometry(element=all_elements_of_category)
explode = Geometry.Explode(geometry=geometry)
flatten = List.Flatten(list=explode)

# group: Custom node
# note: Custom Node: Crumple
surfaceClampZ = Custom[SurfaceClampZ](surfaces=flatten)  # package Crumple; Given a lower and upper parameter between -1 and 1, return all surfaces with a normal Z value in that range.

code_block_2 = CodeBlock { 5000; false; }
thicken = Surface.Thicken(surface=surfaceClampZ, thickness=code_block_2.out0, both_sides=code_block_2.out1)
byUnion = Solid.ByUnion(solids=thicken)

# group: Input
# note: This should be a copy of the topo not influenced by any pads. Model one on existing demolished by new, then have a copy with pads all on the new phase.
toposurface_existing = DSModelElementSelection()  # 1 picked in the model

geometry_2 = Element.Geometry(element=toposurface_existing)
lastItem = List.LastItem(list=geometry_2)

# group: Custom node
# note: Custom Node: spring nodes v.203.2.0
ꟿ_mesh_topolysurface = Custom[ꟿ Mesh.ToPolySurface](mesh=lastItem)  # package spring nodes; Converts a Dynamo mesh to a polysurface. By default the node is single threaded, but if you specify a higher number of threads in the `NUMTHREAD` input, the node will run multi-threaded to speed up the conversion. *WARNING* Using multi-threaded code with Dynamo's geometry kernel may crash Revit in some cases.

split = Geometry.Split(geometry=byUnion, other=ꟿ_mesh_topolysurface)
flatten_2 = List.Flatten(list=split)

# group: You may need to pick one or the other depending on which side is split which way
integer_slider = IntegerSlider(1, range=0..1 step 1)

getItemAtIndex = List.GetItemAtIndex(list=flatten_2, index=integer_slider)
volume = Solid.Volume(solid=getItemAtIndex)
convert_between_units = DynamoConvert(volume, MeasurementType="Volume", FromConversion="CubicMillimeter", ToConversion="CubicMeters")

# group: Cut volume in m3
watch = Watch(convert_between_units)
