# Dynamo graph ABG_201012_DynamoFormwork.dyn "Finished script" (Dynamo 2.3.0.5885)
# packages: Clockwork for Dynamo 2.x 2.3.0

code_block = CodeBlock { "Floors"; }
byName = Category.ByName(name=code_block)
all_elements_of_category = ElementsOfCategory(Category=byName)
code_block_2 = CodeBlock { "Level"; }
getParameterValueByName = Element.GetParameterValueByName(element=all_elements_of_category, parameterName=code_block_2)
elevation = Level.Elevation(level=getParameterValueByName)
code_block_3 = CodeBlock(l=elevation) { l>0; }
filterByBoolMask = List.FilterByBoolMask(list=all_elements_of_category, mask=code_block_3)
solids = Element.Solids(element=filterByBoolMask.in)
code_block_4 = CodeBlock { "Walls"; }
byName_2 = Category.ByName(name=code_block_4)
all_elements_of_category_2 = ElementsOfCategory(Category=byName_2)
solids_2 = Element.Solids(element=all_elements_of_category_2)
code_block_5 = CodeBlock { "Structural Framing"; }
byName_3 = Category.ByName(name=code_block_5)
all_elements_of_category_3 = ElementsOfCategory(Category=byName_3)
code_block_6 = CodeBlock { "Structural Material"; }
getParameterValueByName_2 = Element.GetParameterValueByName(element=all_elements_of_category_3, parameterName=code_block_6)
name = Element.Name(element=getParameterValueByName_2)
code_block_7 = CodeBlock { "Concrete"; true; }
contains = String.Contains(str=name, searchFor=code_block_7.out0, ignoreCase=code_block_7.out1)
filterByBoolMask_2 = List.FilterByBoolMask(list=all_elements_of_category_3, mask=contains)
solids_3 = Element.Solids(element=filterByBoolMask_2.in)
code_block_8 = CodeBlock { "Structural Columns"; }
byName_4 = Category.ByName(name=code_block_8)
all_elements_of_category_4 = ElementsOfCategory(Category=byName_4)
code_block_9 = CodeBlock { "Structural Material"; }
getParameterValueByName_3 = Element.GetParameterValueByName(element=all_elements_of_category_4, parameterName=code_block_9)
name_2 = Element.Name(element=getParameterValueByName_3)
code_block_10 = CodeBlock { "Concrete"; true; }
contains_2 = String.Contains(str=name_2, searchFor=code_block_10.out0, ignoreCase=code_block_10.out1)
filterByBoolMask_3 = List.FilterByBoolMask(list=all_elements_of_category_4, mask=contains_2)
solids_4 = Element.Solids(element=filterByBoolMask_3.in)
list_create = List.Create(item0=solids, item1=solids_2, item2=solids_3, item3=solids_4)
flatten = List.Flatten(list=list_create)
byUnion = Solid.ByUnion(solids=flatten)
explode = Geometry.Explode(geometry=byUnion)
flatten_2 = List.Flatten(list=explode)
code_block_11 = CodeBlock { 0.5; }
pointAtParameter = Surface.PointAtParameter(surface=flatten_2, u=code_block_11, v=code_block_11)
normalAtPoint = Surface.NormalAtPoint(surface=flatten_2, point=pointAtParameter)
Z = Vector.Z(vector=normalAtPoint)
code_block_12 = CodeBlock { 2; }
round = Math.Round(number=Z, digits=code_block_12)
code_block_13 = CodeBlock(V=round) { V>0; }
Z_2 = Point.Z(point=pointAtParameter)
code_block_14 = CodeBlock(Z=Z_2) { Z<1; }
list_create_2 = List.Create(item0=code_block_13, item1=code_block_14)
transpose = List.Transpose(lists=list_create_2)
countFalse = List.CountFalse(list=transpose@L2)
code_block_15 = CodeBlock(F=countFalse) { F==2; }
filterByBoolMask_4 = List.FilterByBoolMask(list=flatten_2, mask=code_block_15)
red = Custom[Color.Red]()  # package Clockwork for Dynamo 2.x; Returns the colour red.
byGeometryColor = Modifiers.GeometryColor.ByGeometryColor(geometry=filterByBoolMask_4.in, color=red)
blue = Custom[Color.Blue]()  # package Clockwork for Dynamo 2.x; Returns the colour blue.
byGeometryColor_2 = Modifiers.GeometryColor.ByGeometryColor(geometry=filterByBoolMask_4.out, color=blue)
area = Surface.Area(surface=filterByBoolMask_4.in)
convert_between_units = DynamoConvert(area, MeasurementType="Area", FromConversion="SquareMillimeter", ToConversion="SquareMeter")
sum = Math.Sum(values=convert_between_units)
