# Dynamo graph ABG_201102_DynamoWallOpenings.dyn "Finished script" (Dynamo 2.3.0.5885)
# packages: archi-lab.net 2020.23.13, spring nodes 203.1.0, Rhythm 2020.2.13

# group: Model wall
live_wall = DSModelElementSelection()  # 1 picked in the model; graph input

# group: Opening family
opening_family = FamilyTypes("ABG_WIN_Opening-Rectangular2_R20:Opening")  # graph input

# group: NB: Architectural link is assumed as the first link
# note: Custom Node: archilab v.2020.23.13
getDocuments = archilab.Revit.Selection.Select.GetDocuments()
code_block = CodeBlock(l=getDocuments.Link_Doc) { l[1]; }
code_block_2 = CodeBlock { "Doors"; "Windows"; }
byName = Category.ByName(name=code_block_2.out0)
byName_2 = Category.ByName(name=code_block_2.out1)

# group: Collect all windows and doors
# note: Custom Node: archilab v.2020.23.13
get_all_elements_from_linked = Custom[Get All Elements From Linked Model](linkDoc=code_block, category=byName)  # package archi-lab.net; This node is based on code posted by Julien Benoit. Big thanks to Julien for sharing his work. This node will retrieve all elements of a given category from a given linked model.
get_all_elements_from_linked_2 = Custom[Get All Elements From Linked Model](linkDoc=code_block, category=byName_2)

# group: This will prompt the selection of a linked element (wall)
# note: Custom Node: spring nodes v.203.1.0
ꟿ_selectlinkedelement = Custom[ꟿ SelectLinkedElement]()  # package spring nodes; Select the linked instance first, followed by the element. If your selection fails, just press escape. To refresh the node, connect a boolean switch node.
id = Element.Id(element=ꟿ_selectlinkedelement.element)

# group: Compare Id's of window/door hosts to find those in the selected linked wall
# note: Custom Node: archilab v.2020.23.13
get_host_element = Custom[Get Host Element](hostedElement=get_all_elements_from_linked)  # package archi-lab.net; This node will retrieve a host element from hosted element. Ex. feed in door, get wall.
id_2 = Element.Id(element=get_host_element)
eq = id_2 == id  # lacing=Longest
get_host_element_2 = Custom[Get Host Element](hostedElement=get_all_elements_from_linked_2)
id_3 = Element.Id(element=get_host_element_2)
eq_2 = id_3 == id  # lacing=Longest

# group: Filter
filterByBoolMask = List.FilterByBoolMask(list=get_all_elements_from_linked, mask=eq)
filterByBoolMask_2 = List.FilterByBoolMask(list=get_all_elements_from_linked_2, mask=eq_2)
code_block_3 = CodeBlock { ["Width","Height"]; }

# group: Get location and width/height of types
getLocation = Element.GetLocation(element=filterByBoolMask.in)
getLocation_2 = Element.GetLocation(element=filterByBoolMask_2.in)
# note: Custom Node: Rhythm v.2020.2.13
ʳʰʸᵗʰᵐ_elements = Rhythm.Revit.Elements.Elements.GetParameterValueByNameTypeOrInstance(element=filterByBoolMask.in@L1, parameterName=code_block_3@L2, lacing=Longest)
ʳʰʸᵗʰᵐ_elements_2 = Rhythm.Revit.Elements.Elements.GetParameterValueByNameTypeOrInstance(element=filterByBoolMask_2.in@L1, parameterName=code_block_3@L2, lacing=Longest)

# group: Join points
list_create = List.Create(item0=getLocation, item1=getLocation_2)
flatten = List.Flatten(list=list_create)

# group: Make openings by door/window
# note: Custom Node: spring nodes v.203.1.0
ꟿ_familyinstance_byhostandpoint = Custom[ꟿ FamilyInstance.ByHostAndPoint](host=live_wall, type=opening_family, point=flatten)  # package spring nodes; Creates hosted family instances(doors/windows) at the specified points. You can feed either a single family type or a unique type for each instance.
code_block_4 = CodeBlock { "Width"; "Height"; }

# group: List management
list_create_2 = List.Create(item0=ʳʰʸᵗʰᵐ_elements, item1=ʳʰʸᵗʰᵐ_elements_2)
flatten_2 = List.Flatten(list=list_create_2@L2)
transpose = List.Transpose(lists=flatten_2)
code_block_5 = CodeBlock(data=transpose) { widths  = data[0]; heights = data[1]; }

# group: Set dimensions
setParameterByName = Element.SetParameterByName(element=ꟿ_familyinstance_byhostandpoint, parameterName=code_block_4.out0, value=code_block_5.widths)
setParameterByName_2 = Element.SetParameterByName(element=ꟿ_familyinstance_byhostandpoint, parameterName=code_block_4.out1, value=code_block_5.heights)
