# Dynamo graph ABG_201105_DynamoRoomDimensions.dyn "Finished script" (Dynamo 2.3.0.5885)

code_block = CodeBlock { "Comments"; }
code_block_2 = CodeBlock { w + " X " + h; }  # unwired: w, h
setParameterByName = Element.SetParameterByName(parameterName=code_block, value=code_block_2)  # unwired: element
code_block_3 = CodeBlock { "Rooms"; }
byName = Category.ByName(name=code_block_3)
all_elements_of_category = ElementsOfCategory(Category=byName)
code_block_4 = CodeBlock { "Area"; }
getParameterValueByName = Element.GetParameterValueByName(element=all_elements_of_category, parameterName=code_block_4)
code_block_5 = CodeBlock(a=getParameterValueByName) { a==""; }
filterByBoolMask = List.FilterByBoolMask(list=all_elements_of_category, mask=code_block_5)
code_block_6 = CodeBlock { "BG_DIM_Width1"; "BG_DIM_Depth1"; }
boundingBox = Element.BoundingBox(element=filterByBoolMask.out)
maxPoint = BoundingBox.MaxPoint(boundingBox=boundingBox)
minPoint = BoundingBox.MinPoint(boundingBox=boundingBox)
code_block_7 = CodeBlock(max=maxPoint, min=minPoint) { width = max.X - min.X; depth = max.Y - min.Y; }
round = Math.Round(number=code_block_7.width)
setParameterByName_2 = Element.SetParameterByName(element=filterByBoolMask.out, parameterName=code_block_6.out0, value=round, lacing=Longest)
round_2 = Math.Round(number=code_block_7.depth)
setParameterByName_3 = Element.SetParameterByName(element=filterByBoolMask.out, parameterName=code_block_6.out1, value=round_2, lacing=Longest)
