# Dynamo graph ABG_201109_DynamoSVGPart1.dyn "Starting point" (Dynamo 2.3.0.5885)
# packages: Data-Shapes 2021.2.6, Crumple 1.0.2, Illustrator 0.1.0

boolean = BoolSelector(false)
roomsByPlacement = Custom[RoomsByPlacement](Refresh=boolean)  # package Crumple; Collects all placed/unplaced rooms as two lists.
code_block = CodeBlock { "GENERATE SVG FILE"; "GENERATE"; true; "CANCEL"; 800; 400; }
code_block_2 = CodeBlock { "DIRECTORY"; "SET PATH..."; }
directorypath_data = Custom[DirectoryPath Data](InputName=code_block_2.out0, ButtonText=code_block_2.out1)  # package Data-Shapes; Creates a DirectoryPath input for UI.MultipleInputForm ++ . Check out www.data-shapes.net for more infos!
code_block_3 = CodeBlock { "SEGMENT LENGTH"; "500"; true; }
textbox_data = Custom[TextBox Data](InputName=code_block_3.out0, DefaultText=code_block_3.out1, IsNumberEntry=code_block_3.out2)  # package Data-Shapes; Create Data for TextBox input in UI.MultipleInputForm ++ . Check out www.data-shapes.net for more informations
code_block_4 = CodeBlock { "SHAPE FILE NAME"; "Raw data"; false; }
textbox_data_2 = Custom[TextBox Data](InputName=code_block_4.out0, DefaultText=code_block_4.out1, IsNumberEntry=code_block_4.out2)
code_block_5 = CodeBlock { "EXCEL FILE PATH"; "SET PATH..."; }
filepath_data = Custom[FilePath Data](InputName=code_block_5.out0, ButtonText=code_block_5.out1)  # package Data-Shapes; Create filepath input for UI.MultipleInputForm ++ . Check out www.data-shapes.net for more infos !
code_block_6 = CodeBlock { "SELECT LEVELS"; }
code_block_7 = CodeBlock { "Levels"; }
byName = Category.ByName(name=code_block_7)
all_elements_of_category = ElementsOfCategory(Category=byName)
name = Element.Name(element=all_elements_of_category)
code_block_8 = CodeBlock { 200; true; false; }
listview_data = Custom[Listview Data](InputName=code_block_6, Keys=name, Values=name, Height_optionnal=code_block_8.out0, HilightInView_optionnal=code_block_8.out2, DisplayModeOnly_optionnal=code_block_8.out2, ShowElementCount_optionnal=code_block_8.out2, SortItems_optionnal=code_block_8.out0, ShowId_optionnal=code_block_8.out2)  # package Data-Shapes; Create data for ListView input in UI.MultiInputForm ++ . Check out www.data-shapes.net for more infos.
list_create = List.Create(item0=directorypath_data, item1=textbox_data, item2=textbox_data_2, item3=filepath_data, item4=listview_data)
multipleinputform = Custom[MultipleInputForm ++](Description_optional=code_block.out0, ButtonText_optional=code_block.out1, Inputs=list_create, Toggle=code_block.out2, CancelButtonText_optional=code_block.out3, MaxHeight_optional=code_block.out4, Width_optional=code_block.out5)  # package Data-Shapes; Create a form with multiple inputs. see www.data-shapes.net for tutorials and infos!
code_block_9 = CodeBlock(data=multipleinputform.User_Inputs) { data[0]; data[1]; data[2]; data[3]; data[4]; }
code_block_10 = CodeBlock { "Level"; }
getParameterValueByName = Element.GetParameterValueByName(element=roomsByPlacement.placed, parameterName=code_block_10)
contains = List.Contains(list=code_block_9.out4@L2, item=getParameterValueByName, lacing=Longest)
filterByBoolMask = List.FilterByBoolMask(list=roomsByPlacement.placed, mask=contains)
finishBoundary = Room.FinishBoundary(room=filterByBoolMask.in)
byJoinedCurves = PolyCurve.ByJoinedCurves(curves=finishBoundary)
byPatch = Surface.ByPatch(closedCurve=byJoinedCurves)
area = Surface.Area(surface=byPatch)
sortByKey = List.SortByKey(list=finishBoundary@L3, keys=area@L2)
lastItem = List.LastItem(list=sortByKey.sorted_list@L3)
code_block_11 = CodeBlock(crvs=lastItem) { crvs; }
type = Object.Type(obj=code_block_11)
code_block_12 = CodeBlock(type=type) { type != "Autodesk.DesignScript.Geometry.Line"; }
length = Curve.Length(curve=code_block_11)
code_block_13 = CodeBlock(len=length, seg=code_block_9.out1) { len/seg; }
ceiling = Math.Ceiling(number=code_block_13)
code_block_14 = CodeBlock(obj=code_block_12, ce=ceiling) { obj?ce:2; }
code_block_15 = CodeBlock(s=code_block_14) { 0..1..#s; }
pointAtParameter = Curve.PointAtParameter(curve=code_block_11@L1, param=code_block_15@L2)
count = List.Count(list=code_block_11@L2)
chop = List.Chop(list=pointAtParameter, lengths=count)
flatten = List.Flatten(list=chop@L3)
pruneDuplicates = Point.PruneDuplicates(points=flatten)
code_block_16 = CodeBlock(Pt=pruneDuplicates) { Pt.X; Pt.Y; }
byCoordinates = Point.ByCoordinates(x=code_block_16.out0, y=code_block_16.out1)
byPoints = Polygon.ByPoints(points=byCoordinates)
XZ = Plane.XZ()
mirror = Geometry.Mirror(geometry=byPoints, mirrorPlane=XZ)
export = Illustrator.SVG.Export(geometry=mirror, exportLocation=code_block_9.out0, fileName=code_block_9.out2)
