# Dynamo graph ABG_201112_DynamoSVGPart2.dyn "Generate SVG file" (Dynamo 2.3.0.5885)
# packages: Illustrator 0.1.0, Data-Shapes 2021.2.6, Crumple 1.0.2

# group: Basic UI buttons
code_block = CodeBlock { "DIRECTORY"; "SET PATH..."; }
# note: Custom Node: Data-Shapes v.2021.2.6
directorypath_data = Custom[DirectoryPath Data](InputName=code_block.out0, ButtonText=code_block.out1)  # package Data-Shapes; Creates a DirectoryPath input for UI.MultipleInputForm ++ . Check out www.data-shapes.net for more infos!
code_block_2 = CodeBlock { "SEGEMENT LENGTH"; "500"; true; }
textbox_data = Custom[TextBox Data](InputName=code_block_2.out0, DefaultText=code_block_2.out1, IsNumberEntry=code_block_2.out2)  # package Data-Shapes; Create Data for TextBox input in UI.MultipleInputForm ++ . Check out www.data-shapes.net for more informations
code_block_3 = CodeBlock { "FILE NAME"; "Raw Data"; false; }
textbox_data_2 = Custom[TextBox Data](InputName=code_block_3.out0, DefaultText=code_block_3.out1, IsNumberEntry=code_block_3.out2)
code_block_4 = CodeBlock { "EXCEL DATA"; "SET PATH..."; }
filepath_data = Custom[FilePath Data](InputName=code_block_4.out0, ButtonText=code_block_4.out1)  # package Data-Shapes; Create filepath input for UI.MultipleInputForm ++ . Check out www.data-shapes.net for more infos !

# group: Collect all levels to list view
string = StringInput("Levels")
byName = Category.ByName(name=string)
all_elements_of_category = ElementsOfCategory(Category=byName)
name = Element.Name(element=all_elements_of_category)
code_block_5 = CodeBlock { 200; true; false; }
# note: Custom Node: Data-Shapes v.2021.2.6
listview_data = Custom[Listview Data](Keys=name, Values=name, Height_optionnal=code_block_5.out0, HilightInView_optionnal=code_block_5.out2, DisplayModeOnly_optionnal=code_block_5.out2, ShowElementCount_optionnal=code_block_5.out2, SortItems_optionnal=code_block_5.out1, ShowId_optionnal=code_block_5.out2)  # package Data-Shapes; Create data for ListView input in UI.MultiInputForm ++ . Check out www.data-shapes.net for more infos.

# group: User interface #1
code_block_6 = CodeBlock { "GENERATE SVG FILE"; "GENERATE"; true; "CANCEL"; 700; 350; }
list_create = List.Create(item0=directorypath_data, item1=textbox_data, item2=textbox_data_2, item3=filepath_data, item4=listview_data)
# note: Custom Node: Data-Shapes v.2021.2.6
multipleinputform = Custom[MultipleInputForm ++](Description_optional=code_block_6.out0, ButtonText_optional=code_block_6.out1, Inputs=list_create, Toggle=code_block_6.out2, CancelButtonText_optional=code_block_6.out3, MaxHeight_optional=code_block_6.out4, Width_optional=code_block_6.out5)  # package Data-Shapes; Create a form with multiple inputs. see www.data-shapes.net for tutorials and infos!
code_block_7 = CodeBlock(data=multipleinputform.User_Inputs) { data[0]; data[1]; data[2]; data[3]; data[4]; }

# group: Rooms at nominated levels only
# note: Custom Node: Crumple v.1.0.2
roomsByPlacement = Custom[RoomsByPlacement]()  # package Crumple; Collects all placed/unplaced rooms as two lists.
code_block_8 = CodeBlock { "Level"; }
getParameterValueByName = Element.GetParameterValueByName(element=roomsByPlacement.placed, parameterName=code_block_8)
contains = List.Contains(list=code_block_7.out4@L2, item=getParameterValueByName, lacing=Longest)
filterByBoolMask = List.FilterByBoolMask(list=roomsByPlacement.placed, mask=contains)

# group: Largest boundary curve only
finishBoundary = Room.FinishBoundary(room=filterByBoolMask.in)
byJoinedCurves = PolyCurve.ByJoinedCurves(curves=finishBoundary)
byPatch = Surface.ByPatch(closedCurve=byJoinedCurves)
area = Surface.Area(surface=byPatch)
sortByKey = List.SortByKey(list=finishBoundary@L3, keys=area@L2)
lastItem = List.LastItem(list=sortByKey.sorted_list@L3)

# group: Segmentation algorithm
# note: credit to Pierpaolo Canini for his awesome segmentation algorithm!
# https://github.com/pierpaolo-canini/DynamyMcDynamoface
code_block_9 = CodeBlock(crvs=lastItem) { crvs; }
type = Object.Type(obj=code_block_9)
code_block_10 = CodeBlock(a=type) { a!="Autodesk.DesignScript.Geometry.Line"; }
length = Curve.Length(curve=code_block_9)
code_block_11 = CodeBlock(a=length, segtr=code_block_7.out1) { a/segtr; }
ceiling = Math.Ceiling(number=code_block_11)
# note: If segment count equals to 2 when rounded up, then it must be a line and can be divided by a domain of 2 (0/1). The remainder are divided between these by more than 2 values.
code_block_12 = CodeBlock(a=code_block_10, ce=ceiling) { a?ce:2; }
code_block_13 = CodeBlock(x=code_block_12) { 0..1..#x; }
# note: For each curve, divide it at end/start point and interim where not a line.
pointAtParameter = Curve.PointAtParameter(curve=code_block_9@L1, param=code_block_13@L2)
count = List.Count(list=code_block_9@L2)
chop = List.Chop(list=pointAtParameter, lengths=count)
flatten = List.Flatten(list=chop@L3)
# note: Remove overlapping start/end points in the overall loop.
pruneDuplicates = Point.PruneDuplicates(points=flatten)
code_block_14 = CodeBlock(Pt=pruneDuplicates) { Pt.X; Pt.Y; }
byCoordinates = Point.ByCoordinates(x=code_block_14.out0, y=code_block_14.out1)
XZ = Plane.XZ()
mirror = Geometry.Mirror(geometry=byCoordinates, mirrorPlane=XZ)

# group: Write SVG file
byPoints = Polygon.ByPoints(points=mirror)
# note: Custom Node: Illustrator v.0.1.0
export = Illustrator.SVG.Export(geometry=byPoints, exportLocation=code_block_7.out0, fileName=code_block_7.out2)

# group: Read generated SVG contents
# note: Custom Node: Crumple v.1.0.2
waitFor = Custom[WaitFor](data=code_block_7.out0, waitFor=export)  # package Crumple; Tells the first input to wait for the second input to arrive, then passes on the first input. Really useful for scripts which have branching paths that rely on their outputs to carry each other forward. Quite a few custom packages have a 'passthrough' or 'waitfor' node. I use these all the time, so find it useful to have them contained in this package also.
code_block_15 = CodeBlock(d=waitFor, n=code_block_7.out2) { d+"\\"+n+".svg"; }
readText = FileSystem.ReadText(file=code_block_15)

# group: Build polygon headers
string_2 = StringInput("<polygon id=\"")
id = Element.Id(element=filterByBoolMask.in)
string_3 = StringInput("\" points")
code_block_16 = CodeBlock(x=string_2, id=id, y=string_3) { x + id + y; }

# group: Replace
# note: old_str = IN[0]
# replace = IN[1]
# for rep in replace:
# 	old_str = old_str.replace("<polygon points", rep, count=1)
# OUT = old_str
python_script = Python(IN[0]=readText, IN[1]=code_block_16)
# ---------- python_script.python (7 lines) ----------
old_str = IN[0]
replace = IN[1]

for rep in replace:
	old_str = old_str.replace("<polygon points", rep, count=1)

OUT = old_str
# ----------------------------------------

# group: Review and clean up apostrophes
watch = Watch(python_script)
string_4 = StringInput("'")
string_5 = StringInput("\"")
replace = String.Replace(str=watch, searchFor=string_4, replaceWith=string_5)
watch_2 = Watch(replace)

# group: Update SVG file
writeText = FileSystem.WriteText(filePath=code_block_15, text=watch_2)

# group: Write room data to excel
code_block_17 = CodeBlock { "Sheet1"; 0; true; }
code_block_18 = CodeBlock()
# ---------- code_block_18.designscript (2 lines) ----------
["Id", "Name",
"Department", "Area", "Level"];
# ----------------------------------------
id_2 = Element.Id(element=filterByBoolMask.in@L2)
string_from_object = FromObject(obj=id_2)
name_2 = Element.Name(element=filterByBoolMask.in@L2)
code_block_19 = CodeBlock { ["Department","Area","Level"]; }
getParameterValueByName_2 = Element.GetParameterValueByName(element=filterByBoolMask.in@L2, parameterName=code_block_19@L1, lacing=Longest)
join = List.Join(list0=string_from_object, list1=name_2, list2=getParameterValueByName_2)
transpose = List.Transpose(lists=join)
addItemToFront = List.AddItemToFront(item=[code_block_18, code_block_18], list=transpose)
exportExcel = Data.ExportExcel(filePath=code_block_7.out3, sheetName=code_block_17.out0, startRow=code_block_17.out1, startCol=code_block_17.out1, data=addItemToFront, overWrite=code_block_17.out2)
