# Dynamo graph ABG_201207_AlBahar1.dyn "Placement" (Dynamo 2.3.0.5885)

family_types = FamilyTypes("Placement panel:Solid")
byFamilyType = FamilyInstance.ByFamilyType(familyType=family_types)
geometry = Element.Geometry(element=byFamilyType)
byJoinedCurves = PolyCurve.ByJoinedCurves(curves=geometry)
curves = PolyCurve.Curves(polyCurve=byJoinedCurves)
startPoint = Curve.StartPoint(curve=curves)
family_types_2 = FamilyTypes("Main panel:Typical")
byPoints = AdaptiveComponent.ByPoints(points=startPoint, familyType=family_types_2)
