# Dynamo graph ABG_201214_CovidSpacing.dyn "BG_Family-CovidReview [2.3.0]" (Dynamo 2.3.0.5885)
# packages: Rhythm 2020.2.13, Crumple 1.0.4

# group: Input
override_graphics = BoolSelector(false)  # graph input

# group: All furniture in view
code_block = CodeBlock { "Furniture"; }
byName = Category.ByName(name=code_block)
current = Document.Current()
activeView = Document.ActiveView(document=current)
all_elements_of_category_in_view = ElementsOfCategoryInView(Category=byName, View=activeView)

# group: Inputs
filtering_parameter = StringInput("Family")  # graph input
parameter_value_contains = StringInput("F.CHA")  # graph input
ignore_value_case = BoolSelector(false)  # graph input

# group: Filter by parameter
# note: Custom Node: Rhythm v.2020.2.13
ʳʰʸᵗʰᵐ_elements = Rhythm.Revit.Elements.Elements.GetParameterValueByNameTypeOrInstance(element=all_elements_of_category_in_view, parameterName=filtering_parameter)
string_from_object = FromObject(obj=ʳʰʸᵗʰᵐ_elements)
contains = String.Contains(str=string_from_object, searchFor=parameter_value_contains, ignoreCase=ignore_value_case)
filterByBoolMask = List.FilterByBoolMask(list=all_elements_of_category_in_view, mask=contains)

# group: Input
minimum_separation = DoubleInput(1500)  # graph input

# group: Filter chairs by separation, IN = Occupied, OUT = Vacant
# note: Custom Node: Crumple v.1.0.4
elementsGroupByProximity = Custom[ElementsGroupByProximity](elements=filterByBoolMask.in, proximity=minimum_separation)  # package Crumple; Given a list of elements, determine how they should be grouped based on a proximity radius. The node will collect the centroid of each element (ignoring the Z coordinate) and cluster them based on whether their radii intersect with one another.
elementsByMinSeparation = Custom[ElementsByMinSeparation](elements=elementsGroupByProximity, count=minimum_separation)  # package Crumple; Given a list of element lists, exclude elements that wont comply with a given separation from one another. The node will return (one of) the most best possible outcomes for that group of elements.
flatten = List.Flatten(list=elementsByMinSeparation)
flatten_2 = List.Flatten(list=elementsGroupByProximity)
contains_2 = List.Contains(list=flatten@L2, item=flatten_2@L1, lacing=Longest)
count = List.Count(list=elementsGroupByProximity@L2)
chop = List.Chop(list=contains_2, lengths=count)
filterByBoolMask_2 = List.FilterByBoolMask(list=elementsGroupByProximity, mask=chop)

# group: Colour elements
empty = List.Empty()
# note: Custom Node: Crumple v.1.0.4
ifThenElse = Custom[IfThenElse](If=override_graphics, Then=filterByBoolMask_2.in, Else=empty)  # package Crumple; A simple if/then/else logic gate. If true, you get the 'then' input, otherwise you get the 'else' input. Unlike the OOTB 'If' node, this one allows differing list sizes.
color_palette = ColorPalette({R: 124, G: 252, B: 0, A: 255})
overrideColorInView = Element.OverrideColorInView(element=ifThenElse@L1, color=color_palette, lacing=Longest)
ifThenElse_2 = Custom[IfThenElse](If=override_graphics, Then=filterByBoolMask_2.out, Else=empty)
color_palette_2 = ColorPalette({R: 210, G: 105, B: 30, A: 255})
overrideColorInView_2 = Element.OverrideColorInView(element=ifThenElse_2@L1, color=color_palette_2, lacing=Longest)

# group: Metrics
flatten_3 = List.Flatten(list=filterByBoolMask_2.out)
count_2 = List.Count(list=flatten_3)
empty_seats = Watch(count_2)  # graph output
flatten_4 = List.Flatten(list=filterByBoolMask_2.in)
count_3 = List.Count(list=flatten_4)
occupied_seats = Watch(count_3)  # graph output
code_block_2 = CodeBlock(num_incl=count_3, num_excl=count_2) { total = num_incl + num_excl; Math.Round(100 * num_incl/total, 1); }
total_seats = Watch(code_block_2.total)  # graph output
percent_occupied = Watch(code_block_2.out1)  # graph output

# group: End user message
string = StringInput("\n")
code_block_3 = CodeBlock(occ=occupied_seats, tot=total_seats, nl=string, perc=percent_occupied) { "RESULTS"; occ + " / " + tot + " seats filled." + nl+nl + perc + " utilization."; }
# note: Custom Node: Rhythm v.2020.2.13
ʳʰʸᵗʰᵐ_helpers_simpleusermessage = Rhythm.Revit.Helpers.Helpers.SimpleUserMessage(caption=code_block_3.out0, message=code_block_3.out1)

# group: Set Comments
code_block_4 = CodeBlock { "OCCUPIED"; "Comments"; "VACANT"; }
setParameterByName = Element.SetParameterByName(element=filterByBoolMask_2.in@L1, parameterName=code_block_4.out1, value=code_block_4.out0, lacing=Longest)
setParameterByName_2 = Element.SetParameterByName(element=filterByBoolMask_2.out@L1, parameterName=code_block_4.out1, value=code_block_4.out2, lacing=Longest)
