# Dynamo graph ABG_210222_BeginnerText.dyn "Demo script" (Dynamo 2.3.0.5885)
# packages: Rhythm 2020.9.8

select_elements_to_change = DSModelElementsSelection()  # 309 picked in the model; graph input
string_from_object = FromObject(obj=select_elements_to_change)
string = StringInput("TextNote")
eq = string_from_object == string
filterByBoolMask = List.FilterByBoolMask(list=select_elements_to_change, mask=eq)
title_case = BoolSelector(false)  # graph input
text = TextNote.Text(textNote=filterByBoolMask.in)
upper_case = BoolSelector(false)  # graph input
changeCase = String.ChangeCase(str=text, upper=upper_case)
ʳʰʸᵗʰᵐ_modify_totitle = Rhythm.String.Modify.ToTitle(str=changeCase)
if_ = If(test=title_case, true=ʳʰʸᵗʰᵐ_modify_totitle, false=changeCase)
setText = TextNote.SetText(textNote=filterByBoolMask.in, value=if_)
new_note_contents = Watch(if_)  # graph output
