# Dynamo graph ABG_210315_ClosestGrid.dyn "grids" (Dynamo 2.6.1.8786)
# packages: Crumple 1.0.7

all_elements_in_active_view = ElementsInView()
code_block = CodeBlock { "Grid intersection"; }
code_block_2 = CodeBlock { "Grids"; }
byName = Category.ByName(name=code_block_2)
all_elements_of_category = ElementsOfCategory(Category=byName)
name = Element.Name(element=all_elements_of_category)
curve = Grid.Curve(grid=all_elements_of_category)
direction = Line.Direction(line=curve)
dominant_grid = DSModelElementSelection()  # 1 picked in the model
curve_2 = Grid.Curve(grid=dominant_grid)
direction_2 = Line.Direction(line=curve_2)
isParallel = Vector.IsParallel(vector=direction, other=direction_2)
filterByBoolMask = List.FilterByBoolMask(list=name, mask=isParallel)
add = filterByBoolMask.in + filterByBoolMask.out  # lacing=CrossProduct
flatten = List.Flatten(list=add)
# note: Custom Package: Crumple v.1.0.7
elementCentroid = Custom[ElementCentroid](element=all_elements_in_active_view)  # package Crumple; Returns the centroid of the element's axis-aligned bounding box.
code_block_3 = CodeBlock(pt=elementCentroid) { pt.X; pt.Y; }
byCoordinates = Point.ByCoordinates(x=code_block_3.out0, y=code_block_3.out1)
filterByBoolMask_2 = List.FilterByBoolMask(list=curve, mask=isParallel)
intersect = Geometry.Intersect(geometry=filterByBoolMask_2.in, other=filterByBoolMask_2.out, lacing=CrossProduct)
flatten_2 = List.Flatten(list=intersect)
code_block_4 = CodeBlock(pt=flatten_2) { pt.X; pt.Y; }
byCoordinates_2 = Point.ByCoordinates(x=code_block_4.out0, y=code_block_4.out1)
distanceTo = Geometry.DistanceTo(geometry=byCoordinates@L1, other=byCoordinates_2@L2, lacing=Longest)
sortIndexByValue = List.SortIndexByValue(list=distanceTo@L2)
firstItem = List.FirstItem(list=sortIndexByValue@L2)
getItemAtIndex = List.GetItemAtIndex(list=flatten, index=firstItem)
setParameterByName = Element.SetParameterByName(element=all_elements_in_active_view, parameterName=code_block, value=getItemAtIndex)
