# Dynamo graph ABG_210401_LogoMaker1.dyn "LogoMaker" (Dynamo 2.6.1.8786)
# packages: GenerativeDesign 1.3.1

# group: Crearte quadrants
code_block = CodeBlock()
# ---------- code_block.designscript (8 lines) ----------
p1 = Point.ByCoordinates(50, 50, 0);
p2 = Point.ByCoordinates(150, 150, 0);
p3 = Point.ByCoordinates(50, 150, 0);
p4 = Point.ByCoordinates(150, 50, 0);

[p1,p2,p3,p4];

100;
# ----------------------------------------
byOriginNormal = Plane.ByOriginNormal(origin=code_block.out4)
byWidthLength = Rectangle.ByWidthLength(plane=byOriginNormal, width=code_block.out5, length=code_block.out5)
byPatch = Surface.ByPatch(closedCurve=byWidthLength)

# group: Establish the border and square
code_block_2 = CodeBlock { 5; }
thicken = Surface.Thicken(surface=byPatch, thickness=code_block_2)
byUnion = Solid.ByUnion(solids=thicken)
XY = Plane.XY()
intersect = Geometry.Intersect(geometry=byUnion, other=XY)
perimeterCurves = Surface.PerimeterCurves(surface=intersect)
code_block_3 = CodeBlock { 15; }
extrude = Curve.Extrude(curve=perimeterCurves, distance=code_block_3)
code_block_4 = CodeBlock { -15; false; }
thicken_2 = Surface.Thicken(surface=extrude, thickness=code_block_4.out0, both_sides=code_block_4.out1)
byUnion_2 = Solid.ByUnion(solids=thicken_2)

openLetterSatisfierTm = DoubleSlider(0, range=0..1 step 1)  # graph input

# group: Versioning
code_block_5 = CodeBlock(x=openLetterSatisfierTm) { x==1; }
version_number = IntegerSlider(2091, range=2022..3000 step 1)  # graph input
thiccness = DoubleSlider(18.7, range=5..25 step 0.1)  # graph input

# group: Splash some colour
code_block_6 = CodeBlock(n=version_number) { n+[11,21,31]; }
random = Math.Random(seed=code_block_6)
code_block_7 = CodeBlock(c=random) { cs = c * 255; r1 = cs[0]; g1 = cs[1]; b1 = cs[2]; 255-r1; 255-g1; 255-b1; }
byARGB = Color.ByARGB(r=code_block_7.out4, g=code_block_7.out5, b=code_block_7.out6)
code_block_8 = CodeBlock { 46; 63; 100; }
byARGB_2 = Color.ByARGB(r=code_block_8.out0, g=code_block_8.out1, b=code_block_8.out2)
if_ = If(test=code_block_5, true=byARGB, false=byARGB_2)
byARGB_3 = Color.ByARGB(r=code_block_7.r1, g=code_block_7.g1, b=code_block_7.b1)
code_block_9 = CodeBlock { 255; 255; 255; }
byARGB_4 = Color.ByARGB(r=code_block_9.out0, g=code_block_9.out1, b=code_block_9.out2)
if_2 = If(test=code_block_5, true=byARGB_3, false=byARGB_4)

# group: Assign colours
byGeometryColor = Modifiers.GeometryColor.ByGeometryColor(geometry=byUnion_2, color=if_)
byGeometryColor_2 = Modifiers.GeometryColor.ByGeometryColor(geometry=byUnion, color=if_2)

# group: Randomize and remap UV points
code_block_10 = CodeBlock(n=version_number) { l1 = [1,2,3,4,5,6,7,8]; l1 + n; }
random_2 = Math.Random(seed=code_block_10.out1)
code_block_11 = CodeBlock { 0.4; 0.6; }
remapRange = Math.RemapRange(numbers=random_2, newMin=code_block_11.out0, newMax=code_block_11.out1)
code_block_12 = CodeBlock { 4; }
chop = List.Chop(list=remapRange, lengths=code_block_12)
code_block_13 = CodeBlock(l=chop) { u = l[0]; v = l[1]; }

# group: Quadrant points
pointAtParameter = Surface.PointAtParameter(surface=byPatch, u=code_block_13.u, v=code_block_13.v)
code_block_14 = CodeBlock(p=pointAtParameter) { lowl = p[0]; uppl = p[2]; lowr = p[3]; uppr = p[1]; }

# group: Remap values
code_block_15 = CodeBlock(n=version_number) { 9+n; 10+n; }
random_3 = Math.Random(seed=code_block_15.out0)
random_4 = Math.Random(seed=code_block_15.out1)
code_block_16 = CodeBlock(x=random_3, y=random_4) { 0.3 + x*0.4; 0.3 + y*0.4; }

# group: Draw the R
byStartPointEndPoint = Line.ByStartPointEndPoint(startPoint=code_block_14.lowl, endPoint=code_block_14.uppl)
byStartPointEndPoint_2 = Line.ByStartPointEndPoint(startPoint=code_block_14.uppl, endPoint=code_block_14.uppr)
pointAtParameter_2 = Curve.PointAtParameter(curve=byStartPointEndPoint, param=code_block_16.out0)
byStartPointEndPoint_3 = Line.ByStartPointEndPoint(startPoint=code_block_14.uppr, endPoint=pointAtParameter_2)
pointAtParameter_3 = Curve.PointAtParameter(curve=byStartPointEndPoint_3, param=code_block_16.out1)
byStartPointEndPoint_4 = Line.ByStartPointEndPoint(startPoint=pointAtParameter_3, endPoint=code_block_14.lowr)

# group: Make the R solid
code_block_17 = CodeBlock(c1=byStartPointEndPoint, c2=byStartPointEndPoint_2, c3=byStartPointEndPoint_3, c4=byStartPointEndPoint_4) { [c1,c2,c3,c4]; }
code_block_18 = CodeBlock { 10; }
extrude_2 = Curve.Extrude(curve=code_block_17, distance=code_block_18)
thicken_3 = Surface.Thicken(surface=extrude_2, thickness=thiccness)
byUnion_3 = Solid.ByUnion(solids=thicken_3)

# group: Join and colour the R
byGeometryColor_3 = Modifiers.GeometryColor.ByGeometryColor(geometry=byUnion_3, color=if_)
union = Solid.Union(solid=byUnion_3, solid_2=byUnion_2)

# group: Measure the volume
volume = Solid.Volume(solid=byUnion_3)
thiccness_2 = Watch(volume)  # graph output

# group: Logo folder path
string = StringInput("C:\Users\Gavin\Documents\Logos\")
string_from_object = FromObject(obj=version_number)
code_block_19 = CodeBlock(p=string, n=string_from_object) { p + "Revit " + n + " logo.png"; }

# group: Let the path through
gate = Data.Gate(false, code_block_19)

# group: Make Pixel grid
code_block_20 = CodeBlock { 0..200..#64; 10; }
byCoordinates = Point.ByCoordinates(x=code_block_20.out0, y=code_block_20.out0, z=code_block_20.out1, lacing=CrossProduct)
remember = Data.Remember(byCoordinates)

# group: Check the pixel colours
doesIntersect = Geometry.DoesIntersect(geometry=union, other=remember, lacing=Longest)
if_3 = If(test=doesIntersect, true=if_, false=if_2)
reverse = List.Reverse(list=if_3@L2)
transpose = List.Transpose(lists=reverse)
fromPixels = Image.FromPixels(colors=transpose)

writeToFile = Image.WriteToFile(path=gate, image=fromPixels)
