# Dynamo graph ABG_210419_RLS1.dyn "Demo script" (Dynamo 2.3.0.5885)
# packages: Data-Shapes 2021.2.94

code_block = CodeBlock { "Rooms"; "Level"; }
byName = Category.ByName(name=code_block.out0)
all_elements_of_category = ElementsOfCategory(Category=byName)
code_block_2 = CodeBlock { "Number"; "Name"; }
getParameterValueByName = Element.GetParameterValueByName(element=all_elements_of_category, parameterName=code_block_2.out0)
getParameterValueByName_2 = Element.GetParameterValueByName(element=all_elements_of_category, parameterName=code_block_2.out1)
id = Element.Id(element=all_elements_of_category)
code_block_3 = CodeBlock(nu=getParameterValueByName, na=getParameterValueByName_2, id=id) { nu + ": " + na + " [" + id + "]"; }
code_block_4 = CodeBlock { "INSTRUCTIONS"; "Fill out all the inputs, the script will then create RLS' for each room selected"; }
textnote_data = Custom[TextNote Data](Title=code_block_4.out0, TextNote=code_block_4.out1)  # package Data-Shapes; Create Data for TextNote input in UI.MultipleInputForm ++ . Check out www.data-shapes.net for more informations
code_block_5 = CodeBlock { "SELECT ROOMS"; }
getParameterValueByName_3 = Element.GetParameterValueByName(element=all_elements_of_category, parameterName=code_block.out1)
groupByKey = List.GroupByKey(list=code_block_3, keys=getParameterValueByName_3)
addItemToFront = List.AddItemToFront(item=groupByKey.unique_keys@L1, list=groupByKey.groups@L2)
code_block_6 = CodeBlock { true; 300; }
treeview_input = Custom[TreeView input](InputName=code_block_5, Data=addItemToFront, FirstItemIsTitle=code_block_6.out0, Height=code_block_6.out1)  # package Data-Shapes; Create a TreeView input for UI.MultipleInputForm ++ . Check out www.data-shapes.net for more infos and tips!
code_block_7 = CodeBlock { "VIEW PREFIX"; "80"; false; }
textbox_data = Custom[TextBox Data](InputName=code_block_7.out0, DefaultText=code_block_7.out1, IsNumberEntry=code_block_7.out2)  # package Data-Shapes; Create Data for TextBox input in UI.MultipleInputForm ++ . Check out www.data-shapes.net for more informations
code_block_8 = CodeBlock { "Views"; }
byName_2 = Category.ByName(name=code_block_8)
all_elements_of_category_2 = ElementsOfCategory(Category=byName_2)
code_block_9 = CodeBlock { false; }
clean = List.Clean(list=all_elements_of_category_2, preserveIndices=code_block_9)
isViewTemplate = View.IsViewTemplate(view=clean)
filterByBoolMask = List.FilterByBoolMask(list=clean, mask=isViewTemplate)
code_block_10 = CodeBlock(e=filterByBoolMask.in) { "PLAN VIEW TEMPLATE"; e.Name; e; true; }
dropdown_data = Custom[DropDown Data](InputName=code_block_10.out0, Keys=code_block_10.out1, Values=code_block_10.e, Sorted_optional=code_block_10.out3)  # package Data-Shapes; Create data for DropDown input in UI.MultiInputForm ++ . Check out www.data-shapes.net for more infos.
code_block_11 = CodeBlock(e=filterByBoolMask.in) { "ELEVATION VIEW TEMPLATE"; e.Name; e; true; }
dropdown_data_2 = Custom[DropDown Data](InputName=code_block_11.out0, Keys=code_block_11.out1, Values=code_block_11.e, Sorted_optional=code_block_11.out3)
code_block_12 = CodeBlock { "Schedules"; }
byName_3 = Category.ByName(name=code_block_12)
all_elements_of_category_3 = ElementsOfCategory(Category=byName_3)
name = Element.Name(element=all_elements_of_category_3)
code_block_13 = CodeBlock { [" Internal", "<Revision "]; }
contains = String.Contains(str=name@L1, searchFor=code_block_13@L2, lacing=Longest)
countTrue = List.CountTrue(list=contains@L2)
code_block_14 = CodeBlock(c=countTrue) { c==0; }
filterByBoolMask_2 = List.FilterByBoolMask(list=all_elements_of_category_3, mask=code_block_14)
code_block_15 = CodeBlock(e=filterByBoolMask_2.in) { "REFERENCE SCHEDULE"; e.Name; e; true; }
dropdown_data_3 = Custom[DropDown Data](InputName=code_block_15.out0, Keys=code_block_15.out1, Values=code_block_15.e, Sorted_optional=code_block_15.out3)
element_types = ElementTypes("ViewFamilyType")
all_elements_of_type = ElementsOfType(element_type=element_types)
code_block_16 = CodeBlock { "Family Name"; }
getParameterValueByName_4 = Element.GetParameterValueByName(element=all_elements_of_type, parameterName=code_block_16)
code_block_17 = CodeBlock(vt=getParameterValueByName_4) { vt == "Floor Plan"; vt == "Elevation"; }
filterByBoolMask_3 = List.FilterByBoolMask(list=all_elements_of_type, mask=code_block_17.out0)
code_block_18 = CodeBlock(e=filterByBoolMask_3.in) { "PLAN VIEW TYPE"; e.Name; e; true; }
dropdown_data_4 = Custom[DropDown Data](InputName=code_block_18.out0, Keys=code_block_18.out1, Values=code_block_18.e, Sorted_optional=code_block_18.out3)
filterByBoolMask_4 = List.FilterByBoolMask(list=all_elements_of_type, mask=code_block_17.out1)
code_block_19 = CodeBlock(e=filterByBoolMask_4.in) { "ELEVATION VIEW TYPE"; e.Name; e; true; }
dropdown_data_5 = Custom[DropDown Data](InputName=code_block_19.out0, Keys=code_block_19.out1, Values=code_block_19.e, Sorted_optional=code_block_19.out3)
list_create = List.Create(item0=textnote_data, item1=treeview_input, item2=textbox_data, item3=dropdown_data, item4=dropdown_data_2, item5=dropdown_data_3, item6=dropdown_data_4, item7=dropdown_data_5)
code_block_20 = CodeBlock(inputs=list_create) { "CREATE ROOM LAYOUT SHEETS"; "RUN"; inputs; true; "CANCEL"; 600; 200; }
multipleinputform = Custom[MultipleInputForm ++](Description_optional=code_block_20.out0, ButtonText_optional=code_block_20.out1, Inputs=code_block_20.inputs, Toggle=code_block_20.out3, CancelButtonText_optional=code_block_20.out4, Width_optional=code_block_20.out5, LabelWidth_optional=code_block_20.out6)  # package Data-Shapes; Create a form with multiple inputs. see www.data-shapes.net for tutorials and infos!
code_block_21 = CodeBlock(i=multipleinputform.User_Inputs) { rooms = i[0]; prefi = i[1]; planv = i[2]; elevv = i[3]; sched = i[4]; plant = i[5]; elevt = i[6]; }
indexOf = List.IndexOf(list=code_block_3, element=code_block_21.rooms)
getItemAtIndex = List.GetItemAtIndex(list=all_elements_of_category, index=indexOf)
