# Dynamo graph ABG_210426_YieldStatements.dyn "Demo script" (Dynamo 2.3.0.5885)

code_block = CodeBlock { 900; }
randomList = Math.RandomList(amount=code_block)
round = Math.Round(number=randomList)
code_block_2 = CodeBlock { 90; }
chop = List.Chop(list=round, lengths=code_block_2)
code_block_3 = CodeBlock { 0; }
python_script = Python(IN[0]=chop, IN[1]=code_block_3)
# ---------- python_script.python (21 lines) ----------
def tolist(input):
	result = input if isinstance(input, list) else [input]
	return result
	
def splitter(seq, splitval = 0):
	seq.append(splitval)
	group = []
	for num in seq:
		if num != splitval:
			group.append(num)
		elif group:
			yield group
			group = []

values = tolist(IN[0])
result = []

for n in values:
	result.append(list(splitter(n)))

OUT = result
# ----------------------------------------
count = List.Count(list=python_script@L2)
code_block_4 = CodeBlock(x=count) { x/4; }
floor = Math.Floor(number=code_block_4)
count_2 = List.Count(list=python_script@L3)
chop_2 = List.Chop(list=floor, lengths=count_2)
sum = Math.Sum(values=chop_2)
