# Dynamo graph ABG_210510_Dimensioning.dyn "Demo script" (Dynamo 2.3.0.5885)
# packages: Genius Loci 2021.2.3

current = Document.Current()
activeView = Document.ActiveView(document=current)
select_model_elements = DSModelElementsSelection()  # 4 picked in the model
getLocation = Element.GetLocation(element=select_model_elements)
vertical_grid = DSModelElementSelection()  # 1 picked in the model
curve = Grid.Curve(grid=vertical_grid)
closestPointTo = Geometry.ClosestPointTo(geometry=curve, other=getLocation)
byStartPointEndPoint = Line.ByStartPointEndPoint(startPoint=getLocation, endPoint=closestPointTo)
YAxis = Vector.YAxis()
number = DoubleInput(300)
translate = Geometry.Translate(geometry=byStartPointEndPoint, direction=YAxis, distance=number)
horizontal_grid = DSModelElementSelection()  # 1 picked in the model
curve_2 = Grid.Curve(grid=horizontal_grid)
closestPointTo_2 = Geometry.ClosestPointTo(geometry=curve_2, other=getLocation)
byStartPointEndPoint_2 = Line.ByStartPointEndPoint(startPoint=getLocation, endPoint=closestPointTo_2)
XAxis = Vector.XAxis()
number_2 = DoubleInput(-300)
translate_2 = Geometry.Translate(geometry=byStartPointEndPoint_2, direction=XAxis, distance=number_2)
join = List.Join(list0=translate, list1=translate_2)
# note: Custom Package: GeniusLoci v.2021.2.3
familyinstance_references = Custom[FamilyInstance References](familyInstance=select_model_elements)  # package Genius Loci; Returns all references and references names.
code_block = CodeBlock()
# ---------- code_block.designscript (2 lines) ----------
["Center (Left/Right)",
"Center (Front/Back)"];
# ----------------------------------------
indexOf = List.IndexOf(list=familyinstance_references.ReferenceName@L2, element=code_block@L2, lacing=Longest)
getItemAtIndex = List.GetItemAtIndex(list=familyinstance_references.Reference@L2, index=indexOf@L2)
transpose = List.Transpose(lists=getItemAtIndex)
code_block_2 = CodeBlock(l=transpose) { vert = l[0]; hori = l[1]; }
element_reference = Custom[Element Reference](element=vertical_grid)  # package Genius Loci; Gets the reference of a geometric object or a dimension or a reference plane.
addItemToFront = List.AddItemToFront(item=code_block_2.vert@L1, list=element_reference@L2, lacing=Longest)
element_reference_2 = Custom[Element Reference](element=horizontal_grid)
addItemToFront_2 = List.AddItemToFront(item=code_block_2.hori@L1, list=element_reference_2@L2, lacing=Longest)
join_2 = List.Join(list0=addItemToFront, list1=addItemToFront_2)
element_types = ElementTypes("DimensionType")
all_elements_of_type = ElementsOfType(element_type=element_types)
name = Element.Name(element=all_elements_of_type)
string = StringInput("Diagonal - 2.5mm Arial")
indexOf_2 = List.IndexOf(list=name, element=string)
getItemAtIndex_2 = List.GetItemAtIndex(list=all_elements_of_type, index=indexOf_2)
dimension_byreferences = Custom[Dimension ByReferences](view=activeView, line=join, references=join_2, dimensionType=getItemAtIndex_2, lacing=Longest)  # package Genius Loci; Creates a new linear dimension from at least two geometric references of an object.
