# Dynamo graph ABG_210531_Speckle.dyn "Speckle dynamo" (Dynamo 2.3.0.5885)
# packages: SpeckleDynamo2 2.0.0, Crumple 2021.5.27

roomsbyplacement = Custom[© RoomsByPlacement]()  # package Crumple; Collects all placed/unplaced rooms as two lists.
id = Element.Id(element=roomsbyplacement.placed)
code_block = CodeBlock()
# ---------- code_block.designscript (3 lines) ----------
["Name",
"Number",
"Area"];
# ----------------------------------------
getParameterValueByName = Element.GetParameterValueByName(element=roomsbyplacement.placed@L1, parameterName=code_block@L2, lacing=Longest)
addItemToFront = List.AddItemToFront(item=id@L1, list=getParameterValueByName@L2)
string = StringInput("https://speckle.xyz/streams/262ebe3fac")
select = Accounts(SelectedUserId="35d41a8684")
get = Speckle.ConnectorDynamo.Functions.Stream.Get(stream=string, account=select)
string_2 = StringInput("Testing 1")
send = Send(data=addItemToFront, stream=get, message=string_2, AutoUpdate=false)
addItemToFront_2 = List.AddItemToFront(item=roomsbyplacement.placed@L1, list=addItemToFront@L2)
string_3 = StringInput("https://speckle.xyz/streams/47de40eb13")
string_4 = StringInput("Testing 1")
send_2 = Send(data=addItemToFront_2, stream=string_3, message=string_4, AutoUpdate=false)
