# Dynamo graph ABG_210617_Export.dyn "Export room data" (Dynamo 2.3.1.11775)
# packages: Crumple 2021.5.27

file_path = Filename("C:\Users\Gavin\Desktop\Room data.xlsx")
code_block = CodeBlock { "Sheet1"; 0; true; }
code_block_2 = CodeBlock { ["ID","Name","Number"]; }
# note: Custom Node: Crumple v.2021.5.27
roomsbyplacement = Custom[© RoomsByPlacement]()  # package Crumple; Collects all placed/unplaced rooms as two lists.
id = Element.Id(element=roomsbyplacement.placed)
number = Room.Number(room=roomsbyplacement.placed)
name = Room.Name(room=roomsbyplacement.placed)
list_create = List.Create(item0=id, item1=number, item2=name)
transpose = List.Transpose(lists=list_create)
addItemToFront = List.AddItemToFront(item=code_block_2, list=transpose)  # frozen
exportExcel = Data.ExportExcel(filePath=file_path, sheetName=code_block.out0, startRow=code_block.out1, startCol=code_block.out1, data=addItemToFront, overWrite=code_block.out2)
