# Dynamo graph ABG_210617_Import.dyn "Import room data" (Dynamo 2.3.1.11775)
# packages: Crumple 2021.5.27

categories = Categories("OST_Rooms")
all_elements_of_category = ElementsOfCategory(Category=categories)
shuffle = List.Shuffle(list=all_elements_of_category)
id = Element.Id(element=shuffle)
file_path = Filename("C:\Users\Gavin\Desktop\Room data.xlsx")
code_block = CodeBlock { true; }
# note: Custom Node: Crumple v.2021.5.27
quickimportexcel = Custom[© QuickImportExcel](filePath=file_path, asStrings=code_block)  # package Crumple; The Import excel node, but with some streamlining features introduced. I mainly made this as I am constantly doing this setup and wanted to simplify it down to one node.
code_block_2 = CodeBlock(out=quickimportexcel.data) { id = out[0]; nm = out[1]; na = out[2]; }
toNumber = String.ToNumber(str=code_block_2.id)
indexOf = List.IndexOf(list=id, element=toNumber)
getItemAtIndex = List.GetItemAtIndex(list=shuffle, index=indexOf)
toNumber_2 = String.ToNumber(str=code_block_2.id)
elementbyid = Custom[© ElementById](Id=toNumber_2)  # package Crumple; Given an Element Id as an integer, returns the corresponding element in Revit.
code_block_3 = CodeBlock { "Number"; "Name"; }
setParameterByName = Element.SetParameterByName(element=elementbyid, parameterName=code_block_3.out0, value=code_block_2.nm)
setParameterByName_2 = Element.SetParameterByName(element=elementbyid, parameterName=code_block_3.out1, value=code_block_2.na)
