# Dynamo graph ABG_210629_RoofEdges.dyn "Roof edges" (Dynamo 2.3.1.11775)
# packages: Crumple 2021.5.27

code_block = CodeBlock { "RESULT"; "Script has completed."; }
select_roof = DSModelElementSelection()  # 1 picked in the model; graph input
code_block_2 = CodeBlock()
# ---------- code_block_2.designscript (3 lines) ----------
["Valleys",
"Ridges",
"Cappings"];
# ----------------------------------------
select_valleys = SelectEdges()  # 1 picked in the model; graph input
length = Curve.Length(curve=select_valleys)
sum = Math.Sum(values=length)
select_ridges = SelectEdges()  # 2 picked in the model; graph input
length_2 = Curve.Length(curve=select_ridges)
sum_2 = Math.Sum(values=length_2)
select_cappings = SelectEdges()  # 1 picked in the model; graph input
length_3 = Curve.Length(curve=select_cappings)
sum_3 = Math.Sum(values=length_3)
list_create = List.Create(item0=sum, item1=sum_2, item2=sum_3)
setParameterByName = Element.SetParameterByName(element=select_roof, parameterName=code_block_2, value=list_create)
uimessenger = Custom[© UIMessenger](title=code_block.out0, body=code_block.out1, pass=setParameterByName)  # package Crumple; Displays a message box with a title/body and OK/cancel button. If OK is selected, the third input's data will be passed through.
