# Dynamo graph ABG_210701_GroupPhasing.dyn "Demo script" (Dynamo 2.3.1.11775)
# packages: Data-Shapes 2021.2.94, Crumple 2021.5.27, spring nodes 204.1.0

code_block = CodeBlock { "Model Groups"; }
byName = Category.ByName(name=code_block)
boolean = BoolSelector(true)
select_model_elements_of = Custom[Select Model Elements of Category](Categories=byName, Toggle=boolean)  # package Data-Shapes; Allows to perform a manual selection with a category filter.
groupelements = Custom[© GroupElements](group=select_model_elements_of)  # package Crumple; Given a Revit group, return all elements in that given group if any.
flatten = List.Flatten(list=groupelements)
code_block_2 = CodeBlock { "Phase Demolished"; }
ꟿ_element_setparametertonone = Custom[ꟿ Element.SetParameterToNone](element=flatten, paramName=code_block_2)  # package spring nodes; Used to set parameters such as View Template, Phase Demolished or Top Constraint to None / Unconstrained.
code_block_3 = CodeBlock { "Phase Created"; }
select_phase = RevitPhases("Working Drawings")  # graph input
setParameterByName = Element.SetParameterByName(parameterName=code_block_3, value=select_phase)  # unwired: element
function_apply = ApplyFunction(func=setParameterByName, arg1=flatten)
