# Dynamo graph ABG_210715_ClosestPoint.dyn "Finished script" (Dynamo 2.3.1.11775)

select_face = DSFaceSelection()  # 1 picked in the model
code_block = CodeBlock { 0.5; 0..1..0.01; }
pointAtParameter = Surface.PointAtParameter(surface=select_face, u=code_block.out0, v=code_block.out1, lacing=Longest)
select_face_2 = DSFaceSelection()  # 1 picked in the model
code_block_2 = CodeBlock { 0.5; }
pointAtParameter_2 = Surface.PointAtParameter(surface=select_face_2, u=code_block_2, v=code_block_2)
normalAtParameter = Surface.NormalAtParameter(surface=select_face_2, u=code_block_2, v=code_block_2)
byOriginNormal = Plane.ByOriginNormal(origin=pointAtParameter_2, normal=normalAtParameter)
closestPointTo = Geometry.ClosestPointTo(geometry=byOriginNormal, other=pointAtParameter, lacing=Longest)
byStartPointEndPoint = Line.ByStartPointEndPoint(startPoint=pointAtParameter, endPoint=closestPointTo)
length = Curve.Length(curve=byStartPointEndPoint)
number_slider = DoubleSlider(3000, range=2200..5000 step 10)
lt = length < number_slider
filterByBoolMask = List.FilterByBoolMask(list=byStartPointEndPoint, mask=lt)
length_2 = Curve.Length(curve=filterByBoolMask.in)
sortByKey = List.SortByKey(list=filterByBoolMask.in, keys=length_2)
lastItem = List.LastItem(list=sortByKey.sorted_list)
startPoint = Curve.StartPoint(curve=lastItem)
endPoint = Curve.EndPoint(curve=lastItem)
list_create = List.Create(item0=startPoint, item1=endPoint)
list_create_2 = List.Create(item0=list_create)
family_types = FamilyTypes("Corridor checker:Corridor checker")
byPoints = AdaptiveComponent.ByPoints(points=list_create_2, familyType=family_types)
