# Dynamo graph ABG_210801_EmailDynamo.dyn "Demo script" (Dynamo 2.3.1.11775)
# packages: Crumple 2021.5.27

code_block = CodeBlock { "Script finished"; }
string = StringInput("gcrump@bimguru.com.au")
string_2 = StringInput("Dynamo here!")
string_3 = StringInput("Stage 1 complete")
outlooksend = Custom[© OutlookSend](to=string, subject=string_2, body=string_3)  # package Crumple; Given Outlook is open, this node will attempt to send an email to a list of recipients with a subject and body.
waitfor = Custom[© WaitFor](data=string, waitFor=outlooksend)  # package Crumple; Tells the first input to wait for the second input to arrive, then passes on the first input. Really useful for scripts which have branching paths that rely on their outputs to carry each other forward. Quite a few custom packages have a 'passthrough' or 'waitfor' node. I use these all the time, so find it useful to have them contained in this package also.
code_block_2 = CodeBlock { 15; }
delay = Custom[© Delay](data=waitfor, seconds=code_block_2, limit=code_block_2)  # package Crumple; Given a duration in seconds and some data, this script will delay that data by the given time. A threshold of 3 seconds is used by default to stop an undesirable number being provided.
string_4 = StringInput("Dynamo here!")
string_5 = StringInput("Stage 2 complete")
outlooksend_2 = Custom[© OutlookSend](to=delay.data, subject=string_4, body=string_5)
uimessenger = Custom[© UIMessenger](title=code_block, body=code_block, pass=outlooksend_2)  # package Crumple; Displays a message box with a title/body and OK/cancel button. If OK is selected, the third input's data will be passed through.
