# Dynamo graph ABG_210805_MergeLogFiles.dyn "Merge files" (Dynamo 2.3.1.11775)
# packages: Crumple 2021.5.27

# note: Custom Node: Crumple v.2021.5.27
userdocuments = Custom[© UserDocuments]()  # package Crumple; This node returns the active username, as well as a path to the user's My Documents.
code_block = CodeBlock(d=userdocuments.My_Docs) { d + "\\Combined.csv"; }
directory_from_path = DirectoryObject(path=userdocuments.My_Docs)
code_block_2 = CodeBlock { "*.csv"; false; }
getDirectoryContents = FileSystem.GetDirectoryContents(directory=directory_from_path, searchString=code_block_2.out0, includeSubdirectories=code_block_2.out1)
code_block_3 = CodeBlock { true; }
importCSV = Data.ImportCSV(filePath=getDirectoryContents.files, transpose=code_block_3)
flatten = List.Flatten(list=importCSV@L2)
exportCSV = Data.ExportCSV(filePath=code_block, data=flatten)
