# Dynamo graph ABG_210809_OpenFamilyURL.dyn "Demo script" (Dynamo 2.3.1.11775)
# packages: Crumple 2021.7.19

select_model_element = DSModelElementSelection()  # 1 picked in the model; graph input
code_block = CodeBlock { "Type"; }
getParameterValueByName = Element.GetParameterValueByName(element=select_model_element, parameterName=code_block)
code_block_2 = CodeBlock { "URL"; }
getParameterValueByName_2 = Element.GetParameterValueByName(element=getParameterValueByName, parameterName=code_block_2)
code_block_3 = CodeBlock(x=getParameterValueByName_2) { x == ""; }
isNull = Object.IsNull(obj=getParameterValueByName_2)
or_ = Or(bool0=code_block_3, bool1=isNull)
code_block_4 = CodeBlock { false; true; }
if_ = If(test=or_, true=code_block_4.out0, false=code_block_4.out1)
openurl = Custom[© OpenURL](url=getParameterValueByName_2, runMe=if_)  # package Crumple; Given a URL, will attempt to open in the default web browser used by Windows.
code_block_5 = CodeBlock { "Valid URL not found."; "URL opened."; }
if_2 = If(test=or_, true=code_block_5.out0, false=code_block_5.out1)
outcome = Watch(if_2)  # graph output
URL = Watch(getParameterValueByName_2)  # graph output
