# Dynamo graph ABG_210812_ReloadNestedFamilies.dyn "Demo script" (Dynamo 2.3.1.11775)
# packages: Orchid 203.3.0.7829

directory_to_load_family_to = Directory("C:\Users\Gavin\Desktop\Run folder")  # graph input
code_block = CodeBlock { "*.rfa"; false; }
contents = Orchid.Common.Directory.Contents(directory=directory_to_load_family_to, searchString=code_block.out0, deepSearch=code_block.out1)
backgroundOpen = Orchid.RevitProject.Common.Document.BackgroundOpen(file=contents)
family_to_load = Filename("C:\Users\Gavin\Desktop\Run folder\Components\Text marker.rfa")  # graph input
loadFamily = Orchid.RevitProject.Common.Document.LoadFamily(document=backgroundOpen, family=family_to_load, lacing=Longest)
await_ = Orchid.Common.DataStream.Await(pass=backgroundOpen, waitFor=loadFamily)
code_block_2 = CodeBlock { true; }
close = Orchid.RevitProject.Common.Document.Close(document=await_, save=code_block_2, lacing=Longest)
