# Dynamo graph ABG_210816_BulkUpgradeModels.dyn "Demo script" (Dynamo 2.6.1.8786)
# packages: Rhythm 2021.1.1

directory_path = Directory("C:\Users\Gavin\Desktop\Projects")
directory_from_path = DirectoryObject(path=directory_path)
code_block = CodeBlock { "*.rvt"; false; }
getDirectoryContents = FileSystem.GetDirectoryContents(directory=directory_from_path, searchString=code_block.out0, includeSubdirectories=code_block.out1)
code_block_2 = CodeBlock { true; }
ʳʰʸᵗʰᵐ_applications = Rhythm.Revit.Application.Applications.OpenDocumentFile(filePath=getDirectoryContents.files, closeAllWorksets=code_block_2)
code_block_3 = CodeBlock { true; }
ʳʰʸᵗʰᵐ_applications_2 = Rhythm.Revit.Application.Applications.CloseDocument(document=ʳʰʸᵗʰᵐ_applications, save=code_block_3)
