# Dynamo graph ABG_210816_WallTopo.dyn "Demo script" (Dynamo 2.3.1.11775)
# packages: spring nodes 204.1.0, WombatDynamo 2.3.4, Clockwork for Dynamo 2.x 2.3.0

wall = DSModelElementSelection()  # 1 picked in the model; graph input
geometry = Element.Geometry(element=wall)
topography = DSModelElementSelection()  # 1 picked in the model; graph input
mesh = Topography.Mesh(topography=topography)
ꟿ_mesh_topolysurface = Custom[ꟿ Mesh.ToPolySurface](mesh=mesh)  # package spring nodes; Converts a Dynamo mesh to a polysurface. By default the node is single threaded, but if you specify a higher number of threads in the `NUMTHREAD` input, the node will run multi-threaded to speed up the conversion. *WARNING* Using multi-threaded code with Dynamo's geometry kernel may crash Revit in some cases.
split = Geometry.Split(geometry=geometry, other=ꟿ_mesh_topolysurface)
centroid = Solid.Centroid(solid=split)
Z = Point.Z(point=centroid)
sortByKey = List.SortByKey(list=split@L1, keys=Z@L1)
firstItem = List.FirstItem(list=sortByKey.sorted_list)
ZAxis = Vector.ZAxis()
wall_height = DoubleInput(2000)  # graph input
translate = Geometry.Translate(geometry=ꟿ_mesh_topolysurface, direction=ZAxis, distance=wall_height)
split_2 = Geometry.Split(geometry=firstItem, other=translate)
lastItem = List.LastItem(list=split_2@L2)
getLocation = Element.GetLocation(element=wall)
code_block = CodeBlock { 0.5; }
pointAtParameter = Curve.PointAtParameter(curve=getLocation, param=code_block)
normalAtParameter = Curve.NormalAtParameter(curve=getLocation, param=code_block)
byOriginNormal = Plane.ByOriginNormal(origin=pointAtParameter, normal=normalAtParameter)
intersect = Geometry.Intersect(geometry=lastItem, other=byOriginNormal)
perimeterCurves = Surface.PerimeterCurves(surface=intersect)
flatten = List.Flatten(list=perimeterCurves)
wall_type = WallTypes("Foundation - 300mm Concrete")  # graph input
base_level_for_new_wall = Levels("Foundation")  # graph input
startPoint = Curve.StartPoint(curve=flatten)
Z_2 = Point.Z(point=startPoint)
minimumItem = List.MinimumItem(list=Z_2)
plane = Custom[Level.Plane](level=base_level_for_new_wall)  # package Clockwork for Dynamo 2.x; Retrieves the plane of a given level
origin = Plane.Origin(plane=plane)
Z_3 = Point.Z(point=origin)
code_block_2 = CodeBlock(min=minimumItem, plane=Z_3) { min-plane; }
byProfile = WombatDynamo.Wall.ByProfile(profile=flatten, wallType=wall_type, level=base_level_for_new_wall, baseOffset=code_block_2)
