# Dynamo graph ABG_210826_ViewAncestry.dyn "test2" (Dynamo 2.3.1.11775)
# packages: Crumple 2021.8.4

views = Custom[© Views]()  # package Crumple; Returns all views in the model. Excludes system views, templates, legends and schedule instances.
parentview = Custom[© ParentView](views=views)  # package Crumple; For a view, return it's next related parent view if any. Will only retrieve one level above (even if it's parent has a parent etc.).
parentview_2 = Custom[© ParentView](views=parentview.onlyParents)
parentview_3 = Custom[© ParentView](views=parentview_2.onlyParents)
parentview_4 = Custom[© ParentView](views=parentview_3.onlyParents)
parentview_5 = Custom[© ParentView](views=parentview_4.onlyParents)
parentview_6 = Custom[© ParentView](views=parentview_5.onlyParents)
join = List.Join(list0=parentview.onlyParents, list1=parentview_2.onlyParents, list2=parentview_3.onlyParents, list3=parentview_4.onlyParents, list4=parentview_5.onlyParents, list5=parentview_6.onlyParents)
uniqueItems = List.UniqueItems(list=join)
python_script = Python(IN[0]=views)
# ---------- python_script.python (58 lines) ----------
# Made by Gavin Crump
# Free for use
# BIM Guru, www.bimguru.com.au

# Boilerplate text
import clr

clr.AddReference("RevitServices")
import RevitServices
from RevitServices.Persistence import DocumentManager 

clr.AddReference("RevitAPI")
import Autodesk 
from Autodesk.Revit.DB import *

# Current doc/app/ui
doc = DocumentManager.Instance.CurrentDBDocument

# Define list/unwrap list functions
def uwlist(input):
    result = input if isinstance(input, list) else [input]
    return UnwrapElement(result)

# Preparing input from dynamo to revit
viewlist = uwlist(IN[0])
alltrees, alldepths, hasparents = [], [], []

# Main function
for v in viewlist:
	
	breaker = 0
	checkview = v
	treedepth = 1
	viewtree = []
	godeeper = True
	
	while godeeper and breaker < 99:
	
		breaker += 1
	
		try:
			parentId = checkview.get_Parameter(BuiltInParameter.SECTION_PARENT_VIEW_NAME).AsElementId()
			checkview = Document.GetElement(doc, parentId)
			
			if checkview != None:
				treedepth += 1
				viewtree.append(checkview)
			else:
				godeeper = False
		except:
			godeeper = False
			
	alltrees.append(viewtree)
	alldepths.append(treedepth)
	hasparents.append(treedepth > 1)

# Preparing output to Dynamo
OUT = [alltrees, alldepths, hasparents]
# ----------------------------------------
code_block = CodeBlock(x=python_script) { x[0]; }
flatten = List.Flatten(list=code_block)
uniqueItems_2 = List.UniqueItems(list=flatten)
viewancestry = Custom[© ViewAncestry](views=views)  # package Crumple; Returns the parent of a view, and the parent of that view, and the.... etc. Will also return if it had any parents, as well as the depth of the view's family tree.
