# Dynamo graph ABG_210928_StairTakeoff.dyn "Demo script" (Dynamo 2.3.1.11775)

categories = Categories("OST_Stairs")
all_elements_of_category = ElementsOfCategory(Category=categories)
code_block = CodeBlock { "BG_DIM_Volume1"; }
solids = Element.Solids(element=all_elements_of_category)
volume = Solid.Volume(solid=solids)
sum = Math.Sum(values=volume)
convert_between_units = DynamoConvert(sum, MeasurementType="Volume", FromConversion="CubicMillimeter", ToConversion="CubicMeters")
setParameterByName = Element.SetParameterByName(element=all_elements_of_category, parameterName=code_block, value=convert_between_units)
code_block_2 = CodeBlock { "BG_DIM_Area1"; }
byUnion = Solid.ByUnion(solids=solids)
explode = Geometry.Explode(geometry=byUnion)
code_block_3 = CodeBlock { 0.5; }
normalAtParameter = Surface.NormalAtParameter(surface=explode, u=code_block_3, v=code_block_3)
Z = Vector.Z(vector=normalAtParameter)
code_block_4 = CodeBlock(z=Z) { z > 0.5; }
filterByBoolMask = List.FilterByBoolMask(list=explode, mask=code_block_4)
area = Surface.Area(surface=filterByBoolMask.in)
sum_2 = Math.Sum(values=area)
convert_between_units_2 = DynamoConvert(sum_2, MeasurementType="Area", FromConversion="SquareMillimeter", ToConversion="SquareMeter")
setParameterByName_2 = Element.SetParameterByName(element=setParameterByName, parameterName=code_block_2, value=convert_between_units_2)
