# Dynamo graph ABG_211005_ElementBB.dyn "Demo script" (Dynamo 2.10.1.3976)
# packages: Genius Loci 2021.7.30

all_elements_in_active_view = ElementsInView()
solids = Element.Solids(element=all_elements_in_active_view)
byUnion = Solid.ByUnion(solids=solids)
boundingBox = Element.BoundingBox(element=all_elements_in_active_view)
toCuboid = BoundingBox.ToCuboid(boundingBox=boundingBox)
centroid = Solid.Centroid(solid=toCuboid)
ZAxis = Vector.ZAxis()
# note: Custom Node: GeniusLoci v.2021.7.30
element_getrotation = Custom[Element GetRotation](element=all_elements_in_active_view)  # package Genius Loci; Calculates the rotation angle between the given element and the X axis. Works for point/ line/ sketch based elements and link instances.
code_block = CodeBlock(x=element_getrotation) { x*-1; }
rotate = Geometry.Rotate(geometry=byUnion, origin=centroid, axis=ZAxis, degrees=code_block)
boundingBox_2 = Geometry.BoundingBox(geometry=rotate)
toCuboid_2 = BoundingBox.ToCuboid(boundingBox=boundingBox_2)
ZAxis_2 = Vector.ZAxis()
rotate_2 = Geometry.Rotate(geometry=toCuboid_2, origin=centroid, axis=ZAxis_2, degrees=element_getrotation)
