# Dynamo graph ABG_211013_RevColours.dyn "revisions" (Dynamo 2.3.1.11775)
# packages: Crumple 2021.9.24

# group: Get the cloud's number and colour Id
categories = Categories("OST_RevisionClouds")
current = Document.Current()
activeView = Document.ActiveView(document=current)
all_elements_of_category_in_view = ElementsOfCategoryInView(Category=categories, View=activeView)
string = StringInput("Revision")
getParameterValueByName = Element.GetParameterValueByName(element=all_elements_of_category_in_view, parameterName=string)

# group: Revisions by project order
# note: Custom Node: Crumple v.2021.9.24
revisions = Custom[© Revisions]()  # package Crumple; Returns all revisions in a document.
code_block = CodeBlock { "Revision Sequence"; }
getParameterValueByName_2 = Element.GetParameterValueByName(element=revisions, parameterName=code_block)
sortByKey = List.SortByKey(list=revisions, keys=getParameterValueByName_2)

# group: Get a colour
color_palette = ColorPalette({R: 0, G: 0, B: 255, A: 255})
color_palette_2 = ColorPalette({R: 210, G: 105, B: 30, A: 255})
color_palette_3 = ColorPalette({R: 255, G: 215, B: 0, A: 255})
# note: You could also generate a list of random colours based on revision count if you want to make sure the colour size is equal to the number of revision types.
color_palette_4 = ColorPalette({R: 219, G: 112, B: 147, A: 255})
list_create = List.Create(item0=color_palette, item1=color_palette_2, item2=color_palette_3, item3=color_palette_4)
indexOf = List.IndexOf(list=sortByKey.sorted_list, element=getParameterValueByName)

# group: Override cloud colour
getItemAtIndex = List.GetItemAtIndex(list=list_create, index=indexOf)
overrideColorInView = Element.OverrideColorInView(element=all_elements_of_category_in_view, color=getItemAtIndex)
