# Dynamo graph ABG_211018_ModelCompare.dyn "Compare" (Dynamo 2.3.1.11775)
# packages: bimorphNodes 3.0.3

pick_a_category = Categories("OST_Walls")  # graph input
all_elements_of_category = ElementsOfCategory(Category=pick_a_category)
id = Element.Id(element=all_elements_of_category)
select_model_link_instance = DSModelElementSelection()  # 1 picked in the model; graph input
# note: Custom Package: BimorphNodes v.3.0.3
ofCategory = Revit.LinkElement.OfCategory(linkInstance=select_model_link_instance, Category=pick_a_category)
id_2 = Element.Id(element=ofCategory)
contains = List.Contains(list=id, item=id_2, lacing=Longest)
filterByBoolMask = List.FilterByBoolMask(list=all_elements_of_category, mask=contains)
code_block = CodeBlock { "Comments"; "New"; }
setParameterByName = Element.SetParameterByName(element=filterByBoolMask.out, parameterName=code_block.out0, value=code_block.out1)
filterByBoolMask_2 = List.FilterByBoolMask(list=id, mask=contains)
indexOf = List.IndexOf(list=id_2, element=filterByBoolMask_2.in)
getItemAtIndex = List.GetItemAtIndex(list=ofCategory, index=indexOf)
boundingBox = Element.BoundingBox(element=getItemAtIndex)
toCuboid = BoundingBox.ToCuboid(boundingBox=boundingBox)
centroid = Solid.Centroid(solid=toCuboid)
code_block_2 = CodeBlock(p=centroid) { p.X; p.Y; }
byCoordinates = Point.ByCoordinates(x=code_block_2.out0, y=code_block_2.out1)
boundingBox_2 = Element.BoundingBox(element=filterByBoolMask.in)
toCuboid_2 = BoundingBox.ToCuboid(boundingBox=boundingBox_2)
centroid_2 = Solid.Centroid(solid=toCuboid_2)
code_block_3 = CodeBlock(p=centroid_2) { p.X; p.Y; }
byCoordinates_2 = Point.ByCoordinates(x=code_block_3.out0, y=code_block_3.out1)
distanceTo = Geometry.DistanceTo(geometry=byCoordinates, other=byCoordinates_2)
tolerance_mm = DoubleInput(800)  # graph input
gt = distanceTo > tolerance_mm
filterByBoolMask_3 = List.FilterByBoolMask(list=filterByBoolMask.in, mask=gt)
code_block_4 = CodeBlock { "Comments"; "Moved"; "Matching"; }
setParameterByName_2 = Element.SetParameterByName(element=filterByBoolMask_3.in, parameterName=code_block_4.out0, value=code_block_4.out1)
setParameterByName_3 = Element.SetParameterByName(element=filterByBoolMask_3.out, parameterName=code_block_4.out0, value=code_block_4.out2)
