# Dynamo graph ABG_211025_BlockToFamily.dyn "Demo script" (Dynamo 2.6.1.8786)
# packages: Genius Loci 2021.2.3, Crumple 2021.9.24

code_block = CodeBlock { "Testing"; }
select_model_element = DSModelElementSelection()  # 1 picked in the model
cad_block = Custom[CAD Block](importInstance=select_model_element)  # package Genius Loci; Get the location point, name and layer of the CAD blocks / XRefs from a CAD link or import.
byFamilyNameAndTypeName = FamilyType.ByFamilyNameAndTypeName(familyName=code_block, typeName=cad_block.BlockName)
levels = Levels("Level 0")
byPointAndLevel = FamilyInstance.ByPointAndLevel(familyType=byFamilyNameAndTypeName, point=cad_block.OriginPoint, level=levels)
code_block_2 = CodeBlock { -1; }
mul = cad_block.Rotation * code_block_2
setRotation = FamilyInstance.SetRotation(familyInstance=byPointAndLevel, degree=mul)
arealinesbycurves = Custom[© AreaLinesByCurves]()  # package Crumple; Given a list of Dynamo curves, the node generates area boundary lines along them in the given view. For convenience of iterability, this node flattens the curve list by default.; unwired: curves
