# Dynamo graph ABG_211028_ReplaceParameters.dyn "BG_Family-ReplaceParameters [2.3.0]" (Dynamo 2.3.1.11775)
# packages: Crumple 2021.9.24

# note: Custom Node: Crumple v.2021.9.24
familydocparameters = Custom[© FamilyDocParameters]()  # package Crumple; Obtains all parameters in a family document, as well as their properties.
code_block = CodeBlock(e=familydocparameters.elements, n=familydocparameters.names, g=familydocparameters.groups, s=familydocparameters.isShared, i=familydocparameters.isInstance) { [e,n,g,s,i]; }
code_block_2 = CodeBlock { "BG_"; false; }
startsWith = String.StartsWith(str=familydocparameters.names, searchFor=code_block_2.out0, ignoreCase=code_block_2.out1)
filterByBoolMask = List.FilterByBoolMask(list=code_block@L2, mask=startsWith)
code_block_3 = CodeBlock(data=filterByBoolMask.in) { e = data[0]; n = data[1]; }
code_block_4 = CodeBlock { "BG_"; "TEMP_"; }
replace = String.Replace(str=code_block_3.n, searchFor=code_block_4.out0, replaceWith=code_block_4.out1)
familydocreplacesharedparameter = Custom[© FamilyDocReplaceSharedParameter](parameters=code_block_3.e, newNames=replace)  # package Crumple; Given some shared parameters in a family document, replaces them with new family parameters with the chosen names.
sharedparameterdefinitions = Custom[© SharedParameterDefinitions]()  # package Crumple; Returns the currently available shared parameters, their groups and the external definitions for both.
string = StringInput("BG_")
replace_2 = String.Replace(str=replace, searchFor=code_block_4.out1, replaceWith=string)
code_block_5 = CodeBlock(deflst=sharedparameterdefinitions.paramDefs, namlst=sharedparameterdefinitions.paramNames, newnames=replace_2)
# ---------- code_block_5.designscript (4 lines) ----------
defs    = DSCore.List.Flatten(deflst);
names   = DSCore.List.Flatten(namlst);
indices = DSCore.List.IndexOf(names, newnames);
defs[indices];
# ----------------------------------------
familydocreplaceparameter = Custom[© FamilyDocReplaceParameter](parameters=familydocreplacesharedparameter.elements, exDefs=code_block_5.out3)  # package Crumple; Given some family parameters in a document, replace them with new shared parameters with the chosen external definitions.
