# Dynamo graph ABG_220625_ReplaceParameters.dyn "Replace parameters example" (Dynamo 2.3.1.11775)
# packages: Crumple 2022.5.27

# group: Names before/after and temp names
code_block = CodeBlock { ["PARAMETER A","PARAMETER B","PARAMETER C"]; ["PARAMETER D","PARAMETER E","PARAMETER F"]; }
code_block_2 = CodeBlock(pn=code_block.out0) { "TEMP_"+ pn; }

# group: Get parameters from names in family
familydoc_parameters = Custom[© FamilyDoc.Parameters]()  # package Crumple; Obtains all parameters in a family document, as well as their properties.
indexOf = List.IndexOf(list=familydoc_parameters.names@L2, element=code_block.out0@L1, lacing=Longest)
getItemAtIndex = List.GetItemAtIndex(list=familydoc_parameters.elements, index=indexOf)

# group: Get parameters to set after
sharedparameters_flat = Custom[© SharedParameters.Flat]()  # package Crumple; Returns all shared parameters as definition and name, as well as their corresponding group and name.
indexOf_2 = List.IndexOf(list=sharedparameters_flat.paramNames@L2, element=code_block.out1@L1, lacing=Longest)
getItemAtIndex_2 = List.GetItemAtIndex(list=sharedparameters_flat.paramDefs, index=indexOf_2)

# group: Replace parameter (2 steps needed)
familydoc_replacesharedparameter = Custom[© FamilyDoc.ReplaceSharedParameter](parameters=getItemAtIndex, newNames=code_block_2)  # package Crumple; Given some shared parameters in a family document, replaces them with new family parameters with the chosen names.
familydoc_replaceparameter = Custom[© FamilyDoc.ReplaceParameter](parameters=familydoc_replacesharedparameter.elements, exDefs=getItemAtIndex_2)  # package Crumple; Given some family parameters in a document, replace them with new shared parameters with the chosen external definitions.
