# Dynamo graph ABG_220826_D1000.dyn "D1000" (Dynamo 2.3.1.11775)

examples_of_inputs_it_can_work = CodeBlock()  # "Examples of inputs it can work with"
# ---------- examples_of_inputs_it_can_work.designscript (19 lines) ----------
// An OK piece of data
5;
[1,2,3];

// Passes, but it notices
"Strings are iterable";
[];
"";
[[1,2,3],[4,5,6]];

// Error catching
null;
[1,2,3,null,4,5];
1..1000..1;

// Easter egg
"Tell me a joke";
"I love you";
"I hate you";
# ----------------------------------------

# group: D1000
your_data_here = CodeBlock(data=examples_of_inputs_it_can_work.out0) { data; }
catch_lists_bigger_than = DoubleInput(100)  # graph input
wait_for_d1000_to_finish_talking = BoolSelector(false)
# note: Made for fun by Gavin Crump
D1000 = Python(IN[0]=your_data_here, IN[1]=catch_lists_bigger_than, IN[2]=wait_for_d1000_to_finish_talking)
# ---------- D1000.python (122 lines) ----------
# Made by Gavin Crump
# Free for use
# BIM Guru, www.bimguru.com.au
# Made for fun only. Practice responsible data management

# || Boilerplate text ||
import clr
clr.AddReference("RevitAPIUI")
from Autodesk.Revit.UI import *

clr.AddReference('System.Speech')
from System.Speech.Synthesis import SpeechSynthesizer

# || Functions ||

# Text to speech
def dynaTalk(txt,wait=False,vol=50,rate=1):
	# Cancel the speech
	SpeechSynthesizer.SpeakAsyncCancelAll
	# Make a new one
	ss = SpeechSynthesizer
	ss = SpeechSynthesizer()
	ss.Volume = vol
	ss.Rate = rate
	if wait:
		ss.Speak(msg)
	else:
		ss.SpeakAsync(msg)
	return None

# Check list depth
def depth(obj):
	try:
		return isinstance(obj, list) and max(map(depth, obj))+1
	except:
		return 0

# Safeguard the object length in case it throws off the len function
def safeLen(obj):
	try:
		return len(IN[0])
	except:
		return 1

# Initial check for list depth
if hasattr(IN[0], '__iter__'):
	objDep = depth(IN[0])
else:
	objDep = 1

# Easter egg jokebook
if IN[0] == "Tell me a joke":
	# Make the book
	jokebook = []

	jokebook.append("A programmer goes to the shops with a shopping list. It says. Buy a loaf of bread, then if they have eggs, buy a dozen. They come home with thirteen loafs of bread.")
	jokebook.append("Why do Python programmers wear glasses? Because they don't see sharp.")
	jokebook.append("A programmer's wife is going out, and asks him if he can mow the lawn while she is out. When she gets back, he is relieved that he can finally stop mowing the lawn.")
	jokebook.append("Why did the programmer quit? Because they didn't get arrays.")
	jokebook.append("There are 1 type of people that understand binary.")
	jokebook.append("Why do Python programmers hold their breath so well? They work below sea level")
	jokebook.append("the secret to learning recursion is"*5 + ". you get the idea")
	
	import random
	ind = random.randint(0, len(jokebook)-1)
	obj = "Hahaha"
	msg = jokebook[ind]
# Easter egg desperation
elif IN[0] == "I love you":
	obj = "<3"
	msg = "I love me too."
# Easter egg mean
elif IN[0] == "I hate you":
	obj = ":@"
	msg = "Is that what you say to the friends you don't have as well?"
# Now let's be serious
elif objDep > 1:
	obj = IN[0]
	msg = "I see some nested lists. " + str(objDep) + " levels deep. My author got a bit lazy here. Let's keep this between us, OK?"
# Deal with noniterables
elif not hasattr(IN[0], '__iter__'):
	# Is it a null
	if IN[0] == None:
		obj = []
		msg = "Nom nom nom, I eat nulls like you for breakfast."
	# Is it a string
	elif isinstance(IN[0],str):
		if IN[0] == "":
			obj = IN[0]
			msg = "A programmer of few words it seems."
		else:
			obj = IN[0]
			msg = "A string. Technically itterable, but you don't trick me that easily."
	# Otherwise we pass it on
	else:
		obj = IN[0]
		msg = "Looks good to me. Thunderbird is go."
# Catch if the object is too large
elif safeLen(IN[0]) > int(IN[1]):
	obj = []
	msg = "My list is too big. " + str(len(IN[0])) + " objects for me, none for you."
# Clean out nulls if found
elif None in IN[0]:
	newLst = []
	for n in IN[0]:
		if n != None:
			newLst.append(n)
	obj = newLst
	msg = "Looks like we have some nulls in there, let me remove those for you."
# Empty list
elif safeLen(IN[0]) < 1:
	obj = IN[0]
	msg = "That's an empty list, but you can have it."
# No issues otherwise
else:
	obj = IN[0]
	msg = "Looks good to me. Thunderbirds are go."

dynaTalk(msg,IN[2])

# Get output
OUT = obj
# ----------------------------------------
what_you_get_from_d1000 = Watch(D1000)
