# Dynamo graph ABG_230521_Set parameters by excel.dyn "Set parameters by excel" (Dynamo 2.12.1.8246)
# packages: Crumple 2022.5.27

# group: Open family documents
directory_path = Directory("C:\Users\Gavin\Desktop\Families")
code_block = CodeBlock { ".rfa"; false; }
windows_directorycontents = Custom[© Windows.DirectoryContents](directoryPath=directory_path, searchString=code_block.out0, deepSearch=code_block.out1)  # package Crumple; Be aware there is an OOTB node that can do this, but I wanted to add this to the package so others can see how to use a Python method as a starter block in other scripts.
familydoc_open = Custom[© FamilyDoc.Open](filePaths=windows_directorycontents)  # package Crumple; Given a file path to a family, attempts to open that document in the background in Revit if possible. Should not be used for regular models/templates.

# group: Get Excel data
file_path = Filename(".\Family data to set.xlsx")
code_block_2 = CodeBlock { "Sheet1"; 0; 0; true; }
openXMLImportExcel = Data.OpenXMLImportExcel(filePath=file_path, sheetName=code_block_2.out0, startRow=code_block_2.out1, startColumn=code_block_2.out2, readAsString=code_block_2.out3)
# note: This will be each row in Excel except the headers. Family/Type then values in order of parameter names to set. Note that currently all values are text, so you may need to adjust some of the value object types if not text (e.g. numbers, booleans etc.).
deconstruct = List.Deconstruct(list=openXMLImportExcel)
code_block_3 = CodeBlock { 2; }
# note: This will be the names of parameters to set for each type in each family
dropItems = List.DropItems(list=deconstruct.first, amount=code_block_3)

# group: Set parameters by Excel data matching
# note: This node will look at each Excel row, then retrieve the family document and its type for each row. It will then take all remaining values and for each parameter name in the same order will set its value. Note that all parameters, types, families and values must be possible to set - otherwise this node will break. It can be adjusted to be more flexible, but would take a lot of work.
python_script_set_parameter = Python(IN[0]=familydoc_open.familyDocs, IN[1]=dropItems, IN[2]=deconstruct.rest)  # "Python Script (Set parameter value by Excel)"; IronPython2
# ---------- python_script_set_parameter.python (83 lines) ----------
# Made by Gavin Crump
# Free for use
# BIM Guru, www.bimguru.com.au

# Boilerplate text
import clr

clr.AddReference("RevitServices")
import RevitServices
from RevitServices.Persistence import DocumentManager
from RevitServices.Transactions import TransactionManager 

clr.AddReference("RevitAPI")
import Autodesk 
from Autodesk.Revit.DB import *

# Preparing input from dynamo to revit
famDocs  = IN[0]
famNames = [f.Title for f in famDocs]

# Get all the data we need to check vs excel
famTypesList, famTypeNamesList, famNames, famParamsList, famParamNamesList, = [],[],[],[],[]

for f in famDocs:
	# Get family name and manager
	famMan = f.FamilyManager
	famNames.append(f.Title)
	# Get type data
	famTypes  = list(famMan.Types)
	typeNames = [f.Name for f in famTypes]
	famTypesList.append(famTypes)
	famTypeNamesList.append(typeNames)
	# Get paramaters
	params = famMan.GetParameters()
	paramNames = [p.Definition.Name for p in params]
	famParamsList.append(params)
	famParamNamesList.append(paramNames)

# Function to set family parameter value for a type
def setFamilyParam(famDoc,p,t,v):
	try:
		famMan = famDoc.FamilyManager
		famMan.CurrentType = t
		famMan.Set(p,v)
		return True
	except:
		return False

# Work through excel data
paramNames = IN[1]
excelData  = IN[2]

outcomesList = []

for row in excelData:
	# Results for this row
	outcomes = []
	# Get the family
	famInd = famNames.index(row[0])
	famDoc = famDocs[famInd]
	# Get the type
	typeInd = famTypeNamesList[famInd].index(row[1])
	famType = famTypesList[famInd][typeInd]
	# Limit to the parameter columns
	values = row[2:]
	# Start a transaction in the family document
	t = Transaction(famDoc, row[0]+" - "+row[1])
	t.Start()
	# For each param/value pair for this type...
	for p,v in zip(paramNames,values):
		# Get the parameter
		parInd = famParamNamesList[famInd].index(p)
		famPar = famParamsList[famInd][parInd]
		# Set the parameter
		setParam = setFamilyParam(famDoc,famPar,famType,v)
		outcomes.append(setParam)
	# Commit the transaction
	t.Commit()
	# Append outcomes to list
	outcomesList.append(outcomes)

# Preparing output to Dynamo
OUT = outcomesList
# ----------------------------------------

# group: Close family documents once changes are made
flow_waitfor = Custom[© Flow.WaitFor](data=familydoc_open.familyDocs, waitFor=python_script_set_parameter)  # package Crumple; Tells the first input to wait for the second input to arrive, then passes on the first input. Really useful for scripts which have branching paths that rely on their outputs to carry each other forward. Quite a few custom packages have a 'passthrough' or 'waitfor' node. I use these all the time, so find it useful to have them contained in this package also.
code_block_4 = CodeBlock { true; }
familydoc_close = Custom[© FamilyDoc.Close](familyDoc=flow_waitfor, saveOption=code_block_4)  # package Crumple; Given documents in the unwrapped state, attempts to close then with the option to save them (applies to all documents, one input expected, not a list).
