# Dynamo graph ABG_230615_DoorHandFlipped.dyn "Set hand flipped property" (Dynamo 2.12.1.8246)

code_block = CodeBlock { "Doors"; }
byName = Category.ByName(name=code_block)
all_elements_of_category = ElementsOfCategory(Category=byName)
code_block_2 = CodeBlock { "Type"; "BG_DAT_Class1"; }
getParameterValueByName = Element.GetParameterValueByName(element=all_elements_of_category, parameterName=code_block_2.out0)
getParameterValueByName_2 = Element.GetParameterValueByName(element=getParameterValueByName, parameterName=code_block_2.out1)
code_block_3 = CodeBlock(v=getParameterValueByName_2) { v == "DOOR"; }
filterByBoolMask = List.FilterByBoolMask(list=all_elements_of_category, mask=code_block_3)
hand_flipped_parameter = StringInput("BG_DAT_IsMirrored1")  # graph input
# note: From Crumple
is_hand_flipped = Python(IN[0]=filterByBoolMask.in)  # CPython3
# ---------- is_hand_flipped.python (25 lines) ----------
# Made by Gavin Crump
# Free for use
# BIM Guru, www.bimguru.com.au

# Boilerplate text
import clr
clr.AddReference("RevitAPI")

# Define list/unwrap list functions
def uwlist(input):
    result = input if isinstance(input, list) else [input]
    return UnwrapElement(input)

# Preparing input from dynamo to revit
uw_list  = uwlist(IN[0])

flips = []

for i in uw_list:
	flip = 1 if i.HandFlipped else 0
	face = 1 if i.FacingFlipped else 0	
	flips.append(flip+face == 1)

# Preparing output to Dynamo
OUT = flips
# ----------------------------------------
setParameterByName = Element.SetParameterByName(element=filterByBoolMask.in, parameterName=hand_flipped_parameter, value=is_hand_flipped)
