# Dynamo graph ABG_230619_ViewToSheets.dyn "Final script - Place views on sheets" (Dynamo 2.13.1.3887)

# group: Read and process excel data
file_path = Filename("C:\Users\Gavin\Desktop\Match list.xlsx")  # graph input
worksheet_name = StringInput("Sheet1")  # graph input
code_block = CodeBlock { "Sheet1"; 1; 0; true; }
openXMLImportExcel = Data.OpenXMLImportExcel(filePath=file_path, sheetName=worksheet_name, startRow=code_block.out1, startColumn=code_block.out2)
transpose = List.Transpose(lists=openXMLImportExcel)
code_block_2 = CodeBlock(data=transpose) { vpn = data[1] + "_" + data[0]; sht = data[2]; vpid = data[3]; sht + ", " + vpn; }

# group: Run the Python script (place viewports)
python_script_try_to_place = Python(IN[0]=code_block_2.vpn, IN[1]=code_block_2.sht, IN[2]=code_block_2.vpid)  # "Python Script (Try to place viewports, then report the outcomes)"; IronPython2
# ---------- python_script_try_to_place.python (120 lines) ----------
# Boilerplate text
import clr

clr.AddReference("RevitNodes")
import Revit
clr.ImportExtensions(Revit.Elements)

clr.AddReference("RevitServices")
import RevitServices
from RevitServices.Persistence import DocumentManager 
from RevitServices.Transactions import TransactionManager 

clr.AddReference("RevitAPI")
import Autodesk 
from Autodesk.Revit.DB import *

# Current doc/app/ui
doc = DocumentManager.Instance.CurrentDBDocument

# Preparing input from dynamo to revit
xclViews  = IN[0]
xclSheets = IN[1]
xclVpIds  = IN[2]

# All plans and sheets
viewPlans  = FilteredElementCollector(doc).OfClass(ViewPlan).WhereElementIsNotElementType().ToElements()
viewSheets = FilteredElementCollector(doc).OfClass(ViewSheet).WhereElementIsNotElementType().ToElements()

# All names for them
def getMatchName(viewPlan):
	vtn = str(viewPlan.ViewType)
	mpn = vtn + "_" + viewPlan.Name
	return mpn

planNames = [getMatchName(viewPlan) for viewPlan in viewPlans]
sheetNos  = [viewSheet.SheetNumber for viewSheet in viewSheets]

def crossIndex(name, names, elements):
	ind = names.index(name)
	return elements[ind]

# Do some action in a Transaction
TransactionManager.Instance.EnsureInTransaction(doc)

# Try to place viewports
viewports, report = [], []

for xclView,xclSheet,xclVpId in zip(xclViews,xclSheets,xclVpIds):
	
	# Set empty error state
	errors = []
	errorMet = False
	
	# Try to get sheet
	if xclSheet in sheetNos:
		# Report we found it
		errors.append(False)
		# Get matching sheet
		sheet = crossIndex(xclSheet, sheetNos, viewSheets)
	# Sheet not found
	else:
		# Error report
		sheet = None
		errors.append(True)
		errorMet = True
	
	# Try to get view
	if xclView in planNames:
		# Report view found
		errors.append(False)
		# Get matching view
		viewPlan = crossIndex(xclView, planNames, viewPlans)
		# Can it be placed on the sheet
		if sheet != None:
			# Check the view can placed on it
			if Viewport.CanAddViewToSheet(doc, sheet.Id, viewPlan.Id):
				# Report it can be placed
				errors.append(False)
			else:
				# Report that it cant
				errors.append(True)
				errorMet = True
		# No sheet found
		else:
			errors.append(True)
			errorMet = True
	# View not found
	else:
		errors.append(True)
		errors.append(True)
		errorMet = True
	
	# Check viewport has a location and exists
	try:
		# get viewport location
		vpId = ElementId(int(xclVpId))
		vp   = doc.GetElement(vpId)
		pt   = vp.GetBoxCenter()
		# Report no errors
		errors.append(False)
	# If it didnt work, error
	except:
		pt = None
		errors.append(True)
		errorMet = True
	
	# If error hit, pass
	if errorMet:
		viewport = None
	else:
		viewport = Viewport.Create(doc, sheet.Id, viewPlan.Id, pt).ToDSType(False)
	
	# Append the outcomes
	viewports.append(viewport)
	report.append(errors)

TransactionManager.Instance.TransactionTaskDone()

# Preparing output to Dynamo
OUT = viewports, report
# ----------------------------------------
code_block_3 = CodeBlock(out=python_script_try_to_place) { viewports = out[0]; errors    = out[1]; }

# group: Viewports created
code_block_4 = CodeBlock { false; }
clean = List.Clean(list=code_block_3.viewports, preserveIndices=code_block_4)
viewports_created = Watch(clean)  # graph output

# group: Process error reports
code_block_5 = CodeBlock { ", "; }
code_block_6 = CodeBlock()
# ---------- code_block_6.designscript (4 lines) ----------
["Sheet not found",
"View not found",
"View cannot be placed",
"Reference viewport not found"];
# ----------------------------------------
filterByBoolMask = List.FilterByBoolMask(list=code_block_6@L2, mask=code_block_3.errors@L2, lacing=Longest)
join = String.Join(separator=code_block_5, string0=filterByBoolMask.in)
code_block_7 = CodeBlock(x=join) { rpt = x[0]; rpt == ""; }

# group: Filter the outcomes
filterByBoolMask_2 = List.FilterByBoolMask(list=code_block_2.out3, mask=code_block_7.out1)
filterByBoolMask_3 = List.FilterByBoolMask(list=code_block_7.rpt, mask=code_block_7.out1)

# group: Report the outcomes
viewports_not_made_for = Watch(filterByBoolMask_2.out)  # graph output
error_reports = Watch(filterByBoolMask_3.out)  # graph output
