# Dynamo graph ABG_230818_FloorThresholds.dyn (Dynamo 2.16.1.2727)
# packages: Clockwork for Dynamo 2.x 2.6.0

# group: Get rooms and doors
rooms_by_status = RoomsByStatus()
doors = Custom[Room.Doors](room=rooms_by_status.PlacedRooms)  # package Clockwork for Dynamo 2.x; Retrieves all doors that are associated with a room (hosted in walls and roofs).

# group: Get room surfaces
finishBoundary = Room.FinishBoundary(room=rooms_by_status.PlacedRooms)
byJoinedCurves = PolyCurve.ByJoinedCurves(curves=finishBoundary)
firstItem = List.FirstItem(list=byJoinedCurves@L2)
byPatch = Surface.ByPatch(closedCurve=firstItem)

# group: Get curve at door centre
getLocation = Element.GetLocation(element=doors)
closestPointTo = Geometry.ClosestPointTo(geometry=byPatch, other=getLocation)
byStartPointEndPoint = Line.ByStartPointEndPoint(startPoint=getLocation, endPoint=closestPointTo)

# group: Get door width as type parameter
elementType = Element.ElementType(element=doors)
code_block = CodeBlock { "Width"; }
getParameterValueByName = Element.GetParameterValueByName(element=elementType, parameterName=code_block)
code_block_2 = CodeBlock(w=getParameterValueByName) { w*-0.5; w; }

# group: Make door thresholds
code_block_3 = CodeBlock { 0.5; }
normalAtParameter = Curve.NormalAtParameter(curve=byStartPointEndPoint, param=code_block_3)
translate = Geometry.Translate(geometry=byStartPointEndPoint, direction=normalAtParameter, distance=code_block_2.out0)
extrude = Curve.Extrude(curve=translate, direction=normalAtParameter, distance=code_block_2.w)

# group: Make doors with thresholds
addItemToFront = List.AddItemToFront(item=byPatch@L1, list=extrude@L2, lacing=Longest)
byUnion = Surface.ByUnion(surfaces=addItemToFront)
perimeterCurves = Surface.PerimeterCurves(surface=byUnion)

# group: Make floor at level/type
floor_types = FloorTypes("Floor 1")
levels = Levels("Level 1")
byOutlineTypeAndLevel = Floor.ByOutlineTypeAndLevel(outlineCurves=perimeterCurves, floorType=floor_types, level=levels)
