# Dynamo graph ABG_240106_Nuke.dyn "Nuke demo" (Dynamo 2.17.1.4055)
# author: Gavin
# Attempts to delete elements based on your options. Use carefully!

views = BoolSelector(false)  # graph input
legends = BoolSelector(false)  # graph input
schedules = BoolSelector(false)  # graph input
sheets = BoolSelector(false)  # graph input
view_templates = BoolSelector(false)  # graph input
view_filters = BoolSelector(false)  # graph input
revit_links = BoolSelector(false)  # graph input
cad_links = BoolSelector(false)  # graph input
list_create = List.Create(item0=views, item1=legends, item2=schedules, item3=sheets, item4=view_templates, item5=view_filters, item6=revit_links, item7=cad_links)
python_script = Python(IN[0]=list_create)  # IronPython2
# ---------- python_script.python (99 lines) ----------
# Made by Gavin Crump
# Free for use
# BIM Guru, www.bimguru.com.au

# Boilerplate text
import clr

clr.AddReference("RevitServices")
import RevitServices
from RevitServices.Persistence import DocumentManager
from RevitServices.Transactions import TransactionManager

clr.AddReference("RevitAPI")
import Autodesk
from Autodesk.Revit.DB import *

# Current doc/app/ui
doc = DocumentManager.Instance.CurrentDBDocument

# Constants
VIEWTYPE_SHEET = ViewType.DrawingSheet
VIEWTYPE_SCHED = ViewType.Schedule
VIEWTYPE_LEGND = ViewType.Legend

# Function to collect by class
def collect_byClass(rvt_class, myDoc = doc):
	elements = FilteredElementCollector(myDoc).OfClass(rvt_class).ToElements()
	return elements

# Get options
option_views, option_legends, option_schedules,\
option_sheets, option_templates, option_filters,\
option_rvt, option_cad = IN[0]

# Valid view types
VIEWTYPE_VIEWS = [ViewType.FloorPlan, ViewType.CeilingPlan,\
				  ViewType.Elevation, ViewType.ThreeD,\
				  ViewType.DraftingView, ViewType.EngineeringPlan,\
				  ViewType.AreaPlan, ViewType.Section,\
				  ViewType.Detail, ViewType.Rendering]

# Collect view elements
views_all = collect_byClass(View)

elements_toDelete = []

for v in views_all:
	# Get view type
	view_type = v.ViewType
	# If view template
	if v.IsTemplate:
		if option_templates:
			elements_toDelete.append(v)
	# If view
	elif view_type in VIEWTYPE_VIEWS:
		if option_views:
			elements_toDelete.append(v)
	# If sheet
	elif view_type == VIEWTYPE_SHEET:
		if option_sheets:
			elements_toDelete.append(v)
	# If sheet
	elif view_type == VIEWTYPE_SCHED:
		if option_schedules and "<Revision" not in v.Name:
			elements_toDelete.append(v)
	# If sheet
	elif view_type == VIEWTYPE_LEGND:
		if option_legends:
			elements_toDelete.append(v)

# Extra class collection
if option_filters:
	elements_toDelete.extend(collect_byClass(FilterElement))
if option_rvt:
	elements_toDelete.extend(collect_byClass(RevitLinkType))
if option_cad:
	elements_toDelete.extend(collect_byClass(ImportInstance))

# Do some action in a Transaction
elements_failed = []
ids_toDelete = [e.Id for e in elements_toDelete]

TransactionManager.Instance.EnsureInTransaction(doc)

for id in ids_toDelete:
	try:
		doc.Delete(id)
	except:
		try:
			element = doc.GetElement(id)
			if element:
				elements_failed.append(element)
		except:
			pass

TransactionManager.Instance.TransactionTaskDone()

# Preparing output to Dynamo
OUT = elements_failed
# ----------------------------------------
elements_failed_to_delete = Watch(python_script)  # graph output
