# Dynamo graph ABG_240106_Workshared.dyn "CheckedOut" (Dynamo 2.17.1.4055)

select_model_elements = DSModelElementsSelection()  # 6 picked in the model
python_script = Python(IN[0]=select_model_elements)  # IronPython2
# ---------- python_script.python (36 lines) ----------
# Made by Gavin Crump
# Free for use
# BIM Guru, www.bimguru.com.au

# Boilerplate text
import clr

clr.AddReference("RevitServices")
import RevitServices
from RevitServices.Persistence import DocumentManager

clr.AddReference("RevitAPI")
import Autodesk 
from Autodesk.Revit.DB import CheckoutStatus, WorksharingUtils

# Current doc/app/ui
doc = DocumentManager.Instance.CurrentDBDocument

# Global constants
OWNEDBYOTHERUSER = CheckoutStatus.OwnedByOtherUser

# Define list/unwrap list functions
def uwlist(input):
	result = input if isinstance(input, list) else [input]
	return UnwrapElement(result)

# Function to check if element is editable
def element_isEditable(element, myDoc = doc):
	checkout_status = WorksharingUtils.GetCheckoutStatus(myDoc, element.Id)
	return checkout_status != OWNEDBYOTHERUSER

# Preparing input from dynamo to revit
elements = uwlist(IN[0])

# Preparing output to Dynamo
OUT = [element_isEditable(e) for e in elements]
# ----------------------------------------
filterByBoolMask = List.FilterByBoolMask(list=select_model_elements, mask=python_script)
python_script_2 = Python(IN[0]=select_model_elements)  # IronPython2
# ---------- python_script_2.python (45 lines) ----------
# Made by Gavin Crump
# Free for use
# BIM Guru, www.bimguru.com.au

# Boilerplate text
import clr

clr.AddReference("RevitServices")
import RevitServices
from RevitServices.Persistence import DocumentManager

clr.AddReference("RevitAPI")
import Autodesk 
from Autodesk.Revit.DB import CheckoutStatus, WorksharingUtils

# Current doc/app/ui
doc = DocumentManager.Instance.CurrentDBDocument

# Global constants
OWNEDBYOTHERUSER = CheckoutStatus.OwnedByOtherUser

# Define list/unwrap list functions
def uwlist(input):
	result = input if isinstance(input, list) else [input]
	return UnwrapElement(result)

# Function to check if element is editable
def element_isEditable(element, myDoc = doc):
	checkout_status = WorksharingUtils.GetCheckoutStatus(myDoc, element.Id)
	return checkout_status != OWNEDBYOTHERUSER

# Preparing input from dynamo to revit
elements = uwlist(IN[0])

# Check elements
editable, noneditable = [],[]

for e in elements:
	if element_isEditable(e):
		editable.append(e)
	else:
		noneditable.append(e)

# Preparing output to Dynamo
OUT = editable, noneditable
# ----------------------------------------
code_block = CodeBlock(OUT=python_script_2) { editable    = OUT[0]; noneditable = OUT[1]; }
watch = Watch(code_block.noneditable)
