# Dynamo graph ABG_240108_CreateSheets.dyn "Sheet creation" (Dynamo 2.17.1.4055)

file_path = Filename("C:\Users\Gavin\Desktop\Sheet details.xlsx")  # graph input
worksheet = StringInput("Sheet1")  # graph input
code_block = CodeBlock { 0; 0; true; }
openXMLImportExcel = Data.OpenXMLImportExcel(filePath=file_path, sheetName=worksheet, startRow=code_block.out0, startColumn=code_block.out1, readAsString=code_block.out2)
use_titleblock_from_sheet = Sheets("Unnamed")  # graph input
update_existing_sheet_data = BoolSelector(true)  # graph input
python_script = Python(IN[0]=openXMLImportExcel, IN[1]=use_titleblock_from_sheet, IN[2]=update_existing_sheet_data)  # IronPython2
# ---------- python_script.python (72 lines) ----------
# Made by Gavin Crump
# Free for use
# BIM Guru, www.bimguru.com.au

# Boilerplate text
import clr

clr.AddReference("RevitServices")
import RevitServices
from RevitServices.Persistence import DocumentManager
from RevitServices.Transactions import TransactionManager

clr.AddReference("RevitAPI")
import Autodesk 
from Autodesk.Revit.DB import *

# Current doc/app/ui
doc = DocumentManager.Instance.CurrentDBDocument

# Preparing input from dynamo to revit
excel_data = IN[0][1:]
sheet_reference = UnwrapElement(IN[1])
update_sheets = IN[2]

# Get the title block
BIC_TTB = BuiltInCategory.OST_TitleBlocks

ttb_id = FilteredElementCollector(doc, sheet_reference.Id).\
		 OfCategory(BIC_TTB).FirstElement().GetTypeId()

sheets_all = FilteredElementCollector(doc).\
			 OfClass(ViewSheet).ToElements()

numbers_all = [s.SheetNumber for s in sheets_all]

# Create and modify sheets
TransactionManager.Instance.EnsureInTransaction(doc)

sheets_out = []

for row in excel_data:
	# Get row data
	sheet_numb = row[0]
	sheet_name = row[1]
	sheet_sort = row[2]
	# If it exists, get the sheet
	if sheet_numb in numbers_all:
		# Get the sheet
		ind = numbers_all.index(sheet_numb)
		sheet = sheets_all[ind]
		sheets_out.append(sheet)
		# If not updating, make the sheet none
		if not update_sheets:
			sheet = None
	# If it doesn't, create sheet
	else:
		sheet = ViewSheet.Create(doc, ttb_id)
		sheets_out.append(sheet)
		sheet.SheetNumber = sheet_numb
	# If we want to update, go for it!
	if sheet:
		sheet.Name = sheet_name
		try:
			par = sheet.LookupParameter("SORT")
			par.Set(sheet_sort)
		except:
			pass

TransactionManager.Instance.TransactionTaskDone()

# Preparing output to Dynamo
OUT = sheets_out
# ----------------------------------------
sheets_created_found = Watch(python_script)  # graph output
