# Dynamo graph ABG_240108_UnhideAll.dyn "Unhide script final" (Dynamo 2.17.1.4055)

choose_run_mode = CustomSelection("Just report elements", items={Just report elements: "1", Select the elements (stay in hidden mode): "2", Unhide the elements in view: "3"})  # graph input
python_script = Python(IN[0]=choose_run_mode)  # IronPython2
# ---------- python_script.python (77 lines) ----------
# Made by Gavin Crump
# Free for use
# BIM Guru, www.bimguru.com.au

# Boilerplate text
import clr

import System
from System.Collections.Generic import List

clr.AddReference("RevitServices")
import RevitServices
from RevitServices.Persistence import DocumentManager
from RevitServices.Transactions import TransactionManager

clr.AddReference("RevitAPI")
import Autodesk
from Autodesk.Revit.DB import *

# Current doc/app/ui
doc = DocumentManager.Instance.CurrentDBDocument
uiapp = DocumentManager.Instance.CurrentUIApplication 
uidoc = uiapp.ActiveUIDocument

view_current = doc.ActiveView

# Preparing input from dynamo to revit
run_mode = IN[0]

VIEW_HIDETEMP = TemporaryViewMode.TemporaryHideIsolate
VIEW_HIDEELEM = TemporaryViewMode.RevealHiddenElements

# Enable view modes
TransactionManager.Instance.EnsureInTransaction(doc)

view_current.DisableTemporaryViewMode(VIEW_HIDETEMP)
view_current.EnableRevealHiddenMode()

TransactionManager.Instance.TransactionTaskDone()

# Get elements in view, check if hidden
elements_hidden = []

elements = FilteredElementCollector(doc, view_current.Id).\
		   WhereElementIsNotElementType().ToElements()

for e in elements:
	try:
		e.Category
		if e.IsHidden(view_current):
			elements_hidden.append(e)
	except:
		pass

# Unhide or select
TransactionManager.Instance.EnsureInTransaction(doc)

if run_mode != 2:
	view_current.DisableTemporaryViewMode(VIEW_HIDEELEM)

if len(elements_hidden) > 0:
	# Make a list of ids
	ids_hidden = List[ElementId]()
	# Add each element to the list
	for e in elements_hidden:
		ids_hidden.Add(e.Id)
	# Option 3 - unhide
	if run_mode == 3:
		view_current.UnhideElements(ids_hidden)
	# Else, option 2 - select
	else:
		uidoc.Selection.SetElementIds(ids_hidden)

TransactionManager.Instance.TransactionTaskDone()

# Preparing output to Dynamo
OUT = elements_hidden
# ----------------------------------------
hidden_elements = Watch(python_script)  # graph output
