# Dynamo graph ABG_240114_RoomPlans.dyn "Room plans by selection" (Dynamo 2.17.1.4055)

view_prefix = StringInput("Room Plan - ")  # graph input
python_script = Python(IN[0]=view_prefix)  # IronPython2
# ---------- python_script.python (50 lines) ----------
# Made by Gavin Crump
# Free for use
# BIM Guru, www.bimguru.com.au

# Boilerplate text
import clr

clr.AddReference("RevitServices")
import RevitServices
from RevitServices.Persistence import DocumentManager 

clr.AddReference("RevitAPI")
import Autodesk 
from Autodesk.Revit.DB import *

# Current doc/app/ui
doc = DocumentManager.Instance.CurrentDBDocument
uiapp = DocumentManager.Instance.CurrentUIApplication 
uidoc = uiapp.ActiveUIDocument

# Prefix
prefix = IN[0]

# Get all the viewplans in the model
viewPlans_all = FilteredElementCollector(doc).OfClass(ViewPlan).WhereElementIsNotElementType().ToElements()

names_all = [v.Name for v in viewPlans_all]

# Get all selected rooms that do not have a view
selected = uidoc.Selection.GetElementIds()

rooms_out, names_out = [],[]

for id in selected:
	# Try to check category
	try:
		e   = doc.GetElement(id)
		cat = e.Category.Name
	except:
		cat = ""
	# Check if room is relevant
	if cat == "Rooms":
		# Check if room has no view
		view_name = prefix + e.Number
		if view_name not in names_all:
			rooms_out.append(e)
			names_out.append(view_name)

# Preparing output to Dynamo
OUT = names_out, rooms_out
# ----------------------------------------
code_block = CodeBlock(OUT=python_script) { names = OUT[0]; rooms = OUT[1]; }

# group: Get outer curves as surface
finishBoundary = Room.FinishBoundary(room=code_block.rooms)
byJoinedCurves = PolyCurve.ByJoinedCurves(curves=finishBoundary)
byPatch = Surface.ByPatch(closedCurve=byJoinedCurves)
area = Surface.Area(surface=byPatch)
sortByKey = List.SortByKey(list=byPatch@L2, keys=area@L2, lacing=Longest)
lastItem = List.LastItem(list=sortByKey.sortedList@L2, lacing=Longest)

# group: Create offset curves
perimeterCurves = Surface.PerimeterCurves(surface=lastItem)
byJoinedCurves_2 = PolyCurve.ByJoinedCurves(curves=perimeterCurves)
number = DoubleInput(1)
code_block_2 = CodeBlock { false; }
offsetMany = PolyCurve.OffsetMany(polyCurve=byJoinedCurves_2, signedDistance=number, extendCircular=code_block_2)

python_script_2 = Python(IN[0]=code_block.names, IN[1]=code_block.rooms, IN[2]=offsetMany)  # IronPython2
# ---------- python_script_2.python (91 lines) ----------
# Made by Gavin Crump
# Free for use
# BIM Guru, www.bimguru.com.au

# Boilerplate text
import clr

clr.AddReference('ProtoGeometry')
from Autodesk.DesignScript.Geometry import *

clr.AddReference("RevitNodes")
import Revit
clr.ImportExtensions(Revit.Elements)
clr.ImportExtensions(Revit.GeometryConversion)

clr.AddReference("RevitServices")
import RevitServices
from RevitServices.Persistence import DocumentManager 
from RevitServices.Transactions import TransactionManager 

clr.AddReference("RevitAPI")
import Autodesk 
from Autodesk.Revit.DB import *

# Current doc/app/ui
doc = DocumentManager.Instance.CurrentDBDocument

# Define list/unwrap list functions
def tolist(input):
    result = input if isinstance(input, list) else [input]
    return result

def uwlist(input):
    result = input if isinstance(input, list) else [input]
    return UnwrapElement(result)

def createPlan(room, name, typeId):
	# Get level id of room
	levelId = room.LevelId
	# Create view
	view = ViewPlan.Create(doc, typeId, levelId)
	view.Name = name
	# Return view
	return view

def cropPlanView(view, polycurve):
	# Get crop manager
	region_man = view.GetCropRegionShapeManager()
	# Get revit curves from pc
	curves_dyn = PolyCurve.Curves(polycurve)
	# Make a curveloop
	curveloop = CurveLoop()
	for c in curves_dyn:
		c_rvt = c.ToRevitType()
		curveloop.Append(c_rvt)
	# Make sure crop is on
	view.CropBoxActive = True
	view.CropBoxVisible = True
	# Set the crop shape
	region_man.SetCropShape(curveloop)

# Preparing input from dynamo to revit
names = tolist(IN[0])
rooms = uwlist(IN[1])
polyCurves = tolist(IN[2])

# Get active view type Id
view_active = doc.ActiveView
viewtype_id = view_active.GetTypeId()

# Create and crop plan views per room
views_out = []

TransactionManager.Instance.EnsureInTransaction(doc)

for r,n,p in zip(rooms,names,polyCurves):
	# Create a plan
	view = createPlan(r, n, viewtype_id)
	# Crop the view
	cropPlanView(view, p)
	# Append the view
	views_out.append(view)

TransactionManager.Instance.TransactionTaskDone()

# Output and Changing element to Dynamo for export
# <element>.ToDSType(True), #Not created in script, mark as Revit-owned
# <element>.ToDSType(False) #Created in script, mark as non-Revit-owned

# Preparing output to Dynamo
OUT = views_out
# ----------------------------------------
views_created = Watch(python_script_2)  # graph output
names_of_views = Watch(code_block.names)  # graph output
