# Dynamo graph ABG_240302_LinkTransforms.dyn (Dynamo 2.17.1.4055)
# packages: Crumple 2022.5.27

select_model_element = DSModelElementSelection()  # 1 picked in the model
categories = Categories("OST_Walls")
elements_bylinkandcategory = Custom[© Elements.ByLinkAndCategory](linkInstance=select_model_element, categories=categories)  # package Crumple; Returns all elements of any number of categories in a single Revit Model link instance.
geometry = Element.Geometry(element=elements_bylinkandcategory)
flatten = List.Flatten(list=geometry)
byOrigin = CoordinateSystem.ByOrigin()
coordinates_getlinktransform = Custom[© Coordinates.GetLinkTransform](linkInstance=select_model_element)  # package Crumple; Given a Revit link instance, returns the coordinate system for transformation of location.
transform = Geometry.Transform(geometry=flatten, fromCoordinateSystem=byOrigin, contextCoordinateSystem=coordinates_getlinktransform)
