# Dynamo graph ABG_240319_ViewFromSunCrumple.dyn "View from sun" (Dynamo 2.12.1.8246)
# packages: Crumple 2024.3.1

year = IntegerSlider(2024, range=2024..2030 step 1)  # graph input
month = IntegerSlider(6, range=1..12 step 1)  # graph input
days = IntegerSlider(21, range=1..31 step 1)  # graph input
start_time = IntegerSlider(9, range=0..23 step 1)  # graph input
end_time = IntegerSlider(15, range=0..23 step 1)  # graph input
time_step = DoubleInput(1)  # graph input
datetime_analysisperiod = Custom[© DateTime.AnalysisPeriod](year=year, month=month, day=days, startHour=start_time, endHour=end_time, timeStep=time_step)  # package Crumple; Constructs a series of DateTime objects from a year, month, day, start time, end time and time step.
datetime_sundirection = Custom[© DateTime.SunDirection](dateTimes=datetime_analysisperiod.dateTimes)  # package Crumple; Given a list of datetimes, attempts to return the direction of the sun in the model as both a vector and XYZ object (taking true north into account).
view_prefix = StringInput("View from sun_")  # graph input
add = view_prefix + datetime_analysisperiod.viewNames
viewfamilytypes_getbyname3d = Custom[© ViewFamilyTypes.GetByName3D]()  # package Crumple; Tries to return an 3D view type with the given name, if one exists in the model.
views_fromsun = Custom[© Views.FromSun](sunDirections=datetime_sundirection, viewNames=add, viewType=viewfamilytypes_getbyname3d.viewFamilyType)  # package Crumple; Given a list of sun directions, view names and a 3D view type this node will create views from the sun. If a view already exists by name, it will be returned but not updated.
views_setsunsettings = Custom[© Views.SetSunSettings](views=views_fromsun, datetimes=datetime_analysisperiod.dateTimes)  # package Crumple; Given a list of views, apply a datetime and shadow intensity setting to their sun settings (still). You will need to update the shadows on/off setting manually or via a view template.
views_created = Watch(views_setsunsettings.views)  # graph output
