# Dynamo graph ABG_240612_CopySpanDirection.dyn "Copy span direction" (Dynamo 2.12.1.8246)

code_block = CodeBlock { true; }
current = Document.Current()
activeView = Document.ActiveView(document=current)
select_model_element = DSModelElementSelection()  # 1 picked in the model
python_script = Python(IN[0]=activeView, IN[1]=select_model_element)  # IronPython2
# ---------- python_script.python (41 lines) ----------
# Made by Gavin Crump
# Free for use
# BIM Guru, www.bimguru.com.au

# Boilerplate text
import clr

from System.Collections.Generic import List

clr.AddReference("RevitServices")
import RevitServices
from RevitServices.Persistence import DocumentManager 
from RevitServices.Transactions import TransactionManager 

clr.AddReference("RevitAPI")
import Autodesk 
from Autodesk.Revit.DB import ElementId, CopyPasteOptions, Transform, XYZ, ElementTransformUtils

# Current doc/app/ui
doc = DocumentManager.Instance.CurrentDBDocument

# Preparing input from dynamo to revit
view = UnwrapElement(IN[0])
tag  = UnwrapElement(IN[1])

# Add the element to a list
eleList = List[ElementId]()
eleList.Add(tag.Id)
# Make basic options and transform
opts = CopyPasteOptions()
tfrm = Transform.CreateTranslation(XYZ(0,0,0))

# Do some action in a Transaction
TransactionManager.Instance.EnsureInTransaction(doc)
# Copy the direction symbol
newEle = ElementTransformUtils.CopyElements(view, eleList, view, tfrm, opts) 
# Close transaction
TransactionManager.Instance.TransactionTaskDone()

# Preparing output to Dynamo
OUT = newEle
# ----------------------------------------
