# Dynamo graph ABG_240804_CrumpleBatchPrint.dyn "test" (Dynamo 2.12.1.8246)
# packages: Crumple 2024.3.1

# group: Select print setting
code_block = CodeBlock { "Select print setting"; }
collect_printsettings = Custom[© Collect.PrintSettings]()  # package Crumple; Returns all print settings in the provided document and their names.
ui_dropdownform = Custom[© UI.DropdownForm](formTitle=code_block, keys=collect_printsettings.settingNames, values=collect_printsettings.printSettings)  # package Crumple; Creates a basic dropdown form from a set of keys and values. If cancelled, the form will return nothing (null).

# group: Select sheets from set
collect_viewsheetsets = Custom[© Collect.ViewSheetSets](docOrLink=ui_dropdownform.chosenValue)  # package Crumple; Returns all view sheet sets in the target document.
code_block_2 = CodeBlock(vss=collect_viewsheetsets) { "Select view sheet set"; vss.Name; vss; }
ui_dropdownform_2 = Custom[© UI.DropdownForm](formTitle=code_block_2.out0, keys=code_block_2.out1, values=code_block_2.vss)
viewsheetsets_views = Custom[© ViewSheetSets.Views](viewSheetSet=ui_dropdownform_2.chosenValue)  # package Crumple; Return all views and sheets in the view sheet set(s).

# group: Process sheet names
code_block_3 = CodeBlock { false; true; true; }
sheets_nameformatted = Custom[© Sheets.NameFormatted](sheets=viewsheetsets_views, includePrjNum=code_block_3.out0, includeRevision=code_block_3.out1, includeName=code_block_3.out2)  # package Crumple; Given a list of sheets, apply a typical naming convention to them with some optional fields such as prefix and separator.

# group: Print pdf's
code_block_4 = CodeBlock { "C:\\Users\\Gavin\\Export folder"; "PDF24"; true; }
revit_printtopdf = Custom[© Revit.PrintToPdf](directoryPath=code_block_4.out0, viewsOrSheets=sheets_nameformatted.sheets, fileNames=sheets_nameformatted.sheetName, printSetting=ui_dropdownform.chosenValue, printerName=code_block_4.out1, runMe=code_block_4.out2)  # package Crumple; Given a list of views and/or sheets as well as various related settings, attempts to print them to PDF. You will need to select and adjust a suitable print driver in order to supress 'save as' dialogues and other potential interruptions the print driver may cause by default. Our suggestion is PDF24, which provides options to prevent dialogues from appearing.

# group: Open directory
flow_waitfor = Custom[© Flow.WaitFor](data=code_block_4.out0, waitFor=revit_printtopdf.wasPrinted)  # package Crumple; Tells the first input to wait for the second input to arrive, then passes on the first input. Really useful for scripts which have branching paths that rely on their outputs to carry each other forward. Quite a few custom packages have a 'passthrough' or 'waitfor' node. I use these all the time, so find it useful to have them contained in this package also.
windows_directoryopen = Custom[© Windows.DirectoryOpen](directoryPath=flow_waitfor)  # package Crumple; Attempts to open a directory path.

# group: Report outputs
filterByBoolMask = List.FilterByBoolMask(list=sheets_nameformatted.sheetName, mask=revit_printtopdf.wasPrinted)
printed = Watch(filterByBoolMask.in)  # graph output
did_not_print = Watch(filterByBoolMask.out)  # graph output
