# Dynamo graph CAD to Revit via family map_R23.dyn (Dynamo 2.16.2.5624)
# packages: Genius Loci 2024.5.29

# group: Get all valid families and their block names from Excel
byFamilyNameAndTypeName = FamilyType.ByFamilyNameAndTypeName()  # unwired: familyName, typeName
excel_data = Filename(".\Block map.xlsx")  # graph input
code_block = CodeBlock { "Sheet1"; 1; true; }
openXMLImportExcel = Data.OpenXMLImportExcel(filePath=excel_data, sheetName=code_block.out0, startRow=code_block.out1, readAsString=code_block.out2)
transpose = List.Transpose(lists=openXMLImportExcel)
code_block_2 = CodeBlock(x=transpose) { x[0]; x[1]; x[2]; }
function_apply = ApplyFunction(function=byFamilyNameAndTypeName, argument0=code_block_2.out0, argument1=code_block_2.out1)
isNull = Object.IsNull(object=function_apply)
filterByBoolMask = List.FilterByBoolMask(list=function_apply, mask=isNull)
filterByBoolMask_2 = List.FilterByBoolMask(list=code_block_2.out2, mask=isNull)

# group: Get CAD Blocks
cad_link_instance = DSModelElementSelection()  # 1 picked in the model; graph input
# note: Genius Loci (needs DSIronPython2.7 v2.5)
cad_block = Custom[CAD Block](importInstance=cad_link_instance)  # package Genius Loci; Get the location point, name and layer of the CAD blocks / XRefs from a CAD link or import. Please note : The non-uniform scaling of blocks is not supported (The X, Y and Z values ​​of the Block Scale must be the same).

# group: Get index of family if it matches (null if it doesn't)
getItemAtIndex = List.GetItemAtIndex(list=filterByBoolMask.out)  # unwired: index
indexOf = List.IndexOf(list=filterByBoolMask_2.out, element=cad_block.BlockName)
function_apply_2 = ApplyFunction(function=getItemAtIndex, argument0=indexOf)

# group: Filter out nulls (no family match)
isNull_2 = Object.IsNull(object=function_apply_2)
filterByBoolMask_3 = List.FilterByBoolMask(list=function_apply_2, mask=isNull_2)
filterByBoolMask_4 = List.FilterByBoolMask(list=cad_block.OriginPoint, mask=isNull_2)
filterByBoolMask_5 = List.FilterByBoolMask(list=cad_block.Rotation, mask=isNull_2)

# group: Place families, set rotation
host_level = Levels("Level 0")  # graph input
byPointAndLevel = FamilyInstance.ByPointAndLevel(level=host_level)  # unwired: familyType, point
function_apply_3 = ApplyFunction(function=byPointAndLevel, argument0=filterByBoolMask_3.out, argument1=filterByBoolMask_4.out)
code_block_3 = CodeBlock(a=filterByBoolMask_5.out) { a-90; }
# note: Genius Loci (needs DSIronPython2.7 v2.5)
element_setrotation = Custom[Element SetRotation](element=function_apply_3, degree=code_block_3)  # package Genius Loci; Set the angle of the element around its local Z-axis. (Same as the Rotate command in Revit)
